# Grasshopper definition mesh quick fixer.gh (Grasshopper 1.0.7)
# Copyright: Co-de-iT
# plug-ins: MeshEdit Components

# ---- group: reference a mesh to weld from Rhino
mesh = Mesh(<mesh referenced from the Rhino model>)

# ----
bbox = BoundingBox(Content=mesh, Plane=PlaneXY(0, 0, 0))  # -> Box, Box_2
weldvertices = MeshWeldVertices(Mesh=mesh, Tolerance=0.01)  # -> RuntimeMessage, Mesh
boxprop = BoxProperties(Box=bbox.Box_2)  # -> Center, Diagonal, Area, Volume, Degeneracy
unifynormals = MeshUnifyNormals(Mesh=weldvertices.Mesh)
devec = DeconstructVector(Vector=boxprop.Diagonal)  # -> XComponent, YComponent, ZComponent
X = UnitX(Factor=expr("x*1.1", devec.XComponent))

# ---- group: bake this back to Rhino
# <title>
# 
# <description>
# 
# code by Alessio Erioli
# 
# v 0.1
# © Co-de-iT 2020 / Creative Commons Attribution-Non Commercial-ShareAlike 4.0 International License
move = Move(Geometry=unifynormals, Motion=X)  # -> Geometry, Transform
