# Grasshopper definition 00-00_AssemblyObject 1 object setup.gh (Grasshopper 1.0.7)
# Copyright: Co-de-iT
# plug-ins: Assembler

# ---- group: a selection of polylines
crv = Curve([<curve referenced from the Rhino model> x7])

# ---- group: all polylines
crv_2 = Curve([<curve referenced from the Rhino model> x20])

# ---- group: type 2
crv_3 = Curve([<curve referenced from the Rhino model> x6])

# ----
crv_4 = Curve([<curve referenced from the Rhino model> x3])

# ---- group: type 1
crv_5 = Curve([<curve referenced from the Rhino model> x7])

# ----
lng = ListLength(List=crv)
rotations = Panel("""0
180""")
weight = Panel("0")
type = Panel("1")
repeat = RepeatData(Data=graft(rotations), Length=lng)
repeat_2 = RepeatData(Data=type, Length=lng)
repeat_3 = RepeatData(Data=weight, Length=lng)
flip = FlipMatrix(Data=repeat)  # -> simplify(Data)

lng_2 = ListLength(List=crv_3)
rotations_2 = Panel("""-90
90""")
weight_2 = Panel("1.0")
type_2 = Panel("2")
repeat_4 = RepeatData(Data=graft(rotations_2), Length=lng_2)
repeat_5 = RepeatData(Data=type_2, Length=lng_2)
repeat_6 = RepeatData(Data=weight_2, Length=lng_2)
flip_2 = FlipMatrix(Data=repeat_4)  # -> simplify(Data)

lng_3 = ListLength(List=crv_5)
# in case you need to specify individual values for each handle, you can use multiple copies of the set above and join the outputs in a Merge component.
# 
# Here's the case for 2 different types and the related rotations and weights
rotations_3 = Panel("""0
180""")
weight_3 = Panel("0")
type_3 = Panel("1")
repeat_7 = RepeatData(Data=graft(rotations_3), Length=lng_3)
repeat_8 = RepeatData(Data=type_3, Length=lng_3)
repeat_9 = RepeatData(Data=weight_3, Length=lng_3)
flip_3 = FlipMatrix(Data=repeat_7)  # -> simplify(Data)

panel = Panel(repeat)
# Assembler
# 
# Framework for Iterative Assemblages workflow
# 
# code by Alessio Erioli
# 
# v 1.0
# © Co-de-iT 2020 / Creative Commons Attribution-Non Commercial-ShareAlike 4.0 International License
panel_2 = Panel(flip)

# ---- group: Create Handles
handle = ConstructHandle(Polyline=crv, RotationAngles=flip, Type=repeat_2, Weight=repeat_3)

handle_2 = ConstructHandle(Polyline=crv_3, RotationAngles=flip_2, Type=repeat_5, Weight=repeat_6)

handle_3 = ConstructHandle(Polyline=crv_5, RotationAngles=flip_3, Type=repeat_8, Weight=repeat_9)

# ----
panel_3 = Panel(handle)
model_abs_size = BooleanToggle(True)
merge = Merge(Data1=flatten(handle_3), Data2=flatten(handle_2))

# ---- group: Display Handles
handdisp = DisplayHandle(Handles=handle, DisplaySize=Slider(0.1, range=0..0.5), ModelScreenSize=model_abs_size)

# ----
# COLLISION MESH: The collision mesh IS NOT the actual geometry of the Object, but a simplified "wrapper" to the actual geometry, used for fast check of collisions. Imagine a wrapped guitar, for instance: the collision geometry is the wrap, the actual geometry is the guitar inside the wrap.
# XDATA: XDATA (X-tra DATA) contains extra information associated with the AssemblyObject, especially in form of geometry. In the wrapped guitar example, XDATA can be the guitar inside the wrap, its instruction sheet, warranty or instructions on how to add/modify parts to it.
# 
# XDATA can contain almost any type of data (Geometry, points, vectors, planes, text). Geometry might be actual, physically intended geometry (such as a wall), but also diagrammatic geometry (such as circulation curves, placeholders, etc.).
# 
# A typical use of XDATA is to insert planes and curves as placeholders to conditionally assign post-assemblage objects and data, once the AssemblyObject is seen in the context of the whole assemblage
image = ImageSampler(
    FilePath="C:\Users\aless\Documents\@ code\GH code\@ Assembler\Example Files\Collision Geometry.jpg",
    Filter="Colour",
    Interpolate=False,
    Umax=1,
    Umin=0,
    Vmax=1,
    Vmin=0,
    Wrap=1)
series = Series(Start=0, Step=1, Count=10)
charseq = CharSequence(Count=10, CharPool="ABCDEFGHIJKLMNOPQRSTUVWXYZ", Format="{0}")

# ---- group: Collision Mesh
mesh = Mesh(<mesh referenced from the Rhino model>)

# ----
merge_2 = Merge(Data1=series, Data2=charseq, Data4=charseq)

# ---- group: volume centroid
volume = Volume(Geometry=mesh)  # -> Volume, Centroid

# ----
name = Panel("block_01")
weight_4 = Panel("1.0")

panel_4 = Panel(merge_2)

# ---- group: direction vector
Y = UnitY(Factor=1)

# ---- group: reference plane
xy = XYPlane(Origin=volume.Centroid)

# ----
crv_6 = Curve([<curve referenced from the Rhino model> x12])
pt = Point([<point referenced from the Rhino model> x7])
brep = Brep([<brep referenced from the Rhino model> x7])
brep_2 = Brep([<brep referenced from the Rhino model> x21])
merge_3 = Merge(Data1=crv_6, Data2=pt)
xdcon = ConstructXData(Label="block_01 body", Data=merge_3, ReferencePlane=xy, AssemblyObjectNameReference=name)

# ---- group: Create AssemblyObject
aocon = ConstructAssemblyObject(Name=name, CollisionMesh=mesh, ReferencePlane=xy, Direction=Y, Weight=weight_4, Handles=handle)

# ----
panel_5 = Panel(xdcon)

self_object = BooleanToggle(True)
self_handle = BooleanToggle(True)
# This component writes the heuristics: all the possible assemblage permutation rules given a set of AssemblyObjects
cross_type = BooleanToggle(False)
heuw = HeuristicsWriter(
    AssemblyObjectsSet=aocon,
    AllowSelfObjectConnections=self_object,
    AllowSelfHandleConnections=self_handle,
    AllowCrossTypeConnections=cross_type)

cell_size = Slider(1.2, range=1..2)
show_edges = BooleanToggle(True)

# ---- group: base point
pt_2 = Point(Point(0, 20, 0))

# ----
heuristics_rules = Panel(heuw)

# ---- group: Heuristics Display
heud = HeuristicDisplay(
    OriginPoint=pt_2,
    AssemblyObjectsSet=aocon,
    HeuristicsString=heuw,
    XSize=cell_size,
    YSize=cell_size,
    NRows=Slider(10, range=10..50),
    ShowEdges=show_edges,
    DisplayMode=0)

# ----
# receiver rotation angle (in degrees)
# receiver Handle index
# sender Handle index
# rule integer Weight
# receiver Object name
# sender Object name
# rO | rH = rHA < sO | sH % r_iWeight
panel_6 = Panel("rName|1=90<sName|3%0")
