# Grasshopper definition 00-01_Assemblage 1 object random.gh (Grasshopper 1.0.7)
# Copyright: Co-de-iT
# plug-ins: EleFront, Assembler

# ---- group: all polylines
# ASSEMBLAGES IN BRIEF: GENERAL STEPS
# 
# . choose WHERE to add
# 
# . choose WHAT to add
# 
# 
# PROCESS STEPS
# 
# 
# 
# . select receiver object in the assemblage
# 
# . list all possible combinations of free handles and related compatible candidates
# 
# . choose a winnig candidate according to given criteria
# 0 - construct
crv = Curve([<curve referenced from the Rhino model> x20])

# ---- group: selected polylines
crv_2 = Curve([<curve referenced from the Rhino model> x7])

# ----
lng = ListLength(List=crv_2)
# DEFINITION ANATOMY: 00 - constuct
# 
# Construct the object and relationships necessary for the Assemblage
# 
# 
# 
# 01 - simulate
# 
# Simulate the Assemblage growth
# 
# 
# 
# 02 - analyze/post-process
# 
# Analyze results and post-process the obtained assemblage
rotations = Panel("""0
180""")
weight = Panel("0")
type = Panel("1")
repeat = RepeatData(Data=graft(rotations), Length=lng)
repeat_2 = RepeatData(Data=type, Length=lng)
repeat_3 = RepeatData(Data=weight, Length=lng)
flip = FlipMatrix(Data=repeat)  # -> simplify(Data)

# ---- group: Create Handles
handle = ConstructHandle(Polyline=crv_2, RotationAngles=flip, Type=repeat_2, Weight=repeat_3)

# ----
model_abs_size = BooleanToggle(True)

# ----
# Assembler
# 
# Framework for Iterative Assemblages workflow
# 
# code by Alessio Erioli
# 
# v 1.0
# © Co-de-iT 2020 / Creative Commons Attribution-Non Commercial-ShareAlike 4.0 International License
mesh = Mesh(<mesh referenced from the Rhino model>)
volume = Volume(Geometry=mesh)  # -> Volume, Centroid
name = Panel("block 01")
Y = UnitY(Factor=1)
xy = XYPlane(Origin=volume.Centroid)

crv_3 = Curve([<curve referenced from the Rhino model> x12])
pt = Point([<point referenced from the Rhino model> x7])
brep = Brep([<brep referenced from the Rhino model> x7])
brep_2 = Brep([<brep referenced from the Rhino model> x21])
merge = Merge(Data1=crv_3, Data2=pt)
xdcon = ConstructXData(Label="block 01 body", Data=merge, ReferencePlane=xy, AssemblyObjectNameReference=name)

# ---- group: Display Handles
handdisp = DisplayHandle(Handles=handle, DisplaySize=Slider(0.1, range=0..0.5), ModelScreenSize=model_abs_size)

# ---- group: Create AssemblyObject
aocon = ConstructAssemblyObject(Name=name, CollisionMesh=mesh, ReferencePlane=xy, Direction=Y, Weight="1.0", Handles=handle)

# ---- group: heuristics
self_object = BooleanToggle(True)
self_handle = BooleanToggle(True)
cross_type = BooleanToggle(False)
heuw = HeuristicsWriter(
    AssemblyObjectsSet=aocon,
    AllowSelfObjectConnections=self_object,
    AllowSelfHandleConnections=self_handle,
    AllowCrossTypeConnections=cross_type)
display = ValueList({"by Type": 0, "by s/r status": 1}, selected="by s/r status")
cell_size = Slider(1.2, range=1..2)
number_slider = Slider(10, range=10..50)
show_edges = BooleanToggle(True)
pt_2 = Point(Point(0, 20, 0))

# ---- group: heuristics / Heuristics Display
heud = HeuristicDisplay(
    OriginPoint=pt_2,
    AssemblyObjectsSet=aocon,
    HeuristicsString=heuw,
    XSize=cell_size,
    YSize=cell_size,
    NRows=number_slider,
    ShowEdges=show_edges,
    DisplayMode=display)

# ----
step = Button()
reset = Button()
pt_3 = Point(Point(0, -100, 0))

# ---- group: Random Assemblage Engine
# 1 - simulate
aoeng = AssemblerEngineSimple(
    AssemblyObjectsSet=aocon,
    StartingPlane=pt_3,
    StartingObjectType=0,
    HeuristicsString=heuw,
    Go=False,
    Step=step,
    NIterations=Slider(100, range=10..100),
    MaxNObjects="1000",
    Reset=reset,
    FastCollisionCheck=False)  # -> Assemblage, AssemblageCount

# ----
heuristics_rules = Panel(heuw)
n_of_objects = Panel(aoeng.AssemblageCount)
# receiver rotation angle (in degrees)
# receiver Handle index
# sender Handle index
# rule integer Weight
# receiver Object name
# sender Object name
# rO | rH = rHA < sO | sH % r_iWeight
panel = Panel("rName|1=90<sName|3%0")
aoadecon = DeconstructAssemblage(Assemblage=aoeng.Assemblage)  # -> AssemblageObjects, AssemblageRules, ReceiverObjectsIndexes, AvailableObjectIndexes, UnreachableObjectIndexes
# 2 - analyze/post-process
assemblyobjects = Panel(aoadecon.AssemblageObjects)
assemblage_rules = Panel(aoadecon.AssemblageRules)
receiver_object_index = Panel(aoadecon.ReceiverObjectsIndexes)
available_objects_indexes = Panel(aoadecon.AvailableObjectIndexes)
unreachable_objects_indexes = Panel(aoadecon.UnreachableObjectIndexes)
aocmesh = ExtractCollisionMesh(AssemblyObject=aoadecon.AssemblageObjects)
aoplane = ExtractReferencePlane(AssemblyObject=aoadecon.AssemblageObjects)

# ---- group: enable for preview
f_mmeea = MeshesExtractEdgesWithToleranceAngle(M=aocmesh, A=45)  # -> Ei, En; inputs M: list of Mesh, A: Double
# ---------- f_mmeea: C# usings ----------
using System.Threading.Tasks;
using System.Collections.Concurrent;
using System.Linq;
# ---------- f_mmeea: C# ----------
          /*
    froGH - a sparse collection of (in)utilities for Grasshopper

    Mesh Extract Edges with tolerance angle - many meshes

    code by Alessio Erioli

    froGH by Co-de-iT is licensed under a Creative Commons Attribution 4.0 International License.
    http://creativecommons.org/licenses/by/4.0/

    */

    InitComp();

    if (M == null) return;

    double num = A / 57.2958;

    ConcurrentBag<GH_Line> list = new ConcurrentBag<GH_Line>();
    ConcurrentBag<GH_Line> list2 = new ConcurrentBag<GH_Line>();


    Parallel.ForEach(M, m =>
      {
      m.Normals.ComputeNormals();
      Rhino.Geometry.Collections.MeshTopologyEdgeList topologyEdges = m.TopologyEdges;
      int num2 = topologyEdges.Count - 1;
      for (int i = 0; i <= num2; i++)
      {
        int[] connectedFaces = topologyEdges.GetConnectedFaces(i);
        if (connectedFaces.Length < 2)
          list2.Add(new GH_Line(topologyEdges.EdgeLine(i)));

        if (connectedFaces.Length == 2)
        {
          Vector3f val2 = m.FaceNormals[connectedFaces[0]];
          Vector3f val3 = m.FaceNormals[connectedFaces[1]];
          double num3 = Vector3d.VectorAngle(new Vector3d((double) val2.X, (double) val2.Y, (double) val2.Z),
            new Vector3d((double) val3.X, (double) val3.Y, (double) val3.Z));
          if (num3 > num)
            list.Add(new GH_Line(topologyEdges.EdgeLine(i)));

        }
      }
      });

    Ei = list;
    En = list2;
# ---------- f_mmeea: C# additional code ----------
  private void InitComp(){
    Component.Name = "Meshes Extract Edges with tolerance angle";
    Component.NickName = "f_MmEEA";
    Component.Description = "Extract Mesh edges with specific angle tolerance.\n\nOptimized for many meshes";
    Component.Params.Input[0].Name = "Meshes";
    Component.Params.Input[0].Description = "The List of Input Meshes to process";
    Component.Params.Input[1].Name = "Angle";
    Component.Params.Input[1].Description = "The Tolerance Angle";
    Component.Params.Output[0].Name = "Internal Edges";
    Component.Params.Output[0].Description = "Internal edges lines under tolerance";
    Component.Params.Output[1].Name = "Naked Edges";
    Component.Params.Output[1].Description = "Naked edges lines";
  }
# ---------- end f_mmeea ----------
preview = CustomPreview(Geometry=aocmesh, Material=ColourSwatch(SwatchColor=RGB(255, 255, 255)))

# ----
bake = BooleanToggle(False)

# ---- group: apply blocks
panel_2 = Panel("block_01")
inblock = InsertBlock(BlockName="block_01_detail", SourcePlane=PlaneXY(0, 0, 0))
bake_2 = BakeObjects(Geometry=inblock, Bake=bake)
