# Grasshopper definition 00-02_Assemblage 1 object random envelope.gh (Grasshopper 1.0.7)
# Copyright: Co-de-iT
# plug-ins: MeshEdit Components, Human, EleFront, Assembler, froGH

# ---- group: all polylines
crv = Curve([<curve referenced from the Rhino model> x10])

# ----
lng = ListLength(List=crv)
# ASSEMBLAGES IN BRIEF: GENERAL STEPS
# 
# . choose WHERE to add
# 
# . choose WHAT to add
# 
# 
# PROCESS STEPS
# 
# 
# 
# . select receiver object in the assemblage
# 
# . list all possible combinations of free handles and related compatible candidates
# 
# . choose a winnig candidate according to given criteria
# DEFINITION ANATOMY: 00 - constuct
# 
# Construct the object and relationships necessary for the Assemblage
# 
# 
# 
# 01 - simulate
# 
# Simulate the Assemblage growth
# 
# 
# 
# 02 - analyze/post-process
# 
# Analyze results and post-process the obtained assemblage
# 0 - construct
rotations = Panel("90")
weight = Panel("0")
type = Panel("1")
repeat = RepeatData(Data=graft(rotations), Length=lng)
repeat_2 = RepeatData(Data=type, Length=lng)
repeat_3 = RepeatData(Data=weight, Length=lng)
flip = FlipMatrix(Data=repeat)  # -> simplify(Data)

# ---- group: Create Handles
handle = ConstructHandle(Polyline=crv, RotationAngles=flip, Type=repeat_2, Weight=repeat_3)

# ----
model_abs_size = BooleanToggle(True)

# ----
# Assembler
# 
# Framework for Iterative Assemblages workflow
# 
# code by Alessio Erioli
# 
# v 1.0
# © Co-de-iT 2020 / Creative Commons Attribution-Non Commercial-ShareAlike 4.0 International License
mesh = Mesh(<mesh referenced from the Rhino model>)
volume = Volume(Geometry=mesh)  # -> Volume, Centroid
name = Panel("block 01")
X = UnitX(Factor=1)
xy = XYPlane(Origin=volume.Centroid)

# ---- group: Display Handles
handdisp = DisplayHandle(Handles=handle, DisplaySize=Slider(0.1, range=0..0.5), ModelScreenSize=model_abs_size)

# ---- group: Create AssemblyObject
aocon = ConstructAssemblyObject(Name=name, CollisionMesh=mesh, ReferencePlane=xy, Direction=X, Weight="1.0", Handles=handle)

# ---- group: curve for envelope elements
crv_2 = Curve([<curve referenced from the Rhino model> x10])

# ----
xdcon = ConstructXData(Label="block 01 body", Data=crv_2, ReferencePlane=xy, AssemblyObjectNameReference=name)

# ---- group: heuristics
self_object = BooleanToggle(True)
self_handle = BooleanToggle(True)
cross_type = BooleanToggle(False)
heuw = HeuristicsWriter(
    AssemblyObjectsSet=aocon,
    AllowSelfObjectConnections=self_object,
    AllowSelfHandleConnections=self_handle,
    AllowCrossTypeConnections=cross_type)
display = ValueList({"by Type": 0, "by s/r status": 1}, selected="by s/r status")
cell_size = Slider(1.2, range=1..2)
number_slider = Slider(10, range=10..50)
show_edges = BooleanToggle(True)
pt = Point(Point(0, 20, 0))

# ---- group: heuristics / Heuristics Display
heud = HeuristicDisplay(
    OriginPoint=pt,
    AssemblyObjectsSet=aocon,
    HeuristicsString=heuw,
    XSize=cell_size,
    YSize=cell_size,
    NRows=number_slider,
    ShowEdges=show_edges,
    DisplayMode=display)

# ----
step = Button()
reset = Button()
pt_2 = Point(Point(0, -50, 0))

# ---- group: Random Assemblage Engine
# 1 - simulate
aoeng = AssemblerEngineSimple(
    AssemblyObjectsSet=aocon,
    StartingPlane=pt_2,
    StartingObjectType=0,
    HeuristicsString=heuw,
    Go=False,
    Step=step,
    NIterations=Slider(100, range=10..100),
    MaxNObjects="1000",
    Reset=reset,
    FastCollisionCheck=False)  # -> Assemblage, AssemblageCount

# ----
heuristics_rules = Panel(heuw)
panel = Panel(aoeng.AssemblageCount)
# receiver rotation angle (in degrees)
# receiver Handle index
# sender Handle index
# rule integer Weight
# receiver Object name
# sender Object name
# rO | rH = rHA < sO | sH % r_iWeight
panel_2 = Panel("rName|1=90<sName|3%0")
aoadecon = DeconstructAssemblage(Assemblage=aoeng.Assemblage)  # -> AssemblageObjects, AssemblageRules, ReceiverObjectsIndexes, AvailableObjectIndexes, UnreachableObjectIndexes
dam = DataDam(DataA=aoeng.Assemblage, BufferDelay=10000000, BufferMode=0)
# 2 - analyze/post-process
aocmesh = ExtractCollisionMesh(AssemblyObject=aoadecon.AssemblageObjects)
aoadecon_2 = DeconstructAssemblage(Assemblage=dam)  # -> AssemblageObjects, AssemblageRules, ReceiverObjectsIndexes, AvailableObjectIndexes, UnreachableObjectIndexes
mjoin = MeshJoin(Meshes=aocmesh)
aotopo = ExtractTopology(Assemblage=dam)  # -> HandleOccupancy, NeighbourObjectIndex, NeighbourHandleIndex
aoxd = AssociateXData(AssemblyObjects=aoadecon_2.AssemblageObjects, XData=xdcon)
unweld = UnweldMesh(Mesh=mjoin, Angle=1.570796327)

# ---- group: enable for preview
f_mmeea = MeshesExtractEdgesWithToleranceAngle(M=aocmesh, A=45)  # -> Ei, En; inputs M: list of Mesh, A: Double
# ---------- f_mmeea: C# usings ----------
using System.Threading.Tasks;
using System.Collections.Concurrent;
using System.Linq;
# ---------- f_mmeea: C# ----------
          /*
    froGH - a sparse collection of (in)utilities for Grasshopper

    Mesh Extract Edges with tolerance angle - many meshes

    code by Alessio Erioli

    froGH by Co-de-iT is licensed under a Creative Commons Attribution 4.0 International License.
    http://creativecommons.org/licenses/by/4.0/

    */

    InitComp();

    if (M == null) return;

    double num = A / 57.2958;

    ConcurrentBag<GH_Line> list = new ConcurrentBag<GH_Line>();
    ConcurrentBag<GH_Line> list2 = new ConcurrentBag<GH_Line>();


    Parallel.ForEach(M, m =>
      {
      m.Normals.ComputeNormals();
      Rhino.Geometry.Collections.MeshTopologyEdgeList topologyEdges = m.TopologyEdges;
      int num2 = topologyEdges.Count - 1;
      for (int i = 0; i <= num2; i++)
      {
        int[] connectedFaces = topologyEdges.GetConnectedFaces(i);
        if (connectedFaces.Length < 2)
          list2.Add(new GH_Line(topologyEdges.EdgeLine(i)));

        if (connectedFaces.Length == 2)
        {
          Vector3f val2 = m.FaceNormals[connectedFaces[0]];
          Vector3f val3 = m.FaceNormals[connectedFaces[1]];
          double num3 = Vector3d.VectorAngle(new Vector3d((double) val2.X, (double) val2.Y, (double) val2.Z),
            new Vector3d((double) val3.X, (double) val3.Y, (double) val3.Z));
          if (num3 > num)
            list.Add(new GH_Line(topologyEdges.EdgeLine(i)));

        }
      }
      });

    Ei = list;
    En = list2;
# ---------- f_mmeea: C# additional code ----------
  private void InitComp(){
    Component.Name = "Meshes Extract Edges with tolerance angle";
    Component.NickName = "f_MmEEA";
    Component.Description = "Extract Mesh edges with specific angle tolerance.\n\nOptimized for many meshes";
    Component.Params.Input[0].Name = "Meshes";
    Component.Params.Input[0].Description = "The List of Input Meshes to process";
    Component.Params.Input[1].Name = "Angle";
    Component.Params.Input[1].Description = "The Tolerance Angle";
    Component.Params.Output[0].Name = "Internal Edges";
    Component.Params.Output[0].Description = "Internal edges lines under tolerance";
    Component.Params.Output[1].Name = "Naked Edges";
    Component.Params.Output[1].Description = "Naked edges lines";
  }
# ---------- end f_mmeea ----------
preview = CustomPreview(Geometry=unweld, Material=ColourSwatch(SwatchColor=RGB(255, 255, 255)))  # disabled

# ---- group: find free handles
equals = Equality(FirstNumber=aotopo.HandleOccupancy, SecondNumber="0")  # -> Equality, Inequality

# ----
aosp = ExtractSenderHandlesPlanes(AssemblyObject=aoadecon_2.AssemblageObjects)
xddecon = DeconstructXData(XData=aoxd)  # -> Label, Data, ReferencePlane, AssemblyObjectNameReference
previewlw = CustomPreviewLineweights(Geometry=f_mmeea.Ei, Shader=ColourSwatch(SwatchColor=RGB(0, 0, 0)), Absolute=False)
cull = CullPattern(List=aosp, CullPattern=equals.Equality)
cull_2 = CullPattern(List=xddecon.Data, CullPattern=equals.Equality)

# ---- group: separate horizontal/vertical condition
deplane = DeconstructPlane(Plane=cull)  # -> Origin, XAxis, YAxis, ZAxis
Z = UnitZ(Factor=1)
panel_3 = Panel("""0 horizontal - ceiling
1 - vertical
2 horizontal - bottom""")
# this adds an index
# to the data tree
angle = Angle(VectorA=deplane.ZAxis, VectorB=Z)  # -> Angle, Reflex
div = DivideDomain(Domain="0 to Pi", Count="3")
# 0
panel_4 = Panel(angle.Angle)
inc = Includes(Value=graft(angle.Angle), Domain=div)  # -> Includes, Deviation
panel_5 = Panel("""0
1
2""")
dispatch = Dispatch(List=panel_5, DispatchPattern=inc.Includes)  # -> ListA, ListB
pshift = ShiftPaths(Data=dispatch.ListA, Offset=-1)

# ----
# Pi/2
# Pi
panel_6 = Panel(div)

# ---- group: simple envelope
smesh = SimpleMesh(Brep=cull_2)
mjoin_2 = MeshJoin(Meshes=flatten(smesh))
flip_2 = MeshFlip(Mesh=mjoin_2)
f_mrenorm = MeshRebuildNormals(Mesh=smesh)
f_mrenorm_2 = MeshRebuildNormals(Mesh=flip_2)
sift = SiftPattern(List=f_mrenorm, SiftPattern=pshift)  # -> Output0, Output1, Output2
preview_2 = CustomPreview(
    Geometry=f_mrenorm_2,
    Material={diffuse=RGB(221, 160, 221), emission=RGB(66, 48, 66), shine=0.5, specular=RGB(255, 255, 255), transparency=0})  # disabled
mesh_2 = Mesh(sift.Output0)
mesh_3 = Mesh(sift.Output1)
mesh_4 = Mesh(sift.Output2)
roof = ColourSwatch(SwatchColor=RGB(255, 212, 0))
facade = ColourSwatch(SwatchColor=RGB(255, 0, 0))
slab = ColourSwatch(SwatchColor=RGB(0, 55, 255))
preview_3 = CustomPreview(Geometry=mesh_2, Material=roof)  # disabled
preview_4 = CustomPreview(Geometry=mesh_3, Material=facade)  # disabled
preview_5 = CustomPreview(Geometry=mesh_4, Material=slab)  # disabled

# ----
panel_7 = Panel(inc.Includes)
sift_2 = SiftPattern(List=cull, SiftPattern=pshift)  # -> flatten(Output0), flatten(Output1), flatten(Output2)
# index to be removed
panel_8 = Panel(dispatch.ListA)
panel_9 = Panel(pshift)

# ---- group: apply roof blocks
inblock = InsertBlock(BlockName="roof element", SourcePlane=sift_2.Output0)
bake = BooleanToggle(False)
bake_2 = BakeObjects(Geometry=inblock, Bake=bake)

# ---- group: apply facade blocks
inblock_2 = InsertBlock(BlockName="facade", SourcePlane=sift_2.Output1)
bake_3 = BooleanToggle(False)
bake_4 = BakeObjects(Geometry=inblock_2, Bake=bake_3)

# ---- group: apply slab blocks
inblock_3 = InsertBlock(BlockName="slab", SourcePlane=sift_2.Output2)
bake_5 = BooleanToggle(False)
bake_6 = BakeObjects(Geometry=inblock_3, Bake=bake_5)
