# Grasshopper definition 01-00-1_AssemblyObject 2 objects setup sort-filter rules.gh (Grasshopper 1.0.7)
# Copyright: Co-de-iT
# plug-ins: Assembler

# ---- group: type 1
crv = Curve([<curve referenced from the Rhino model> x3])

# ---- group: type 2
crv_2 = Curve([<curve referenced from the Rhino model> x2])

crv_3 = Curve([<curve referenced from the Rhino model> x2])

# ---- group: type 1
crv_4 = Curve([<curve referenced from the Rhino model> x4])

# ----
merge = Merge(Data1=crv, Data2=crv_2)
merge_2 = Merge(Data1=crv_4, Data2=crv_3)

rotations = Panel("""0
180""")
lng = ListLength(List=merge_2)
type = Panel("""1
1
1
1
2
2""")
repeat = RepeatData(Data=graft(rotations), Length=lng)
weight = Panel("0")
flip = FlipMatrix(Data=repeat)  # -> simplify(Data)
repeat_2 = RepeatData(Data=weight, Length=lng)

crv_5 = Curve(merge)

type_2 = Panel("""1
1
1
2
2""")
rotations_2 = Panel("""0
180""")
lng_2 = ListLength(List=crv_5)
repeat_3 = RepeatData(Data=graft(rotations_2), Length=lng_2)
weight_2 = Panel("0")
flip_2 = FlipMatrix(Data=repeat_3)  # -> simplify(Data)
repeat_4 = RepeatData(Data=weight_2, Length=lng_2)

# ---- group: Create Handles
# Assembler
# 
# Framework for Iterative Assemblages workflow
# 
# code by Alessio Erioli
# 
# v 1.0
# © Co-de-iT 2020 / Creative Commons Attribution-Non Commercial-ShareAlike 4.0 International License
handle = ConstructHandle(Polyline=crv_5, RotationAngles=flip_2, Type=type_2, Weight=repeat_4)

handle_2 = ConstructHandle(Polyline=merge_2, RotationAngles=flip, Type=type, Weight=repeat_2)

# ----
model_abs_size = BooleanToggle(True)
model_abs_size_2 = BooleanToggle(True)

mesh = Mesh(<mesh referenced from the Rhino model>)
volume = Volume(Geometry=mesh)  # -> Volume, Centroid
name = Panel("blockB")
xy = XYPlane(Origin=volume.Centroid)
X = UnitX(Factor=1)

mesh_2 = Mesh(<mesh referenced from the Rhino model>)
volume_2 = Volume(Geometry=mesh_2)  # -> Volume, Centroid
name_2 = Panel("blockA")
xy_2 = XYPlane(Origin=volume_2.Centroid)
X_2 = UnitX(Factor=1)

# ---- group: Display Handles
handdisp = DisplayHandle(Handles=handle_2, DisplaySize=Slider(0.1, range=0..0.5), ModelScreenSize=model_abs_size)

handdisp_2 = DisplayHandle(Handles=handle, DisplaySize=Slider(0.1, range=0..0.5), ModelScreenSize=model_abs_size_2)

# ----
crv_6 = Curve()
pt = Point()
brep = Brep()
merge_3 = Merge()
xdcon = ConstructXData(Label="blockA body", Data=merge_3, ReferencePlane=xy_2, AssemblyObjectNameReference=name_2)

crv_7 = Curve()
pt_2 = Point()
brep_2 = Brep()
merge_4 = Merge()
xdcon_2 = ConstructXData(Label="blockB body", Data=merge_4, ReferencePlane=xy, AssemblyObjectNameReference=name)

# ---- group: Create AssemblyObject
aocon = ConstructAssemblyObject(Name=name_2, CollisionMesh=mesh_2, ReferencePlane=xy_2, Direction=X_2, Weight="1.0", Handles=handle)

aocon_2 = ConstructAssemblyObject(Name=name, CollisionMesh=mesh, ReferencePlane=xy, Direction=X, Weight="1.0", Handles=handle_2)

# ---- group: XData
merge_5 = Merge(Data1=flatten(xdcon), Data2=flatten(xdcon_2))
data = Data(merge_5)

# ---- group: AssemblyObjects
merge_6 = Merge(Data1=flatten(aocon), Data2=flatten(aocon_2))
data_2 = Data(merge_6)

# ----
self_object = BooleanToggle(True)
self_handle = BooleanToggle(True)
cross_type = BooleanToggle(False)
heuw = HeuristicsWriter(
    AssemblyObjectsSet=data_2,
    AllowSelfObjectConnections=self_object,
    AllowSelfHandleConnections=self_handle,
    AllowCrossTypeConnections=cross_type)

# ----
# sorting operations on rules
sorting = ValueList({"none": 0, "volume (min to max)": 1, "volume (max to min)": 2, "Z height (min to max)": 3, "bbox diagonal (min to max)": 4}, selected="volume (min to max)")
heudex = HeuristicsDisplayEx(OriginPoint=Point(0, 0, 0), AssemblyObjectsSet=data_2, HeuristicsString=heuw, XSize=1, YSize=1, NRows=10)  # -> AssemblyObjectPairs, CoherencePattern, HeuristicsStringTree, TextBasePoints, XData
aocmesh = ExtractCollisionMesh(AssemblyObject=heudex.AssemblyObjectPairs)
bbox = BoundingBox(Content=aocmesh, Plane=PlaneXY(0, 0, 0), UnionBox=True)  # -> Box, Box_2
boxprop = BoxProperties(Box=bbox.Box)  # -> Center, Diagonal, Area, Volume, Degeneracy
vlen = VectorLength(Vector=boxprop.Diagonal)
devec = DeconstructVector(Vector=boxprop.Diagonal)  # -> XComponent, YComponent, ZComponent
volume_3 = Volume(Geometry=bbox.Box)  # -> Volume, Centroid
cull = CullPattern(List=volume_3.Volume, CullPattern=heudex.CoherencePattern)  # -> flatten(List)
cull_2 = CullPattern(List=devec.ZComponent, CullPattern=heudex.CoherencePattern)  # -> flatten(List)
cull_3 = CullPattern(List=vlen, CullPattern=heudex.CoherencePattern)  # -> flatten(List)
cull_4 = CullPattern(List=heudex.HeuristicsStringTree, CullPattern=heudex.CoherencePattern)  # -> flatten(List)
sort = SortList(Keys=cull_2, ValuesA=cull_4)  # -> Keys, ValuesA
sort_2 = SortList(Keys=cull_3, ValuesA=cull_4)  # -> Keys, ValuesA
sort_3 = SortList(Keys=cull, ValuesA=cull_4)  # -> Keys, ValuesA
valid_rules_only = BooleanToggle(True)
filter = StreamFilter(
    Gate=sorting,
    Stream0=cull_4,
    Stream1=sort_3.ValuesA,
    Stream2=reverse(sort_3.ValuesA),
    Stream3=sort.ValuesA,
    Stream4=sort_2.ValuesA)
filter_2 = StreamFilter(Gate=valid_rules_only, Stream0=heuw, Stream1=filter)

heuristics_rules = Panel(heuw)
# receiver rotation angle (in degrees)
# receiver Handle index
# sender Handle index
# rule integer Weight
# receiver Object name
# sender Object name
# rO | rH = rHA < sO | sH % r_iWeight
panel = Panel("rName|1=90<sName|3%0")
display = ValueList({"by Type": 0, "by s/r status": 1}, selected="by Type")
number_slider = Slider(1.2, range=1..2)
pt_3 = Point(Point(0, 20, 0))

# ---- group: Heuristics Display
heud = HeuristicDisplay(
    OriginPoint=pt_3,
    AssemblyObjectsSet=data_2,
    HeuristicsString=filter_2,
    XSize=number_slider,
    YSize=number_slider,
    NRows=Slider(10, range=10..50),
    ShowEdges=Toggle(True),
    DisplayMode=display)
