# Grasshopper definition 01-01-1_Assemblage 2 objects random filter blocks.gh (Grasshopper 1.0.7)
# Copyright: Co-de-iT
# plug-ins: Human, EleFront, Assembler

# ---- group: type 1
crv = Curve([<curve referenced from the Rhino model> x3])

# ---- group: type 2
crv_2 = Curve([<curve referenced from the Rhino model> x2])

crv_3 = Curve([<curve referenced from the Rhino model> x2])

# ---- group: type 1
crv_4 = Curve([<curve referenced from the Rhino model> x4])

# ----
merge = Merge(Data1=crv, Data2=crv_2)
merge_2 = Merge(Data1=crv_4, Data2=crv_3)

rotations = Panel("""0
180""")
lng = ListLength(List=merge_2)
type = Panel("""1
1
1
1
2
2""")
repeat = RepeatData(Data=graft(rotations), Length=lng)
weight = Panel("0")
flip = FlipMatrix(Data=repeat)  # -> simplify(Data)
repeat_2 = RepeatData(Data=weight, Length=lng)

crv_5 = Curve(merge)

type_2 = Panel("""1
1
1
2
2""")
rotations_2 = Panel("""0
180""")
lng_2 = ListLength(List=crv_5)
repeat_3 = RepeatData(Data=graft(rotations_2), Length=lng_2)
weight_2 = Panel("0")
flip_2 = FlipMatrix(Data=repeat_3)  # -> simplify(Data)
repeat_4 = RepeatData(Data=weight_2, Length=lng_2)

# ---- group: Create Handles
# Assembler
# 
# Framework for Iterative Assemblages workflow
# 
# code by Alessio Erioli
# 
# v 1.0
# © Co-de-iT 2020 / Creative Commons Attribution-Non Commercial-ShareAlike 4.0 International License
handle = ConstructHandle(Polyline=crv_5, RotationAngles=flip_2, Type=type_2, Weight=repeat_4)

handle_2 = ConstructHandle(Polyline=merge_2, RotationAngles=flip, Type=type, Weight=repeat_2)

# ----
model_abs_size = BooleanToggle(True)
model_abs_size_2 = BooleanToggle(True)

mesh = Mesh(<mesh referenced from the Rhino model>)
volume = Volume(Geometry=mesh)  # -> Volume, Centroid
name = Panel("blockB")
xy = XYPlane(Origin=volume.Centroid)
X = UnitX(Factor=1)

mesh_2 = Mesh(<mesh referenced from the Rhino model>)
volume_2 = Volume(Geometry=mesh_2)  # -> Volume, Centroid
name_2 = Panel("blockA")
xy_2 = XYPlane(Origin=volume_2.Centroid)
X_2 = UnitX(Factor=1)

# ---- group: Display Handles
handdisp = DisplayHandle(Handles=handle_2, DisplaySize=Slider(0.1, range=0..0.5), ModelScreenSize=model_abs_size)

handdisp_2 = DisplayHandle(Handles=handle, DisplaySize=Slider(0.1, range=0..0.5), ModelScreenSize=model_abs_size_2)

# ----
crv_6 = Curve()
pt = Point()
brep = Brep()
merge_3 = Merge()
xdcon = ConstructXData(Label="blockA body", Data=merge_3, ReferencePlane=xy_2, AssemblyObjectNameReference=name_2)

crv_7 = Curve()
pt_2 = Point()
brep_2 = Brep()
merge_4 = Merge()
xdcon_2 = ConstructXData(Label="blockB body", Data=merge_4, ReferencePlane=xy, AssemblyObjectNameReference=name)

# ---- group: Create AssemblyObject
aocon = ConstructAssemblyObject(Name=name_2, CollisionMesh=mesh_2, ReferencePlane=xy_2, Direction=X_2, Weight="1.0", Handles=handle)

aocon_2 = ConstructAssemblyObject(Name=name, CollisionMesh=mesh, ReferencePlane=xy, Direction=X, Weight="1.0", Handles=handle_2)

# ---- group: XData
merge_5 = Merge(Data1=flatten(xdcon), Data2=flatten(xdcon_2))
data = Data(merge_5)

# ---- group: AssemblyObjects
merge_6 = Merge(Data1=flatten(aocon), Data2=flatten(aocon_2))
data_2 = Data(merge_6)

# ----
starting_plane = ValueList({"XY": 0, "YZ": 1, "custom": 2}, selected="XY")
pt_3 = Point(Point(0, -100, 0))

self_object = BooleanToggle(True)
self_handle = BooleanToggle(True)
cross_type = BooleanToggle(False)
heuw = HeuristicsWriter(
    AssemblyObjectsSet=data_2,
    AllowSelfObjectConnections=self_object,
    AllowSelfHandleConnections=self_handle,
    AllowCrossTypeConnections=cross_type)

xy_3 = XYPlane(Origin=pt_3)
yz = YZPlane(Origin=pt_3)
pl = PlaneNormal(Origin=pt_3, ZAxis="1,-1,1")
display = ValueList({"by Type": 0, "by s/r status": 1}, selected="by Type")
filter = StreamFilter(Gate=starting_plane, Stream0=xy_3, Stream1=yz, Stream2=pl)
max_objects = Panel("2000")
step = Button()
reset = Button()

# ---- group: filter heuristics
heudex = HeuristicsDisplayEx(OriginPoint=Point(0, 0, 0), AssemblyObjectsSet=data_2, HeuristicsString=heuw, XSize=1, YSize=1, NRows=10)  # -> AssemblyObjectPairs, CoherencePattern, HeuristicsStringTree, TextBasePoints, XData
cull = CullPattern(List=flatten(heudex.HeuristicsStringTree), CullPattern=flatten(heudex.CoherencePattern))

# ----
number_slider = Slider(1.2, range=1..2)
number_slider_2 = Slider(10, range=10..50)
pt_4 = Point(Point(0, 20, 0))
heuristics_rules = Panel(heuw)

# ---- group: Random Assemblage Engine
aoeng = AssemblerEngineSimple(
    AssemblyObjectsSet=data_2,
    StartingPlane=filter,
    StartingObjectType=0,
    HeuristicsString=cull,
    Go=False,
    Step=step,
    NIterations=Slider(100, range=10..100),
    MaxNObjects=max_objects,
    Reset=reset,
    FastCollisionCheck=False)  # -> Assemblage, AssemblageCount

# ---- group: Heuristics Display
heud = HeuristicDisplay(
    OriginPoint=pt_4,
    AssemblyObjectsSet=data_2,
    HeuristicsString=heuw,
    XSize=number_slider,
    YSize=number_slider,
    NRows=10,
    ShowEdges=Toggle(True),
    DisplayMode=display)

# ----
display_2 = ValueList({"objects": 0, "occupancy": 1, "type": 2, "sequence": 3, "Z height": 4, "none": 5}, selected="objects")
n_of_objects = Panel(aoeng.AssemblageCount)
panel = Panel("""AliceBlue
SlateGray
GoldenRod
YellowGreen
DarkKhaki""")
# receiver rotation angle (in degrees)
# receiver Handle index
# sender Handle index
# rule integer Weight
# receiver Object name
# sender Object name
# rO | rH = rHA < sO | sH % r_iWeight
panel_2 = Panel("rName|1=90<sName|3%0")
cluster = Cluster(vizmode=display_2, assemblage=aoeng.Assemblage, type_colors=panel, stop_and_go_bool=step)  # -> meshes, edges

# ---- group: display components / display edges
previewlw = CustomPreviewLineweights(Geometry=cluster.edges, Shader=ColourSwatch(SwatchColor=RGB(0, 0, 0)), Thickness=Slider(1, range=1..3), Absolute=False)

# ---- group: display components
mjoin = MeshJoin(Meshes=cluster.meshes)
preview = CustomPreview(Geometry=mjoin, Material=ColourSwatch(SwatchColor=RGB(255, 255, 255)))

# ----
dam = DataDam(DataA=aoeng.Assemblage, BufferDelay=10000000, BufferMode=0)
aoadecon = DeconstructAssemblage(Assemblage=dam)  # -> AssemblageObjects, AssemblageRules, ReceiverObjectsIndexes, AvailableObjectIndexes, UnreachableObjectIndexes
aotype = ExtractType(AssemblyObject=aoadecon.AssemblageObjects)
# sift by type: filters by a pattern of integers. In case of more than 2 types, add other channels to the output.
sift = SiftPattern(List=aoadecon.AssemblageObjects, SiftPattern=aotype)  # -> Output0, Output1
aoplane = ExtractReferencePlane(AssemblyObject=sift.Output0)
aoplane_2 = ExtractReferencePlane(AssemblyObject=sift.Output1)

# ---- group: separate horizontal/vertical
# recognizing horizontal and vertical: The dot product of 2 unit vectors is equal to the cosine of the comprised angle.
# 
# Two perpendicular vectors have a dot product of 0 (angle is 90), while for two parallel vectors the dot product can be 1 or -1 (if their arrows are concord or discord respectively, which means an angle of 0 or 180). Using the absolute value function, the value becomes 1 regardless of the sign.
# 
# In this case we test the angle of each AssemblyObject's  reference plane X vector with the global Z vector. If they are parallel (absolute dot product = 1) then the object is oriented vertically, if they are perpendicular (absolute dot product = 0) the object is horizontal.
Z = UnitZ(Factor=1)
deplane = DeconstructPlane(Plane=aoplane)  # -> Origin, XAxis, YAxis, ZAxis
dprod = DotProduct(VectorA=deplane.XAxis, VectorB=Z, Unitize=False)
abs = Absolute(Value=dprod)
dispatch = Dispatch(List=aoplane, DispatchPattern=abs)  # -> ListA, ListB

# ---- group: associate blocks / vertical elements
pln = Plane(dispatch.ListA)

# ---- group: associate blocks / horizontal elements
pln_2 = Plane(dispatch.ListB)

# ---- group: associate blocks
# blockA / type 0
# blockB / type 1
pln_3 = Plane(aoplane_2)
inblock = InsertBlock(BlockName="blockA_v1", SourcePlane=pln_2)
inblock_2 = InsertBlock(BlockName="blockB", SourcePlane=pln_3)
inblock_3 = InsertBlock(BlockName="blockA_v2", SourcePlane=pln)

# ----
panel_3 = Panel("recombine horizontal/vertical")
weave = Weave(Pattern=abs, Stream0=inblock, Stream1=inblock_3, NullGaps=False)
# recombine types: In case of more than 2 types, add other channels to the input accordingly.
combine = CombineData(Input0=weave, Input1=inblock_2)  # -> Result, Index
bake = BooleanToggle(False)
data_3 = Data(combine.Result)
bake_2 = BakeObjects(Geometry=data_3, Bake=bake)
preview_2 = CustomPreview(
    Geometry=data_3,
    Material={diffuse=RGB(221, 160, 221), emission=RGB(66, 48, 66), shine=0.5, specular=RGB(255, 255, 255), transparency=0})

# ==== cluster Cluster
vizmode = ClusterInput()
assemblage = ClusterInput()
type_colors = ClusterInput()
stop_and_go_bool = ClusterInput()
aoadecon = DeconstructAssemblage(Assemblage=assemblage)  # -> AssemblageObjects, AssemblageRules, ReceiverObjectsIndexes, AvailableObjectIndexes, UnreachableObjectIndexes
filter = StreamFilter(Gate=stop_and_go_bool, Stream0=assemblage)
gate = StreamGate(Stream=aoadecon.AssemblageObjects, Gate=stop_and_go_bool)  # -> Target0, Target1
aoset = ExtractAOSet(Assemblage=filter)
gate_2 = StreamGate(Stream=gate.Target0, Gate=vizmode)  # -> Target0, Target1, Target2, Target3, Target4, Target5
aocmesh = ExtractCollisionMesh(AssemblyObject=aoset)
f_mseea = MeshExtractEdgesWithToleranceAngle(Mesh=aocmesh, Angle="45")  # -> InternalEdges, NakedEdges

# ---- group: extract object type
aotype = ExtractType(AssemblyObject=gate.Target0)

# ----
aocmesh_2 = ExtractCollisionMesh(AssemblyObject=gate_2.Target3)
aocmesh_3 = ExtractCollisionMesh(AssemblyObject=gate_2.Target2)
aocmesh_4 = ExtractCollisionMesh(AssemblyObject=gate_2.Target1)
aocmesh_5 = ExtractCollisionMesh(AssemblyObject=gate_2.Target4)
group = Group(Objects=f_mseea.InternalEdges)  # -> flatten(Group)
lng = ListLength(List=aocmesh_4)
aoplane = ExtractReferencePlane(AssemblyObject=aoset)
aoplane_2 = ExtractReferencePlane(AssemblyObject=gate_2.Target4)
repeat = RepeatData(Data="0", Length=lng)

# ---- group: display by assemblage sequence
lng_2 = ListLength(List=aocmesh_2)  # -> expr("x-1", Length)
f_ifroml = IndexesFromList(D=aocmesh_2)  # -> i; inputs D: list
# ---------- f_ifroml: C# usings ----------
using System.Linq;
# ---------- f_ifroml: C# ----------
   
 /*
    froGH - a sparse collection of (in)utilities for Grasshopper

    Indexes from Number
    code by Alessio Erioli

    froGH by Co-de-iT is licensed under a Creative Commons Attribution 4.0 International License.
    http://creativecommons.org/licenses/by/4.0/

    */
    initComp();
   
    GH_Integer[] indexes = new GH_Integer[D.Count];

    for(int j = 0; j < D.Count; j++)
      indexes[j] = new GH_Integer(j);

    //A = indexes.Sum(j => j.Value); // uses System.Linq Sum selector function - for each GH_Integer j in indexes add its value to the total sum

    i = indexes;
# ---------- f_ifroml: C# additional code ----------
  void initComp(){
    Component.Name = "Indexes from List";
    Component.NickName = "f_iFromL";
    Component.Description = "Generates a list of 0-based integer indexes from a given list of data";
    Component.Params.Input[0].Name = "Data";
    Component.Params.Input[0].Description = "the list to index";
    Component.Params.Output[0].Name = "Indexes";
    Component.Params.Output[0].Description = "the generated indexes";
  }
# ---------- end f_ifroml ----------
one_over_x = OneOverX(Value=lng_2)
multiplication = Multiplication(A=f_ifroml, B=one_over_x)
sqr = Square(Value=multiplication)
gradient = Gradient(
    LowerLimit=0,
    UpperLimit=1,
    Parameter=sqr,
    stops=[0: RGB(0, 0, 0), 0.498: RGB(56, 136, 150), 0.904: RGB(186, 224, 224), 1: RGB(255, 255, 255)])
mcol = MeshColours(Mesh=graft(aocmesh_2), Colours=graft(gradient))  # -> flatten(Mesh)

# ----
filter_2 = StreamFilter(Gate=stop_and_go_bool, Stream0=aotype)
pdecon = Deconstruct(Point=aoplane_2)  # -> XComponent, YComponent, ZComponent
aoplane_3 = ExtractReferencePlane(AssemblyObject=gate.Target0)
item = ListItem(List=group, Index=filter_2, Wrap=True)
item_2 = ListItem(List=aoplane, Index=filter_2, Wrap=True)
replace = ReplaceItems(List=repeat, Item="1", Indices=aoadecon.AvailableObjectIndexes, Wrap=False)
bnd = Bounds(Numbers=pdecon.ZComponent)
replace_2 = ReplaceItems(List=replace, Item="2", Indices=aoadecon.UnreachableObjectIndexes, Wrap=False)
orient = Orient(Geometry=item, Source=item_2, Target=aoplane_3)  # -> Geometry, Transform
remap = RemapNumbers(Value=pdecon.ZComponent, Source=bnd, Target=Domain(0, 1))  # -> Mapped, Clipped

# ---- group: occupied/available visualization
saturated = ColourSwatch(SwatchColor=RGB(112, 117, 57))
available = ColourSwatch(SwatchColor=RGB(255, 255, 255))
unreachable = ColourSwatch(SwatchColor=RGB(194, 199, 137))
weave = Weave(Pattern=graft(replace_2), Stream0=saturated, Stream1=available, Stream2=unreachable, NullGaps=False)  # -> simplify(Weave)
mcol_2 = MeshColours(Mesh=graft(aocmesh_4), Colours=weave)  # -> flatten(Mesh)

# ----
gradient_2 = Gradient(
    LowerLimit=0,
    UpperLimit=1,
    Parameter=remap.Mapped,
    stops=[0: RGB(21, 0, 33), 0.326: RGB(150, 66, 114), 0.664: RGB(224, 186, 187), 1: RGB(255, 255, 255)])
ungroup = Ungroup(Group=orient.Geometry)  # -> flatten(Objects)
item_3 = ListItem(List=type_colors, Index=graft(aotype), Wrap=True)  # -> simplify(Item)
aocmesh_6 = ExtractCollisionMesh(AssemblyObject=gate_2.Target0)
aocmesh_7 = ExtractCollisionMesh(AssemblyObject=gate.Target1)
filter_3 = StreamFilter(Gate=stop_and_go_bool, Stream0=ungroup)

# ---- group: display by component type
mcol_3 = MeshColours(Mesh=graft(aocmesh_3), Colours=item_3)  # -> flatten(Mesh)

# ----
mcol_4 = MeshColours(Mesh=graft(aocmesh_5), Colours=graft(gradient_2))  # -> flatten(Mesh)
filter_4 = StreamFilter(Gate=vizmode, Stream0=aocmesh_6, Stream1=mcol_2, Stream2=mcol_3, Stream3=mcol, Stream4=mcol_4)
filter_5 = StreamFilter(Gate=stop_and_go_bool, Stream0=filter_4, Stream1=aocmesh_7)
meshes = ClusterOutput(filter_5)
edges = ClusterOutput(filter_3)
