# Grasshopper definition 01-03_AssemblyObject 2 objects heuristics display ex.gh (Grasshopper 1.0.7)
# Copyright: Co-de-iT
# plug-ins: Human, SelectablePreview, Assembler, froGH

# ---- group: type 1 - square
crv = Curve([<curve referenced from the Rhino model> x3])

# ---- group: type 2 - rectangle
crv_2 = Curve([<curve referenced from the Rhino model> x2])

# ---- group: type 3 - triangle
crv_3 = Curve([<curve referenced from the Rhino model> x4])

# ---- group: type 1 - square
crv_4 = Curve([<curve referenced from the Rhino model> x4])

# ---- group: type 2 - rectangle
crv_5 = Curve([<curve referenced from the Rhino model> x2])

# ----
rotations = Panel("""0
180""")
lng = ListLength(List=crv_2)
weight = Panel("0")
repeat = RepeatData(Data=graft(rotations), Length=lng)
flip = FlipMatrix(Data=repeat)  # -> simplify(Data)
repeat_2 = RepeatData(Data=weight, Length=lng)

merge = Merge(Data1=crv_4, Data2=crv_5)

rotations_2 = Panel("-90")
lng_2 = ListLength(List=crv_3)
weight_2 = Panel("0")
repeat_3 = RepeatData(Data=graft(rotations_2), Length=lng_2)
flip_2 = FlipMatrix(Data=repeat_3)  # -> simplify(Data)
repeat_4 = RepeatData(Data=weight_2, Length=lng_2)

rotations_3 = Panel("""0
90
180""")
lng_3 = ListLength(List=crv)
weight_3 = Panel("0")
repeat_5 = RepeatData(Data=graft(rotations_3), Length=lng_3)
flip_3 = FlipMatrix(Data=repeat_5)  # -> simplify(Data)
repeat_6 = RepeatData(Data=weight_3, Length=lng_3)

rotations_4 = Panel("""0
180""")
lng_4 = ListLength(List=merge)
type = Panel("""1
1
1
1
2
2""")
repeat_7 = RepeatData(Data=graft(rotations_4), Length=lng_4)
weight_4 = Panel("0")
flip_4 = FlipMatrix(Data=repeat_7)  # -> simplify(Data)
repeat_8 = RepeatData(Data=weight_4, Length=lng_4)

type_2 = Panel("2")
type_3 = Panel("3")
type_4 = Panel("1")
repeat_9 = RepeatData(Data=graft(type_2), Length=lng)
repeat_10 = RepeatData(Data=graft(type_3), Length=lng_2)
repeat_11 = RepeatData(Data=graft(type_4), Length=lng_3)

# ---- group: Create Handles
handle = ConstructHandle(Polyline=crv_2, RotationAngles=flip, Type=repeat_9, Weight=repeat_2)

handle_2 = ConstructHandle(Polyline=crv_3, RotationAngles=flip_2, Type=repeat_10, Weight=repeat_4)

handle_3 = ConstructHandle(Polyline=merge, RotationAngles=flip_4, Type=type, Weight=repeat_8)

# Assembler
# 
# Framework for Iterative Assemblages workflow
# 
# code by Alessio Erioli
# 
# v 1.0
# © Co-de-iT 2020 / Creative Commons Attribution-Non Commercial-ShareAlike 4.0 International License
handle_4 = ConstructHandle(Polyline=crv, RotationAngles=flip_3, Type=repeat_11, Weight=repeat_6)

# ----
model_abs_size = BooleanToggle(True)
model_abs_size_2 = BooleanToggle(True)
merge_2 = Merge(Data1=flatten(handle_4), Data2=flatten(handle), Data3=flatten(handle_2))

# ---- group: Display Handles
handdisp = DisplayHandle(Handles=handle_3, DisplaySize=Slider(7.261, range=0..10), ModelScreenSize=model_abs_size)

handdisp_2 = DisplayHandle(Handles=merge_2, DisplaySize=Slider(10, range=0..10), ModelScreenSize=model_abs_size_2)

# ----
mesh = Mesh(<mesh referenced from the Rhino model>)
volume = Volume(Geometry=mesh)  # -> Volume, Centroid
name = Panel("blockA")
xy = XYPlane(Origin=volume.Centroid)
X = UnitX(Factor=1)

mesh_2 = Mesh(<mesh referenced from the Rhino model>)
volume_2 = Volume(Geometry=mesh_2)  # -> Volume, Centroid
name_2 = Panel("blockB")
xy_2 = XYPlane(Origin=volume_2.Centroid)
X_2 = UnitX(Factor=1)

crv_6 = Curve()
pt = Point([<point referenced from the Rhino model> x7])
brep = Brep([<brep referenced from the Rhino model> x7])
xdcon = ConstructXData(Label="blockA body", ReferencePlane=xy, AssemblyObjectNameReference=name)

crv_7 = Curve([<curve referenced from the Rhino model> x12])
pt_2 = Point([<point referenced from the Rhino model> x7])
brep_2 = Brep([<brep referenced from the Rhino model> x7])
xdcon_2 = ConstructXData(Label="blockB body", ReferencePlane=xy_2, AssemblyObjectNameReference=name_2)

# ---- group: Create AssemblyObject
aocon = ConstructAssemblyObject(Name=name, CollisionMesh=mesh, ReferencePlane=xy, Direction=X, Weight="1.0", Handles=merge_2)

aocon_2 = ConstructAssemblyObject(Name=name_2, CollisionMesh=mesh_2, ReferencePlane=xy_2, Direction=X_2, Weight="1.0", Handles=handle_3)

# ---- group: XData
merge_3 = Merge(Data1=flatten(xdcon), Data2=flatten(xdcon_2))
data = Data(merge_3)

# ---- group: AssemblyObjects set
merge_4 = Merge(Data1=flatten(aocon), Data2=flatten(aocon_2))
data_2 = Data(merge_4)

# ----
self_object = BooleanToggle(True)
self_handle = BooleanToggle(True)
cross_type = BooleanToggle(False)
heuw = HeuristicsWriter(
    AssemblyObjectsSet=data_2,
    AllowSelfObjectConnections=self_object,
    AllowSelfHandleConnections=self_handle,
    AllowCrossTypeConnections=cross_type)

# ---- group: select rules by index number
number_slider = Slider(28, range=0..166)
panel = Panel("""0
1
2
5
120
160""")
item = ListItem(List=heuw, Index=panel, Wrap=True)

# ----
number_slider_2 = Slider(1.093, range=1..2)
pt_3 = Point(Point(0, 1500, 0))
heuristics_rules = Panel(heuw)
heudex = HeuristicsDisplayEx(
    OriginPoint=pt_3,
    AssemblyObjectsSet=data_2,
    XData=data,
    HeuristicsString=heuw,
    XSize=number_slider_2,
    YSize=number_slider_2,
    NRows=Slider(14, range=10..50))  # -> AssemblyObjectPairs, CoherencePattern, HeuristicsStringTree, TextBasePoints, XData

# ---- group: display text
number_slider_3 = Slider(80, range=0..100)
number_slider_4 = Slider(100, range=0..100)
swatch = ColourSwatch(SwatchColor=RGB(99, 99, 99))
f_ifroml = IndexesFromList(Data=flatten(heudex.HeuristicsStringTree))  # -> graft(Indexes)
swatch_2 = ColourSwatch(SwatchColor=RGB(0, 0, 0))

# ---- group: filter valid AO
dispatch = Dispatch(List=heudex.AssemblyObjectPairs, DispatchPattern=heudex.CoherencePattern)  # -> ListA, ListB

# ---- group: filter valid Heuristics
dispatch_2 = Dispatch(List=heudex.HeuristicsStringTree, DispatchPattern=heudex.CoherencePattern)  # -> ListA, ListB

# ---- group: display XData
xddecon = DeconstructXData(XData=heudex.XData)  # -> Label, Data, ReferencePlane, AssemblyObjectNameReference

# ----
# receiver rotation angle (in degrees)
# receiver Handle index
# sender Handle index
# receiver Object name
# sender Object name
# rO | rH = rHA < sO | sH % r_iWeight
panel_2 = Panel("rName|1=90<sName|3%0")

# ---- group: display invalid combinations
aocmesh = ExtractCollisionMesh(AssemblyObject=dispatch.ListB)
f_mmeea = MeshesExtractEdgesWithToleranceAngle(Mesh=aocmesh, Angle=45)  # -> InternalEdges, NakedEdges
previewlw = CustomPreviewLineweights(
    Geometry=[f_mmeea.InternalEdges, f_mmeea.NakedEdges],
    Shader=ColourSwatch(SwatchColor=RGB(255, 0, 0)),
    Thickness="3",
    Absolute=False)

# ---- group: display text / bake rule index
tag = TextTag3D(Location=heudex.TextBasePoints, Text=f_ifroml, Size=number_slider_3, Colour=swatch, Justification=8)

# ---- group: display XData / bake XData
data_3 = Data(xddecon.Data)

# ---- group: display text / bake text
tag_2 = TextTag3D(Location=heudex.TextBasePoints, Text=heudex.HeuristicsStringTree, Size=number_slider_4, Colour=swatch_2, Justification=2)

# ----
aocmesh_2 = ExtractCollisionMesh(AssemblyObject=dispatch.ListA)
rules = ValueList({"all": 0, "manual": 1}, selected="all")
# rule integer Weight
number_slider_5 = Slider(0, range=0..1)

# ---- group: manually pick rules
# Ensure the button is in Select mode (if in Locked mode, double-clik on it).
# 
# Select as you would normally in Rhino using the mouse (Shift to add, Ctrl to subtract, Window select, etc.).
# 
# Once happy with your selection, double click on the button to put it in Locked mode.
selpv = SelectablePreview(
    Geometry=aocmesh_2,
    lock=True,
    maintain=False,
    order=False,
    selectedobject="53|52|35|34|33|32|31|30|29|11|10|9|8|7|6|5|4|190|189|187|186|185|184|171|169|168|167|166|165|164|163|162|161|160|145|144|143|142|141|140|138")  # -> Geometry, Path, Index
branch = TreeBranch(Tree=dispatch_2.ListA, Path=selpv.Path, MaintainPaths=True)  # -> flatten(Branch)

# ----
branch_2 = TreeBranch(Tree=dispatch.ListA, Path=selpv.Path, MaintainPaths=True)
filter = StreamFilter(Gate=rules, Stream0=dispatch.ListA, Stream1=branch_2)
selected_rules = Panel(branch)

# ---- group: bake Collision meshes
aocmesh_3 = ExtractCollisionMesh(AssemblyObject=filter)

# ---- group: display geometries
color = ValueList({"by type": 0, "by s/r status": 1}, selected="by s/r status")
# a
panel_3 = Panel("""AliceBlue
SlateGray""")
# b
panel_4 = Panel("""229,229,220
SlateGray""")
aotype = ExtractType(AssemblyObject=filter)
item_2 = ListItem(List=panel_3, Index=aotype, Wrap=True)
filter_2 = StreamFilter(Gate=color, Stream0=item_2, Stream1=panel_4)
f_mmeea_2 = MeshesExtractEdgesWithToleranceAngle(Mesh=aocmesh_3, Angle=45)  # -> InternalEdges, NakedEdges
# IMPORTANT NOTE: In rare cases, you might see an error in the Custom Preview component.
# 
# Although at the moment the cause is unclear, the solution is to replace (a) and (b) with colours generated from Colour Swatch components.
preview = CustomPreview(Geometry=aocmesh_3, Material=filter_2)
previewlw_2 = CustomPreviewLineweights(Geometry=[f_mmeea_2.InternalEdges, f_mmeea_2.NakedEdges], Shader=ColourSwatch(SwatchColor=RGB(0, 0, 0)), Absolute=False)
