# Grasshopper definition 01-06_Assemblage 2 objects composite.gh (Grasshopper 1.0.7)
# Copyright: Co-de-iT
# plug-ins: Human, EleFront, Assembler, froGH

# ---- group: all polylines
crv = Curve([<curve referenced from the Rhino model> x10])

# ---- group: selected polylines
crv_2 = Curve([<curve referenced from the Rhino model> x7])

crv_3 = Curve([<curve referenced from the Rhino model> x6])

# ----
lng = ListLength(List=crv)
# ASSEMBLAGES IN BRIEF: GENERAL STEPS
# 
# . choose WHERE to add
# 
# . choose WHAT to add
# 
# 
# PROCESS STEPS
# 
# 
# 
# . select receiver object in the assemblage
# 
# . list all possible combinations of free handles and related compatible candidates
# 
# . choose a winnig candidate according to given criteria
# DEFINITION ANATOMY: 00 - constuct
# 
# Construct the object and relationships necessary for the Assemblage
# 
# 
# 
# 01 - simulate
# 
# Simulate the Assemblage growth
# 
# 
# 
# 02 - analyze/post-process
# 
# Analyze results and post-process the obtained assemblage
# 0 - construct
rotations = Panel("0")
weight = Panel("0")
type = Panel("1")
repeat = RepeatData(Data=graft(rotations), Length=lng)
repeat_2 = RepeatData(Data=type, Length=lng)
repeat_3 = RepeatData(Data=weight, Length=lng)
flip = FlipMatrix(Data=repeat)  # -> simplify(Data)

lng_2 = ListLength(List=crv_2)
rotations_2 = Panel("0")
weight_2 = Panel("0")
type_2 = Panel("1")
repeat_4 = RepeatData(Data=graft(rotations_2), Length=lng_2)
repeat_5 = RepeatData(Data=type_2, Length=lng_2)
repeat_6 = RepeatData(Data=weight_2, Length=lng_2)
flip_2 = FlipMatrix(Data=repeat_4)  # -> simplify(Data)

lng_3 = ListLength(List=crv_3)
rotations_3 = Panel("0")
type_3 = Panel("1")
weight_3 = Panel("0")
repeat_7 = RepeatData(Data=graft(rotations_3), Length=lng_3)
repeat_8 = RepeatData(Data=type_3, Length=lng_3)
repeat_9 = RepeatData(Data=weight_3, Length=lng_3)
flip_3 = FlipMatrix(Data=repeat_7)  # -> simplify(Data)

# ---- group: Create Handles
handle = ConstructHandle(Polyline=crv, RotationAngles=flip, Type=repeat_2, Weight=repeat_3)

handle_2 = ConstructHandle(Polyline=crv_2, RotationAngles=flip_2, Type=repeat_5, Weight=repeat_6)

handle_3 = ConstructHandle(Polyline=crv_3, RotationAngles=flip_3, Type=repeat_8, Weight=repeat_9)

# ----
model_abs_size = BooleanToggle(True)
model_abs_size_2 = BooleanToggle(True)
model_abs_size_3 = BooleanToggle(True)

# ----
# Assembler
# 
# Framework for Iterative Assemblages workflow
# 
# code by Alessio Erioli
# 
# v 1.0
# © Co-de-iT 2020 / Creative Commons Attribution-Non Commercial-ShareAlike 4.0 International License
mesh = Mesh(<mesh referenced from the Rhino model>)
volume = Volume(Geometry=mesh)  # -> Volume, Centroid
name = Panel("block A")
X = UnitX(Factor=1)
xy = XYPlane(Origin=volume.Centroid)

mesh_2 = Mesh(<mesh referenced from the Rhino model>)
volume_2 = Volume(Geometry=mesh_2)  # -> Volume, Centroid
name_2 = Panel("composite")
X_2 = UnitX(Factor=1)
xy_2 = XYPlane(Origin=volume_2.Centroid)

mesh_3 = Mesh(<mesh referenced from the Rhino model>)
volume_3 = Volume(Geometry=mesh_3)  # -> Volume, Centroid
name_3 = Panel("composite2")
X_3 = UnitX(Factor=1)
xy_3 = XYPlane(Origin=volume_3.Centroid)

# ---- group: Display Handles
handdisp = DisplayHandle(Handles=handle, DisplaySize=Slider(0.1, range=0..0.5), ModelScreenSize=model_abs_size)

handdisp_2 = DisplayHandle(Handles=handle_2, DisplaySize=Slider(0.1, range=0..0.5), ModelScreenSize=model_abs_size_2)

handdisp_3 = DisplayHandle(Handles=handle_3, DisplaySize=Slider(0.1, range=0..0.5), ModelScreenSize=model_abs_size_3)

# ---- group: Create AssemblyObject
aocon = ConstructAssemblyObject(Name=name, CollisionMesh=mesh, ReferencePlane=xy, Direction=X, Weight="1.0", Handles=handle)

aocon_2 = ConstructAssemblyObject(Name=name_2, CollisionMesh=mesh_2, ReferencePlane=xy_2, Direction=X_2, Weight="1.0", Handles=handle_2)

aocon_3 = ConstructAssemblyObject(Name=name_3, CollisionMesh=mesh_3, ReferencePlane=xy_3, Direction=X_3, Weight="1.0", Handles=handle_3)

# ----
merge = Merge(Data1=aocon, Data2=aocon_2)

# ---- group: heuristics
self_object = BooleanToggle(True)
self_handle = BooleanToggle(True)
cross_type = BooleanToggle(False)
heuw = HeuristicsWriter(
    AssemblyObjectsSet=merge,
    AllowSelfObjectConnections=self_object,
    AllowSelfHandleConnections=self_handle,
    AllowCrossTypeConnections=cross_type)
display = ValueList({"by Type": 0, "by s/r status": 1}, selected="by Type")
cell_size = Slider(1.2, range=1..2)
number_slider = Slider(10, range=10..50)
show_edges = BooleanToggle(True)
pt = Point(Point(0, 20, 0))

# ---- group: filter heuristics
heudex = HeuristicsDisplayEx(OriginPoint=Point(0, 0, 0), AssemblyObjectsSet=merge, HeuristicsString=heuw, XSize=1, YSize=1, NRows=10)  # -> AssemblyObjectPairs, CoherencePattern, HeuristicsStringTree, TextBasePoints, XData
cull = CullPattern(List=flatten(heudex.HeuristicsStringTree), CullPattern=flatten(heudex.CoherencePattern))

# ---- group: heuristics / Heuristics Display
heud = HeuristicDisplay(
    OriginPoint=pt,
    AssemblyObjectsSet=merge,
    HeuristicsString=heuw,
    XSize=cell_size,
    YSize=cell_size,
    NRows=number_slider,
    ShowEdges=show_edges,
    DisplayMode=display)

# ----
step = Button()
reset = Button()
pt_2 = Point(Point(0, -50, 0))

# ---- group: Random Assemblage Engine
# 1 - simulate
aoeng = AssemblerEngineSimple(
    AssemblyObjectsSet=merge,
    StartingPlane=pt_2,
    StartingObjectType=0,
    HeuristicsString=cull,
    Go=False,
    Step=step,
    NIterations=Slider(100, range=10..100),
    MaxNObjects="1000",
    Reset=reset,
    FastCollisionCheck=False)  # -> Assemblage, AssemblageCount

# ----
heuristics_rules = Panel(heuw)
panel = Panel(aoeng.AssemblageCount)
dam = DataDam(DataA=aoeng.Assemblage, BufferDelay=10000000, BufferMode=0)
display_2 = ValueList({"objects": 0, "occupancy": 1, "type": 2, "sequence": 3, "Z height": 4, "none": 5}, selected="type")
aoadecon = DeconstructAssemblage(Assemblage=dam)  # -> AssemblageObjects, AssemblageRules, ReceiverObjectsIndexes, AvailableObjectIndexes, UnreachableObjectIndexes
panel_2 = Panel("""AliceBlue
SlateGray
GoldenRod
YellowGreen
DarkKhaki""")
# receiver rotation angle (in degrees)
# receiver Handle index
# sender Handle index
# rule integer Weight
# receiver Object name
# sender Object name
# rO | rH = rHA < sO | sH % r_iWeight
panel_3 = Panel("rName|1=90<sName|3%0")

# ---- group: filter by AssemblyObject name
aodecon = DeconstructAssemblyObject(AssemblyObject=aoadecon.AssemblageObjects)  # -> Name, CollisionMesh, ReferencePlane, Direction, Weight, OccludedNeighbours, Handles, Children
panel_4 = Panel("composite2")
panel_5 = Panel("composite")
panel_6 = Panel("block A")
merge_2 = Merge(Data1=panel_6, Data2=panel_5, Data3=panel_4)
tmatch = MatchText(Text=graft(aodecon.Name), Pattern=merge_2, Case=True)
f_ifroml = IndexesFromList(Data=tmatch)
cull_2 = CullPattern(List=f_ifroml, CullPattern=tmatch)  # -> flatten(List)
sift = SiftPattern(List=aodecon.ReferencePlane, SiftPattern=cull_2)  # -> Output0, Output1, Output2

# ----
aoplane = ExtractReferencePlane(AssemblyObject=aoadecon.AssemblageObjects)

# ---- group: filter by type
aotype = ExtractType(AssemblyObject=aoadecon.AssemblageObjects)
sift_2 = SiftPattern(List=aoplane, SiftPattern=aotype)  # -> Output0, Output1, Output2

# ----
# 2 - analyze/post-process
cluster = Cluster(vizmode=display_2, assemblage=aoeng.Assemblage, type_colors=panel_2, stop_and_go_bool=step)  # -> meshes, edges

# ---- group: display components
mjoin = MeshJoin(Meshes=cluster.meshes)
unweld = UnweldMesh(Mesh=mjoin, Angle=1.570796327)
preview = CustomPreview(Geometry=unweld, Material=ColourSwatch(SwatchColor=RGB(255, 255, 255)))  # disabled

# ---- group: display components / display edges
previewlw = CustomPreviewLineweights(Geometry=cluster.edges, Shader=ColourSwatch(SwatchColor=RGB(0, 0, 0)), Thickness=Slider(1, range=1..3), Absolute=False)

# ----
inblock = InsertBlock(BlockName=panel_5, SourcePlane=sift.Output1)
inblock_2 = InsertBlock(BlockName=panel_4, SourcePlane=sift.Output2)
inblock_3 = InsertBlock(BlockName=panel_6, SourcePlane=sift.Output0)
bake_blocks = BooleanToggle(False)
merge_3 = Merge(Data1=inblock_3, Data2=inblock, Data3=inblock_2)
bake = BakeObjects(Geometry=merge_3, Bake=bake_blocks)

# ==== cluster Cluster
vizmode = ClusterInput()
assemblage = ClusterInput()
type_colors = ClusterInput()
stop_and_go_bool = ClusterInput()
aoadecon = DeconstructAssemblage(Assemblage=assemblage)  # -> AssemblageObjects, AssemblageRules, ReceiverObjectsIndexes, AvailableObjectIndexes, UnreachableObjectIndexes
filter = StreamFilter(Gate=stop_and_go_bool, Stream0=assemblage)
gate = StreamGate(Stream=aoadecon.AssemblageObjects, Gate=stop_and_go_bool)  # -> Target0, Target1
aoset = ExtractAOSet(Assemblage=filter)
gate_2 = StreamGate(Stream=gate.Target0, Gate=vizmode)  # -> Target0, Target1, Target2, Target3, Target4, Target5
aocmesh = ExtractCollisionMesh(AssemblyObject=aoset)
f_mseea = MeshExtractEdgesWithToleranceAngle(Mesh=aocmesh, Angle="45")  # -> InternalEdges, NakedEdges

# ---- group: extract object type
aotype = ExtractType(AssemblyObject=gate.Target0)

# ----
aocmesh_2 = ExtractCollisionMesh(AssemblyObject=gate_2.Target3)
aocmesh_3 = ExtractCollisionMesh(AssemblyObject=gate_2.Target2)
aocmesh_4 = ExtractCollisionMesh(AssemblyObject=gate_2.Target1)
aocmesh_5 = ExtractCollisionMesh(AssemblyObject=gate_2.Target4)
group = Group(Objects=f_mseea.InternalEdges)  # -> flatten(Group)
lng = ListLength(List=aocmesh_4)
aoplane = ExtractReferencePlane(AssemblyObject=aoset)
aoplane_2 = ExtractReferencePlane(AssemblyObject=gate_2.Target4)
repeat = RepeatData(Data="0", Length=lng)

# ---- group: display by assemblage sequence
lng_2 = ListLength(List=aocmesh_2)  # -> expr("x-1", Length)
f_ifroml = IndexesFromList(D=aocmesh_2)  # -> i; inputs D: list
# ---------- f_ifroml: C# usings ----------
using System.Linq;
# ---------- f_ifroml: C# ----------
   
 /*
    froGH - a sparse collection of (in)utilities for Grasshopper

    Indexes from Number
    code by Alessio Erioli

    froGH by Co-de-iT is licensed under a Creative Commons Attribution 4.0 International License.
    http://creativecommons.org/licenses/by/4.0/

    */
    initComp();
   
    GH_Integer[] indexes = new GH_Integer[D.Count];

    for(int j = 0; j < D.Count; j++)
      indexes[j] = new GH_Integer(j);

    //A = indexes.Sum(j => j.Value); // uses System.Linq Sum selector function - for each GH_Integer j in indexes add its value to the total sum

    i = indexes;
# ---------- f_ifroml: C# additional code ----------
  void initComp(){
    Component.Name = "Indexes from List";
    Component.NickName = "f_iFromL";
    Component.Description = "Generates a list of 0-based integer indexes from a given list of data";
    Component.Params.Input[0].Name = "Data";
    Component.Params.Input[0].Description = "the list to index";
    Component.Params.Output[0].Name = "Indexes";
    Component.Params.Output[0].Description = "the generated indexes";
  }
# ---------- end f_ifroml ----------
one_over_x = OneOverX(Value=lng_2)
multiplication = Multiplication(A=f_ifroml, B=one_over_x)
sqr = Square(Value=multiplication)
gradient = Gradient(
    LowerLimit=0,
    UpperLimit=1,
    Parameter=sqr,
    stops=[0: RGB(0, 0, 0), 0.498: RGB(56, 136, 150), 0.904: RGB(186, 224, 224), 1: RGB(255, 255, 255)])
mcol = MeshColours(Mesh=graft(aocmesh_2), Colours=graft(gradient))  # -> flatten(Mesh)

# ----
filter_2 = StreamFilter(Gate=stop_and_go_bool, Stream0=aotype)
pdecon = Deconstruct(Point=aoplane_2)  # -> XComponent, YComponent, ZComponent
aoplane_3 = ExtractReferencePlane(AssemblyObject=gate.Target0)
item = ListItem(List=group, Index=filter_2, Wrap=True)
item_2 = ListItem(List=aoplane, Index=filter_2, Wrap=True)
replace = ReplaceItems(List=repeat, Item="1", Indices=aoadecon.AvailableObjectIndexes, Wrap=False)
bnd = Bounds(Numbers=pdecon.ZComponent)
replace_2 = ReplaceItems(List=replace, Item="2", Indices=aoadecon.UnreachableObjectIndexes, Wrap=False)
orient = Orient(Geometry=item, Source=item_2, Target=aoplane_3)  # -> Geometry, Transform
remap = RemapNumbers(Value=pdecon.ZComponent, Source=bnd, Target=Domain(0, 1))  # -> Mapped, Clipped

# ---- group: occupied/available visualization
saturated = ColourSwatch(SwatchColor=RGB(112, 117, 57))
available = ColourSwatch(SwatchColor=RGB(255, 255, 255))
unreachable = ColourSwatch(SwatchColor=RGB(194, 199, 137))
weave = Weave(Pattern=graft(replace_2), Stream0=saturated, Stream1=available, Stream2=unreachable, NullGaps=False)  # -> simplify(Weave)
mcol_2 = MeshColours(Mesh=graft(aocmesh_4), Colours=weave)  # -> flatten(Mesh)

# ----
gradient_2 = Gradient(
    LowerLimit=0,
    UpperLimit=1,
    Parameter=remap.Mapped,
    stops=[0: RGB(21, 0, 33), 0.326: RGB(150, 66, 114), 0.664: RGB(224, 186, 187), 1: RGB(255, 255, 255)])
ungroup = Ungroup(Group=orient.Geometry)  # -> flatten(Objects)
item_3 = ListItem(List=type_colors, Index=graft(aotype), Wrap=True)  # -> simplify(Item)
aocmesh_6 = ExtractCollisionMesh(AssemblyObject=gate_2.Target0)
aocmesh_7 = ExtractCollisionMesh(AssemblyObject=gate.Target1)
filter_3 = StreamFilter(Gate=stop_and_go_bool, Stream0=ungroup)

# ---- group: display by component type
mcol_3 = MeshColours(Mesh=graft(aocmesh_3), Colours=item_3)  # -> flatten(Mesh)

# ----
mcol_4 = MeshColours(Mesh=graft(aocmesh_5), Colours=graft(gradient_2))  # -> flatten(Mesh)
filter_4 = StreamFilter(Gate=vizmode, Stream0=aocmesh_6, Stream1=mcol_2, Stream2=mcol_3, Stream3=mcol, Stream4=mcol_4)
filter_5 = StreamFilter(Gate=stop_and_go_bool, Stream0=filter_4, Stream1=aocmesh_7)
meshes = ClusterOutput(filter_5)
edges = ClusterOutput(filter_3)
