# Grasshopper definition 01-06_Assemblage 2 objects_selective geometry.gh (Grasshopper 1.0.7)
# Copyright: Co-de-iT
# plug-ins: Human, Assembler, froGH

# ---- group: type 2
crv = Curve([<curve referenced from the Rhino model> x5])

# ---- group: type 1
crv_2 = Curve([<curve referenced from the Rhino model> x4])

crv_3 = Curve([<curve referenced from the Rhino model> x4])

# ----
crv_4 = Curve(crv)
crv_5 = Curve(crv_2)

rotations = Panel("0")
lng = ListLength(List=crv_4)
repeat = RepeatData(Data=graft(rotations), Length=lng)
weight = Panel("0")
flip = FlipMatrix(Data=repeat)  # -> simplify(Data)
repeat_2 = RepeatData(Data=weight, Length=lng)

rotations_2 = Panel("0")
lng_2 = ListLength(List=crv_5)
repeat_3 = RepeatData(Data=graft(rotations_2), Length=lng_2)
weight_2 = Panel("0")
flip_2 = FlipMatrix(Data=repeat_3)  # -> simplify(Data)
repeat_4 = RepeatData(Data=weight_2, Length=lng_2)

crv_6 = Curve(crv_3)

rotations_3 = Panel("0")
lng_3 = ListLength(List=crv_6)
repeat_5 = RepeatData(Data=graft(rotations_3), Length=lng_3)
weight_3 = Panel("0")
flip_3 = FlipMatrix(Data=repeat_5)  # -> simplify(Data)
repeat_6 = RepeatData(Data=weight_3, Length=lng_3)

type = Panel("2")
type_2 = Panel("1")
type_3 = Panel("1")
repeat_7 = RepeatData(Data=type, Length=lng)
repeat_8 = RepeatData(Data=type_2, Length=lng_2)
repeat_9 = RepeatData(Data=type_3, Length=lng_3)

# ---- group: Create Handles
handle = ConstructHandle(Polyline=crv_4, RotationAngles=flip, Type=repeat_7, Weight=repeat_2)

# Assembler
# 
# Framework for Iterative Assemblages workflow
# 
# code by Alessio Erioli
# 
# v 1.0
# © Co-de-iT 2020 / Creative Commons Attribution-Non Commercial-ShareAlike 4.0 International License
handle_2 = ConstructHandle(Polyline=crv_5, RotationAngles=flip_2, Type=repeat_8, Weight=repeat_4)

handle_3 = ConstructHandle(Polyline=crv_6, RotationAngles=flip_3, Type=repeat_9, Weight=repeat_6)

# ----
model_abs_size = BooleanToggle(True)
model_abs_size_2 = BooleanToggle(True)
model_abs_size_3 = BooleanToggle(True)
merge = Merge(Data1=handle_2, Data2=handle)

mesh = Mesh(<mesh referenced from the Rhino model>)
volume = Volume(Geometry=mesh)  # -> Volume, Centroid
name = Panel("typeA")
xy = XYPlane(Origin=volume.Centroid)
X = UnitX(Factor=1)

mesh_2 = Mesh(<mesh referenced from the Rhino model>)
volume_2 = Volume(Geometry=mesh_2)  # -> Volume, Centroid
name_2 = Panel("typeB")
xy_2 = XYPlane(Origin=volume_2.Centroid)
X_2 = UnitX(Factor=1)

# ---- group: Display Handles
handdisp = DisplayHandle(Handles=handle, DisplaySize=Slider(7.261, range=0..10), ModelScreenSize=model_abs_size)

handdisp_2 = DisplayHandle(Handles=handle_2, DisplaySize=Slider(7.261, range=0..10), ModelScreenSize=model_abs_size_2)

handdisp_3 = DisplayHandle(Handles=handle_3, DisplaySize=Slider(7.261, range=0..10), ModelScreenSize=model_abs_size_3)

# ----
crv_7 = Curve()
pt = Point()
brep = Brep()
merge_2 = Merge()
xdcon = ConstructXData(Label="blockA body", Data=merge_2, ReferencePlane=xy, AssemblyObjectNameReference=name)

brep_2 = Brep([<brep referenced from the Rhino model> x20])
xdcon_2 = ConstructXData(Label="typeB extra", Data=brep_2, ReferencePlane=xy_2, AssemblyObjectNameReference=name_2)

# ---- group: Create AssemblyObject
aocon = ConstructAssemblyObject(Name=name, CollisionMesh=mesh, ReferencePlane=xy, Direction=X, Weight="1.0", Handles=merge)

aocon_2 = ConstructAssemblyObject(Name=name_2, CollisionMesh=mesh_2, ReferencePlane=xy_2, Direction=X_2, Weight="1.0", Handles=handle_3)

# ---- group: XData
merge_3 = Merge(Data1=flatten(xdcon), Data2=flatten(xdcon_2))
data = Data(merge_3)

# ---- group: AssemblyObjects
merge_4 = Merge(Data1=flatten(aocon), Data2=flatten(aocon_2))
data_2 = Data(merge_4)

# ----
starting_plane = ValueList({"XY": 0, "YZ": 1, "custom": 2}, selected="XY")
pt_2 = Point(Point(-12807.51619, 13383.37939, 0))

self_object = BooleanToggle(True)
self_handle = BooleanToggle(True)
cross_type = BooleanToggle(False)
heuw = HeuristicsWriter(
    AssemblyObjectsSet=data_2,
    AllowSelfObjectConnections=self_object,
    AllowSelfHandleConnections=self_handle,
    AllowCrossTypeConnections=cross_type)

xy_3 = XYPlane(Origin=pt_2)
yz = YZPlane(Origin=pt_2)
pl = PlaneNormal(Origin=pt_2, ZAxis="1,-1,1")
display = ValueList({"by Type": 0, "by s/r status": 1}, selected="by Type")
filter = StreamFilter(Gate=starting_plane, Stream0=xy_3, Stream1=yz, Stream2=pl)
max_objects = Panel("2000")
step = Button()
reset = Button()

# ---- group: filter heuristics
heudex = HeuristicsDisplayEx(OriginPoint=Point(0, 0, 0), AssemblyObjectsSet=data_2, HeuristicsString=heuw, XSize=1, YSize=1, NRows=10)  # -> AssemblyObjectPairs, CoherencePattern, HeuristicsStringTree, TextBasePoints, XData
cull = CullPattern(List=flatten(heudex.HeuristicsStringTree), CullPattern=flatten(heudex.CoherencePattern))

# ----
cell_size = Slider(1.2, range=1..2)

# ---- group: base point
pt_3 = Point(Point(0, 1500, 0))

# ----
show_edges = BooleanToggle(True)
heuristics_rules = Panel(heuw)

# ---- group: Random Assemblage Engine
aoeng = AssemblerEngineSimple(
    AssemblyObjectsSet=data_2,
    StartingPlane=filter,
    StartingObjectType=0,
    HeuristicsString=cull,
    Go=False,
    Step=step,
    NIterations=Slider(100, range=10..100),
    MaxNObjects=max_objects,
    Reset=reset)  # -> Assemblage, AssemblageCount

# ---- group: Heuristics Display
heud = HeuristicDisplay(
    OriginPoint=pt_3,
    AssemblyObjectsSet=data_2,
    HeuristicsString=heuw,
    XSize=cell_size,
    YSize=cell_size,
    NRows=Slider(10, range=10..50),
    ShowEdges=show_edges,
    DisplayMode=display)

# ----
display_2 = ValueList({"objects": 0, "occupancy": 1, "type": 2, "sequence": 3, "Z height": 4, "none": 5}, selected="type")
n_of_objects = Panel(aoeng.AssemblageCount)
panel = Panel("""AliceBlue
SlateGray
GoldenRod
YellowGreen
DarkKhaki""")
# receiver rotation angle (in degrees)
# receiver Handle index
# sender Handle index
# rule integer Weight
# receiver Object name
# sender Object name
# rO | rH = rHA < sO | sH % r_iWeight
panel_2 = Panel("rName|1=90<sName|3%0")
cluster = Cluster(vizmode=display_2, assemblage=aoeng.Assemblage, type_colors=panel, stop_and_go_bool=step)  # -> meshes, edges
dam = DataDam(DataA=aoeng.Assemblage, BufferDelay=10000000, BufferMode=0)

# ---- group: display components / display edges
previewlw = CustomPreviewLineweights(Geometry=cluster.edges, Shader=ColourSwatch(SwatchColor=RGB(0, 0, 0)), Thickness=Slider(1, range=1..3), Absolute=False)

# ---- group: display components
mjoin = MeshJoin(Meshes=cluster.meshes)
preview = CustomPreview(Geometry=mjoin, Material=ColourSwatch(SwatchColor=RGB(255, 255, 255)))

# ----
aoadecon = DeconstructAssemblage(Assemblage=dam)  # -> AssemblageObjects, AssemblageRules, ReceiverObjectsIndexes, AvailableObjectIndexes, UnreachableObjectIndexes
# component filtering operations
aocmesh = ExtractCollisionMesh(AssemblyObject=aoadecon.AssemblageObjects)
aoplane = ExtractReferencePlane(AssemblyObject=aoadecon.AssemblageObjects)
aotype = ExtractType(AssemblyObject=aoadecon.AssemblageObjects)

# ----
# 2D circle inclusion
md_slider = MDSlider(
    SliderMode=0,
    slider_value=Point(0.2505061452, 0.4467490592, 0.5),
    x_domain=Domain(0, 1),
    y_domain=Domain(0, 1),
    z_domain=Domain(0, 1))
devec = DeconstructVector(Vector=md_slider)  # -> XComponent, YComponent, ZComponent
bbox = BoundingBox(Content=aocmesh, Plane=PlaneXY(0, 0, 0), UnionBox=True)  # -> Box, Box_2
boxprop = BoxProperties(Box=bbox.Box)  # -> Center, Diagonal, Area, Volume, Degeneracy
devec_2 = DeconstructVector(Vector=boxprop.Diagonal)  # -> XComponent, YComponent, ZComponent
box = EvaluateBox(Box=bbox.Box, UParameter=devec.XComponent, VParameter=devec.YComponent, WParameter=devec.ZComponent)  # -> Plane, Point, Include
multiplication = Multiplication(A=devec_2.ZComponent, B="-0.3")
Z = UnitZ(Factor=multiplication)
search_radius = Slider(1608.056, range=0..10000)
move = Move(Geometry=box.Plane, Motion=Z)  # -> Geometry, Transform
project = Project(Geometry=aoplane, Plane=move.Geometry)  # -> Geometry, Transform
cir = Circle(Plane=move.Geometry, Radius=search_radius)
f_ptssph = PointsInSphere(SphereCenter=move.Geometry, PointsToSearch=project.Geometry, SearchRadius=search_radius)  # -> Points, PointsIndexes

# ---- group: visualize occurrencies
choose_ao_type_to_view = Slider(1, range=0..1)
line_scale = Slider(202.691, range=0..1000)

# ----
type_colors = Panel("""AliceBlue
SlateGray
GoldenRod
YellowGreen
DarkKhaki""")

# ---- group: visualize occurrencies
equals = Equality(FirstNumber=aotype, SecondNumber=choose_ao_type_to_view)  # -> Equality, Inequality
cull_2 = CullPattern(List=project.Geometry, CullPattern=equals.Equality)
cullpt = CullDuplicates(Points=cull_2, Tolerance=0.1, CullMode=1)  # -> Points, Indices, Valence
multiplication_2 = Multiplication(A=cullpt.Valence, B=line_scale)
line = LineSDL(Start=cullpt.Points, Direction=Vector(0, 0, 1), Length=multiplication_2)
item = ListItem(List=type_colors, Index=choose_ao_type_to_view, Wrap=True)  # -> flatten(Item)

# ----
item_2 = ListItem(List=type_colors, Index=aotype, Wrap=True)  # -> flatten(Item)
preview_2 = CustomPreview(Geometry=project.Geometry, Material=item_2)

# ---- group: selection area
preview_3 = CustomPreview(Geometry=cir, Material=ColourSwatch(SwatchColor=RGB(151, 255, 87)))

# ---- group: view occurrencies as a line
previewlw_2 = CustomPreviewLineweights(Geometry=line, Shader=item, Thickness="8", Absolute=False)

# ---- group: circle selection
int = Integer(f_ptssph.PointsIndexes)

# ---- group: shortlisted indexes
int_2 = Integer(int)

# ----
aocmesh_2 = ExtractCollisionMesh(AssemblyObject=aoadecon.AssemblageObjects)

# ---- group: shortlisted objects
# extra geometry operations
item_3 = ListItem(List=aocmesh_2, Index=int_2, Wrap=True)

# ---- group: all other objects
cull_i = CullIndex(List=aocmesh_2, Indices=int_2, Wrap=True)

# ----
# selective geometry integration
mesh_col = ColourSwatch(SwatchColor=RGBA(250, 250, 250, 10))
preview_4 = CustomPreview(Geometry=cull_i, Material=mesh_col)

shader = Shader({diffuse=RGB(230, 230, 230), emission=RGB(0, 0, 0), shine=0, specular=RGB(255, 255, 255), transparency=0.178415224})
preview_5 = CustomPreview(Geometry=item_3, Material=shader)

# ---- group: selective geometry integration / extract type 1 objects in neighborhood
item_4 = ListItem(List=aotype, Index=int_2, Wrap=True)
equals_2 = Equality(FirstNumber=item_4, SecondNumber="1")  # -> Equality, Inequality
cull_3 = CullPattern(List=int_2, CullPattern=equals_2.Equality)

# ---- group: select AssemblyObjects
item_5 = ListItem(List=aoadecon.AssemblageObjects, Index=cull_3, Wrap=True)

# ----
aoplane_2 = ExtractReferencePlane(AssemblyObject=item_5)
aocmesh_3 = ExtractCollisionMesh(AssemblyObject=item_5)

# ---- group: selective geometry XData
data_3 = Data(xdcon_2)

# ----
xddecon = DeconstructXData(XData=data_3)  # -> Label, Data, ReferencePlane, AssemblyObjectNameReference

# ---- group: selective geometry integration
type_1_objects_index = Panel(cull_3)
deplane = DeconstructPlane(Plane=aoplane_2)  # -> Origin, XAxis, YAxis, ZAxis

# ---- group: selective geometry integration / filter Z up planes
Z_2 = UnitZ(Factor=1)
any_number_lower_than_pi = Panel("3")
angle = Angle(VectorA=deplane.ZAxis, VectorB=Z_2)  # -> Angle, Reflex
smaller = SmallerThan(FirstNumber=angle.Angle, SecondNumber=any_number_lower_than_pi)  # -> SmallerThan, OrEqualTo

# ---- group: selective geometry integration (continued)
dispatch = Dispatch(List=aoplane_2, DispatchPattern=smaller.SmallerThan)  # -> ListA, ListB
orient = Orient(Geometry=xddecon.Data, Source=xddecon.ReferencePlane, Target=graft(dispatch.ListA))  # -> Geometry, Transform

preview_6 = CustomPreview(Geometry=orient.Geometry, Material=ColourSwatch(SwatchColor=RGB(8, 177, 199)))

# ==== cluster Cluster
vizmode = ClusterInput()
assemblage = ClusterInput()
type_colors = ClusterInput()
stop_and_go_bool = ClusterInput()
aoadecon = DeconstructAssemblage(Assemblage=assemblage)  # -> AssemblageObjects, AssemblageRules, ReceiverObjectsIndexes, AvailableObjectIndexes, UnreachableObjectIndexes
filter = StreamFilter(Gate=stop_and_go_bool, Stream0=assemblage)
gate = StreamGate(Stream=aoadecon.AssemblageObjects, Gate=stop_and_go_bool)  # -> Target0, Target1
aoset = ExtractAOSet(Assemblage=filter)
gate_2 = StreamGate(Stream=gate.Target0, Gate=vizmode)  # -> Target0, Target1, Target2, Target3, Target4, Target5
aocmesh = ExtractCollisionMesh(AssemblyObject=aoset)
f_mseea = MeshExtractEdgesWithToleranceAngle(Mesh=aocmesh, Angle="45")  # -> InternalEdges, NakedEdges

# ---- group: extract object type
aotype = ExtractType(AssemblyObject=gate.Target0)

# ----
aocmesh_2 = ExtractCollisionMesh(AssemblyObject=gate_2.Target3)
aocmesh_3 = ExtractCollisionMesh(AssemblyObject=gate_2.Target2)
aocmesh_4 = ExtractCollisionMesh(AssemblyObject=gate_2.Target1)
aocmesh_5 = ExtractCollisionMesh(AssemblyObject=gate_2.Target4)
group = Group(Objects=f_mseea.InternalEdges)  # -> flatten(Group)
lng = ListLength(List=aocmesh_4)
aoplane = ExtractReferencePlane(AssemblyObject=aoset)
aoplane_2 = ExtractReferencePlane(AssemblyObject=gate_2.Target4)
repeat = RepeatData(Data="0", Length=lng)

# ---- group: display by assemblage sequence
lng_2 = ListLength(List=aocmesh_2)  # -> expr("x-1", Length)
f_ifroml = IndexesFromList(D=aocmesh_2)  # -> i; inputs D: list
# ---------- f_ifroml: C# usings ----------
using System.Linq;
# ---------- f_ifroml: C# ----------
   
 /*
    froGH - a sparse collection of (in)utilities for Grasshopper

    Indexes from Number
    code by Alessio Erioli

    froGH by Co-de-iT is licensed under a Creative Commons Attribution 4.0 International License.
    http://creativecommons.org/licenses/by/4.0/

    */
    initComp();
   
    GH_Integer[] indexes = new GH_Integer[D.Count];

    for(int j = 0; j < D.Count; j++)
      indexes[j] = new GH_Integer(j);

    //A = indexes.Sum(j => j.Value); // uses System.Linq Sum selector function - for each GH_Integer j in indexes add its value to the total sum

    i = indexes;
# ---------- f_ifroml: C# additional code ----------
  void initComp(){
    Component.Name = "Indexes from List";
    Component.NickName = "f_iFromL";
    Component.Description = "Generates a list of 0-based integer indexes from a given list of data";
    Component.Params.Input[0].Name = "Data";
    Component.Params.Input[0].Description = "the list to index";
    Component.Params.Output[0].Name = "Indexes";
    Component.Params.Output[0].Description = "the generated indexes";
  }
# ---------- end f_ifroml ----------
one_over_x = OneOverX(Value=lng_2)
multiplication = Multiplication(A=f_ifroml, B=one_over_x)
sqr = Square(Value=multiplication)
gradient = Gradient(
    LowerLimit=0,
    UpperLimit=1,
    Parameter=sqr,
    stops=[0: RGB(0, 0, 0), 0.498: RGB(56, 136, 150), 0.904: RGB(186, 224, 224), 1: RGB(255, 255, 255)])
mcol = MeshColours(Mesh=graft(aocmesh_2), Colours=graft(gradient))  # -> flatten(Mesh)

# ----
filter_2 = StreamFilter(Gate=stop_and_go_bool, Stream0=aotype)
pdecon = Deconstruct(Point=aoplane_2)  # -> XComponent, YComponent, ZComponent
aoplane_3 = ExtractReferencePlane(AssemblyObject=gate.Target0)
item = ListItem(List=group, Index=filter_2, Wrap=True)
item_2 = ListItem(List=aoplane, Index=filter_2, Wrap=True)
replace = ReplaceItems(List=repeat, Item="1", Indices=aoadecon.AvailableObjectIndexes, Wrap=False)
bnd = Bounds(Numbers=pdecon.ZComponent)
replace_2 = ReplaceItems(List=replace, Item="2", Indices=aoadecon.UnreachableObjectIndexes, Wrap=False)
orient = Orient(Geometry=item, Source=item_2, Target=aoplane_3)  # -> Geometry, Transform
remap = RemapNumbers(Value=pdecon.ZComponent, Source=bnd, Target=Domain(0, 1))  # -> Mapped, Clipped

# ---- group: occupied/available visualization
saturated = ColourSwatch(SwatchColor=RGB(112, 117, 57))
available = ColourSwatch(SwatchColor=RGB(255, 255, 255))
unreachable = ColourSwatch(SwatchColor=RGB(194, 199, 137))
weave = Weave(Pattern=graft(replace_2), Stream0=saturated, Stream1=available, Stream2=unreachable, NullGaps=False)  # -> simplify(Weave)
mcol_2 = MeshColours(Mesh=graft(aocmesh_4), Colours=weave)  # -> flatten(Mesh)

# ----
gradient_2 = Gradient(
    LowerLimit=0,
    UpperLimit=1,
    Parameter=remap.Mapped,
    stops=[0: RGB(21, 0, 33), 0.326: RGB(150, 66, 114), 0.664: RGB(224, 186, 187), 1: RGB(255, 255, 255)])
ungroup = Ungroup(Group=orient.Geometry)  # -> flatten(Objects)
item_3 = ListItem(List=type_colors, Index=graft(aotype), Wrap=True)  # -> simplify(Item)
aocmesh_6 = ExtractCollisionMesh(AssemblyObject=gate_2.Target0)
aocmesh_7 = ExtractCollisionMesh(AssemblyObject=gate.Target1)
filter_3 = StreamFilter(Gate=stop_and_go_bool, Stream0=ungroup)

# ---- group: display by component type
mcol_3 = MeshColours(Mesh=graft(aocmesh_3), Colours=item_3)  # -> flatten(Mesh)

# ----
mcol_4 = MeshColours(Mesh=graft(aocmesh_5), Colours=graft(gradient_2))  # -> flatten(Mesh)
filter_4 = StreamFilter(Gate=vizmode, Stream0=aocmesh_6, Stream1=mcol_2, Stream2=mcol_3, Stream3=mcol, Stream4=mcol_4)
filter_5 = StreamFilter(Gate=stop_and_go_bool, Stream0=filter_4, Stream1=aocmesh_7)
meshes = ClusterOutput(filter_5)
edges = ClusterOutput(filter_3)
