# Grasshopper definition 01-07_Assemblage 2 objects_selective geometry.gh (Grasshopper 1.0.7)
# Copyright: Co-de-iT
# plug-ins: Human, EleFront, Assembler, froGH

# ---- group: type 2
crv = Curve([<curve referenced from the Rhino model> x5])

# ---- group: type 1
crv_2 = Curve([<curve referenced from the Rhino model> x4])

crv_3 = Curve([<curve referenced from the Rhino model> x4])

# ----
crv_4 = Curve(crv)
crv_5 = Curve(crv_2)

rotations = Panel("0")
lng = ListLength(List=crv_4)
repeat = RepeatData(Data=graft(rotations), Length=lng)
weight = Panel("0")
flip = FlipMatrix(Data=repeat)  # -> simplify(Data)
repeat_2 = RepeatData(Data=weight, Length=lng)

rotations_2 = Panel("0")
lng_2 = ListLength(List=crv_5)
repeat_3 = RepeatData(Data=graft(rotations_2), Length=lng_2)
weight_2 = Panel("0")
flip_2 = FlipMatrix(Data=repeat_3)  # -> simplify(Data)
repeat_4 = RepeatData(Data=weight_2, Length=lng_2)

crv_6 = Curve(crv_3)

rotations_3 = Panel("0")
lng_3 = ListLength(List=crv_6)
repeat_5 = RepeatData(Data=graft(rotations_3), Length=lng_3)
weight_3 = Panel("0")
flip_3 = FlipMatrix(Data=repeat_5)  # -> simplify(Data)
repeat_6 = RepeatData(Data=weight_3, Length=lng_3)

type = Panel("2")
type_2 = Panel("1")
type_3 = Panel("1")
repeat_7 = RepeatData(Data=type, Length=lng)
repeat_8 = RepeatData(Data=type_2, Length=lng_2)
repeat_9 = RepeatData(Data=type_3, Length=lng_3)

# ---- group: Create Handles
handle = ConstructHandle(Polyline=crv_4, RotationAngles=flip, Type=repeat_7, Weight=repeat_2)

# Assembler
# 
# Framework for Iterative Assemblages workflow
# 
# code by Alessio Erioli
# 
# v 1.0
# © Co-de-iT 2020 / Creative Commons Attribution-Non Commercial-ShareAlike 4.0 International License
handle_2 = ConstructHandle(Polyline=crv_5, RotationAngles=flip_2, Type=repeat_8, Weight=repeat_4)

handle_3 = ConstructHandle(Polyline=crv_6, RotationAngles=flip_3, Type=repeat_9, Weight=repeat_6)

# ----
model_abs_size = BooleanToggle(True)
model_abs_size_2 = BooleanToggle(True)
model_abs_size_3 = BooleanToggle(True)
merge = Merge(Data1=handle_2, Data2=handle)

mesh = Mesh(<mesh referenced from the Rhino model>)
volume = Volume(Geometry=mesh)  # -> Volume, Centroid
name = Panel("typeA")
xy = XYPlane(Origin=volume.Centroid)
X = UnitX(Factor=1)

mesh_2 = Mesh(<mesh referenced from the Rhino model>)
volume_2 = Volume(Geometry=mesh_2)  # -> Volume, Centroid
name_2 = Panel("typeB")
xy_2 = XYPlane(Origin=volume_2.Centroid)
X_2 = UnitX(Factor=1)

# ---- group: Display Handles
handdisp = DisplayHandle(Handles=handle, DisplaySize=Slider(0.1, range=0..0.5), ModelScreenSize=model_abs_size)

handdisp_2 = DisplayHandle(Handles=handle_2, DisplaySize=Slider(0.1, range=0..0.5), ModelScreenSize=model_abs_size_2)

handdisp_3 = DisplayHandle(Handles=handle_3, DisplaySize=Slider(0.1, range=0..0.5), ModelScreenSize=model_abs_size_3)

# ----
pt = Point(<point referenced from the Rhino model>)
xy_3 = XYPlane(Origin=pt)
xdcon = ConstructXData(Label="typeB extra", Data=xy_3, ReferencePlane=xy_2, AssemblyObjectNameReference=name_2)

xdcon_2 = ConstructXData(Label="blockA body", ReferencePlane=xy, AssemblyObjectNameReference=name)

# ---- group: Create AssemblyObject
aocon = ConstructAssemblyObject(Name=name, CollisionMesh=mesh, ReferencePlane=xy, Direction=X, Weight="1.0", Handles=merge)

aocon_2 = ConstructAssemblyObject(Name=name_2, CollisionMesh=mesh_2, ReferencePlane=xy_2, Direction=X_2, Weight="1.0", Handles=handle_3)

# ---- group: XData
merge_2 = Merge(Data1=flatten(xdcon_2), Data2=flatten(xdcon))
data = Data(merge_2)

# ---- group: AssemblyObjects
merge_3 = Merge(Data1=flatten(aocon), Data2=flatten(aocon_2))
data_2 = Data(merge_3)

# ----
starting_plane = ValueList({"XY": 0, "YZ": 1, "custom": 2}, selected="XY")
pt_2 = Point(Point(-50, 50, 0))

self_object = BooleanToggle(True)
self_handle = BooleanToggle(True)
cross_type = BooleanToggle(False)
heuw = HeuristicsWriter(
    AssemblyObjectsSet=data_2,
    AllowSelfObjectConnections=self_object,
    AllowSelfHandleConnections=self_handle,
    AllowCrossTypeConnections=cross_type)

xy_4 = XYPlane(Origin=pt_2)
yz = YZPlane(Origin=pt_2)
pl = PlaneNormal(Origin=pt_2, ZAxis="1,-1,1")
display = ValueList({"by Type": 0, "by s/r status": 1}, selected="by Type")
filter = StreamFilter(Gate=starting_plane, Stream0=xy_4, Stream1=yz, Stream2=pl)
max_objects = Panel("2000")
step = Button()
reset = Button()

# ---- group: filter heuristics
heudex = HeuristicsDisplayEx(OriginPoint=Point(0, 0, 0), AssemblyObjectsSet=data_2, HeuristicsString=heuw, XSize=1, YSize=1, NRows=10)  # -> AssemblyObjectPairs, CoherencePattern, HeuristicsStringTree, TextBasePoints, XData
cull = CullPattern(List=flatten(heudex.HeuristicsStringTree), CullPattern=flatten(heudex.CoherencePattern))

# ----
cell_size = Slider(1.2, range=1..2)
show_edges = BooleanToggle(True)

# ---- group: base point
pt_3 = Point(Point(0, 20, 0))

# ----
heuristics_rules = Panel(heuw)

# ---- group: Random Assemblage Engine
aoeng = AssemblerEngineSimple(
    AssemblyObjectsSet=data_2,
    StartingPlane=filter,
    StartingObjectType=0,
    HeuristicsString=cull,
    Go=False,
    Step=step,
    NIterations=Slider(100, range=10..100),
    MaxNObjects=max_objects,
    Reset=reset,
    FastCollisionCheck=False)  # -> Assemblage, AssemblageCount

# ---- group: Heuristics Display
heud = HeuristicDisplay(
    OriginPoint=pt_3,
    AssemblyObjectsSet=data_2,
    HeuristicsString=heuw,
    XSize=cell_size,
    YSize=cell_size,
    NRows=Slider(10, range=10..50),
    ShowEdges=show_edges,
    DisplayMode=display)

# ----
display_2 = ValueList({"objects": 0, "occupancy": 1, "type": 2, "sequence": 3, "Z height": 4, "none": 5}, selected="type")
n_of_objects = Panel(aoeng.AssemblageCount)
panel = Panel("""AliceBlue
SlateGray
GoldenRod
YellowGreen
DarkKhaki""")
# receiver rotation angle (in degrees)
# receiver Handle index
# sender Handle index
# rule integer Weight
# receiver Object name
# sender Object name
# rO | rH = rHA < sO | sH % r_iWeight
panel_2 = Panel("rName|1=90<sName|3%0")
cluster = Cluster(vizmode=display_2, assemblage=aoeng.Assemblage, type_colors=panel, stop_and_go_bool=step)  # -> meshes, edges
dam = DataDam(DataA=aoeng.Assemblage, BufferDelay=10000000, BufferMode=0)

# ---- group: display components / display edges
previewlw = CustomPreviewLineweights(Geometry=cluster.edges, Shader=ColourSwatch(SwatchColor=RGB(0, 0, 0)), Thickness=Slider(1, range=1..3), Absolute=False)

# ---- group: display components
mjoin = MeshJoin(Meshes=cluster.meshes)
preview = CustomPreview(Geometry=mjoin, Material=ColourSwatch(SwatchColor=RGB(255, 255, 255)))  # disabled

# ----
aoadecon = DeconstructAssemblage(Assemblage=dam)  # -> AssemblageObjects, AssemblageRules, ReceiverObjectsIndexes, AvailableObjectIndexes, UnreachableObjectIndexes
# component filtering operations
aocmesh = ExtractCollisionMesh(AssemblyObject=aoadecon.AssemblageObjects)
aoplane = ExtractReferencePlane(AssemblyObject=aoadecon.AssemblageObjects)
aotype = ExtractType(AssemblyObject=aoadecon.AssemblageObjects)
# insert objects as Blocks in the Rhino file
listblockd = ListBlockDocument()
available_blocks = Panel(listblockd)

# ----
# 2D circle inclusion
md_slider = MDSlider(
    SliderMode=0,
    slider_value=Point(0.6571431974, 0.6376595846, 0.5),
    x_domain=Domain(0, 1),
    y_domain=Domain(0, 1),
    z_domain=Domain(0, 1))
devec = DeconstructVector(Vector=md_slider)  # -> XComponent, YComponent, ZComponent
bbox = BoundingBox(Content=aocmesh, Plane=PlaneXY(0, 0, 0), UnionBox=True)  # -> Box, Box_2
boxprop = BoxProperties(Box=bbox.Box)  # -> Center, Diagonal, Area, Volume, Degeneracy
devec_2 = DeconstructVector(Vector=boxprop.Diagonal)  # -> XComponent, YComponent, ZComponent
box = EvaluateBox(Box=bbox.Box, UParameter=devec.XComponent, VParameter=devec.YComponent, WParameter=devec.ZComponent)  # -> Plane, Point, Include
multiplication = Multiplication(A=devec_2.ZComponent, B="-0.3")
Z = UnitZ(Factor=multiplication)
search_radius = Slider(15.696, range=0..50)
move = Move(Geometry=box.Plane, Motion=Z)  # -> Geometry, Transform
project = Project(Geometry=aoplane, Plane=move.Geometry)  # -> Geometry, Transform
cir = Circle(Plane=move.Geometry, Radius=search_radius)
f_ptssph = PointsInSphere(SphereCenter=move.Geometry, PointsToSearch=project.Geometry, SearchRadius=search_radius)  # -> Points, PointsIndexes

# ---- group: visualize occurrencies
choose_ao_type_to_view = Slider(1, range=0..1)
line_scale = Slider(1.955, range=-0.001..10)

# ----
panel_3 = Panel("""L-shape
L-shape_hole""")
aotype_2 = ExtractType(AssemblyObject=aoadecon.AssemblageObjects)
# insert blocks can be a long operation, use Data Dam to avoid long waiting times during the assemblage
dam_2 = DataDam(DataA=aoplane, BufferDelay=10000000, BufferMode=0)
item = ListItem(List=panel_3, Index=aotype_2, Wrap=True)
inblock = InsertBlock(BlockName=item, SourcePlane=dam_2)
# What does it do?: . compute the assemblage bounding box
# . project all object reference planes to the bottom face of the bounding box
# . evaluate a point on the same box face
# . find all the points and corresponding objects indexes inside a given radius
# ....but why??!?: . in this example the goal is to find suitable places to add stairs
# . vertical connections usually work better when concentrated in a limited area
# . therefore, this method works like a "cylindrical selection" to find possible "shunts" for the placement of stairs
bake = BooleanToggle(False)
type_colors = Panel("""AliceBlue
SlateGray
GoldenRod
YellowGreen
DarkKhaki""")

# ---- group: visualize occurrencies
equals = Equality(FirstNumber=aotype, SecondNumber=choose_ao_type_to_view)  # -> Equality, Inequality
cull_2 = CullPattern(List=project.Geometry, CullPattern=equals.Equality)
cullpt = CullDuplicates(Points=cull_2, Tolerance=0.1, CullMode=1)  # -> Points, Indices, Valence
multiplication_2 = Multiplication(A=cullpt.Valence, B=line_scale)
line = LineSDL(Start=cullpt.Points, Direction=Vector(0, 0, 1), Length=multiplication_2)
item_2 = ListItem(List=type_colors, Index=choose_ao_type_to_view, Wrap=True)  # -> flatten(Item)

# ----
bake_2 = BakeObjects(Geometry=inblock, Bake=bake)

item_3 = ListItem(List=type_colors, Index=aotype, Wrap=True)  # -> flatten(Item)
preview_2 = CustomPreview(Geometry=project.Geometry, Material=item_3)

# ---- group: selection area
preview_3 = CustomPreview(Geometry=cir, Material=ColourSwatch(SwatchColor=RGB(151, 255, 87)))

# ---- group: view occurrencies as a line
previewlw_2 = CustomPreviewLineweights(Geometry=line, Shader=item_2, Thickness="8", Absolute=False)

# ---- group: circle selection
int = Integer(f_ptssph.PointsIndexes)

# ---- group: shortlisted indexes
# selective geometry integration
int_2 = Integer(int)

# ----
item_4 = ListItem(List=aoadecon.AssemblageObjects, Index=int_2, Wrap=True)

# ---- group: selective geometry XData
data_3 = Data(xdcon)

# ---- group: extract type 1 objects in neighborhood
# selective geometry integration - the extensive way
item_5 = ListItem(List=aotype, Index=int_2, Wrap=True)  # disabled
panel_4 = Panel("1")  # disabled
equals_2 = Equality(FirstNumber=item_5, SecondNumber=panel_4)  # -> Equality, Inequality; disabled
cull_3 = CullPattern(List=int_2, CullPattern=equals_2.Equality)  # disabled

# ----
aoxd = AssociateXData(AssemblyObjects=item_4, XData=data_3)
xddecon = DeconstructXData(XData=aoxd)  # -> Label, Data, ReferencePlane, AssemblyObjectNameReference

# ---- group: filter planes facing up - the easy way
deplane = DeconstructPlane(Plane=xddecon.Data)  # -> Origin, XAxis, YAxis, ZAxis
devec_3 = DeconstructVector(Vector=deplane.ZAxis)  # -> XComponent, YComponent, ZComponent
# Facing up means a normal pointing in the direction of the absolute Z coordinate, so if a plane faces up, the Z coordinate of its Z vector should be > 0
panel_5 = Panel("0")
larger = LargerThan(FirstNumber=devec_3.ZComponent, SecondNumber=panel_5)  # -> LargerThan, OrEqualTo

# ---- group: select AssemblyObjects
item_6 = ListItem(List=aoadecon.AssemblageObjects, Index=cull_3, Wrap=True)  # disabled

# ----
dispatch = Dispatch(List=xddecon.Data, DispatchPattern=larger.LargerThan)  # -> ListA, ListB
bake_3 = BooleanToggle(False)
inblock_2 = InsertBlock(BlockName="stair", SourcePlane=dispatch.ListA)

# ---- group: selective geometry XData
data_4 = Data()  # disabled

# ----
bake_4 = BakeObjects(Geometry=inblock_2, Bake=bake_3)

preview_4 = CustomPreview(Geometry=inblock_2, Material=ColourSwatch(SwatchColor=RGB(8, 177, 199)))

# ----
# extra geometry operations
# display shortlisted objects
aocmesh_2 = ExtractCollisionMesh(AssemblyObject=aoadecon.AssemblageObjects)
M = Material({diffuse=RGB(230, 230, 230), emission=RGB(0, 0, 0), shine=0, specular=RGB(255, 255, 255), transparency=0.5632000566})

# ---- group: shortlisted objects
item_7 = ListItem(List=aocmesh_2, Index=int_2, Wrap=True)

# ---- group: all other objects
cull_i = CullIndex(List=aocmesh_2, Indices=int_2, Wrap=True)

# ----
M_2 = Material({diffuse=RGB(255, 255, 255), emission=RGB(0, 0, 0), shine=0.8, specular=RGB(255, 255, 255), transparency=0})
preview_5 = CustomPreview(Geometry=item_7, Material=M_2)

preview_6 = CustomPreview(Geometry=cull_i, Material=M)

# ----
# this method is deprecated, however it might be useful for the understanding of the logic of filtering
type_1_objects_index = Panel(cull_3)  # disabled
aoplane_2 = ExtractReferencePlane(AssemblyObject=item_6)  # disabled
aocmesh_3 = ExtractCollisionMesh(AssemblyObject=item_6)  # disabled
deplane_2 = DeconstructPlane(Plane=aoplane_2)  # -> Origin, XAxis, YAxis, ZAxis; disabled

# ---- group: filter Z up planes
Z_2 = UnitZ(Factor=1)  # disabled
any_number_lower_than_pi = Panel("3")  # disabled
angle = Angle(VectorA=deplane_2.ZAxis, VectorB=Z_2)  # -> Angle, Reflex; disabled
smaller = SmallerThan(FirstNumber=angle.Angle, SecondNumber=any_number_lower_than_pi)  # -> SmallerThan, OrEqualTo; disabled

# ----
dispatch_2 = Dispatch(List=item_6, DispatchPattern=smaller.SmallerThan)  # -> ListA, ListB; disabled
aoxd_2 = AssociateXData(AssemblyObjects=dispatch_2.ListA, XData=data_4)  # disabled
xddecon_2 = DeconstructXData(XData=aoxd_2)  # -> Label, Data, ReferencePlane, AssemblyObjectNameReference; disabled
pln = Plane(xddecon_2.Data)  # disabled

# ==== cluster Cluster
vizmode = ClusterInput()
assemblage = ClusterInput()
type_colors = ClusterInput()
stop_and_go_bool = ClusterInput()
aoadecon = DeconstructAssemblage(Assemblage=assemblage)  # -> AssemblageObjects, AssemblageRules, ReceiverObjectsIndexes, AvailableObjectIndexes, UnreachableObjectIndexes
filter = StreamFilter(Gate=stop_and_go_bool, Stream0=assemblage)
gate = StreamGate(Stream=aoadecon.AssemblageObjects, Gate=stop_and_go_bool)  # -> Target0, Target1
aoset = ExtractAOSet(Assemblage=filter)
gate_2 = StreamGate(Stream=gate.Target0, Gate=vizmode)  # -> Target0, Target1, Target2, Target3, Target4, Target5
aocmesh = ExtractCollisionMesh(AssemblyObject=aoset)
f_mseea = MeshExtractEdgesWithToleranceAngle(Mesh=aocmesh, Angle="45")  # -> InternalEdges, NakedEdges

# ---- group: extract object type
aotype = ExtractType(AssemblyObject=gate.Target0)

# ----
aocmesh_2 = ExtractCollisionMesh(AssemblyObject=gate_2.Target3)
aocmesh_3 = ExtractCollisionMesh(AssemblyObject=gate_2.Target2)
aocmesh_4 = ExtractCollisionMesh(AssemblyObject=gate_2.Target1)
aocmesh_5 = ExtractCollisionMesh(AssemblyObject=gate_2.Target4)
group = Group(Objects=f_mseea.InternalEdges)  # -> flatten(Group)
lng = ListLength(List=aocmesh_4)
aoplane = ExtractReferencePlane(AssemblyObject=aoset)
aoplane_2 = ExtractReferencePlane(AssemblyObject=gate_2.Target4)
repeat = RepeatData(Data="0", Length=lng)

# ---- group: display by assemblage sequence
lng_2 = ListLength(List=aocmesh_2)  # -> expr("x-1", Length)
f_ifroml = IndexesFromList(D=aocmesh_2)  # -> i; inputs D: list
# ---------- f_ifroml: C# usings ----------
using System.Linq;
# ---------- f_ifroml: C# ----------
   
 /*
    froGH - a sparse collection of (in)utilities for Grasshopper

    Indexes from Number
    code by Alessio Erioli

    froGH by Co-de-iT is licensed under a Creative Commons Attribution 4.0 International License.
    http://creativecommons.org/licenses/by/4.0/

    */
    initComp();
   
    GH_Integer[] indexes = new GH_Integer[D.Count];

    for(int j = 0; j < D.Count; j++)
      indexes[j] = new GH_Integer(j);

    //A = indexes.Sum(j => j.Value); // uses System.Linq Sum selector function - for each GH_Integer j in indexes add its value to the total sum

    i = indexes;
# ---------- f_ifroml: C# additional code ----------
  void initComp(){
    Component.Name = "Indexes from List";
    Component.NickName = "f_iFromL";
    Component.Description = "Generates a list of 0-based integer indexes from a given list of data";
    Component.Params.Input[0].Name = "Data";
    Component.Params.Input[0].Description = "the list to index";
    Component.Params.Output[0].Name = "Indexes";
    Component.Params.Output[0].Description = "the generated indexes";
  }
# ---------- end f_ifroml ----------
one_over_x = OneOverX(Value=lng_2)
multiplication = Multiplication(A=f_ifroml, B=one_over_x)
sqr = Square(Value=multiplication)
gradient = Gradient(
    LowerLimit=0,
    UpperLimit=1,
    Parameter=sqr,
    stops=[0: RGB(0, 0, 0), 0.498: RGB(56, 136, 150), 0.904: RGB(186, 224, 224), 1: RGB(255, 255, 255)])
mcol = MeshColours(Mesh=graft(aocmesh_2), Colours=graft(gradient))  # -> flatten(Mesh)

# ----
filter_2 = StreamFilter(Gate=stop_and_go_bool, Stream0=aotype)
pdecon = Deconstruct(Point=aoplane_2)  # -> XComponent, YComponent, ZComponent
aoplane_3 = ExtractReferencePlane(AssemblyObject=gate.Target0)
item = ListItem(List=group, Index=filter_2, Wrap=True)
item_2 = ListItem(List=aoplane, Index=filter_2, Wrap=True)
replace = ReplaceItems(List=repeat, Item="1", Indices=aoadecon.AvailableObjectIndexes, Wrap=False)
bnd = Bounds(Numbers=pdecon.ZComponent)
replace_2 = ReplaceItems(List=replace, Item="2", Indices=aoadecon.UnreachableObjectIndexes, Wrap=False)
orient = Orient(Geometry=item, Source=item_2, Target=aoplane_3)  # -> Geometry, Transform
remap = RemapNumbers(Value=pdecon.ZComponent, Source=bnd, Target=Domain(0, 1))  # -> Mapped, Clipped

# ---- group: occupied/available visualization
saturated = ColourSwatch(SwatchColor=RGB(112, 117, 57))
available = ColourSwatch(SwatchColor=RGB(255, 255, 255))
unreachable = ColourSwatch(SwatchColor=RGB(194, 199, 137))
weave = Weave(Pattern=graft(replace_2), Stream0=saturated, Stream1=available, Stream2=unreachable, NullGaps=False)  # -> simplify(Weave)
mcol_2 = MeshColours(Mesh=graft(aocmesh_4), Colours=weave)  # -> flatten(Mesh)

# ----
gradient_2 = Gradient(
    LowerLimit=0,
    UpperLimit=1,
    Parameter=remap.Mapped,
    stops=[0: RGB(21, 0, 33), 0.326: RGB(150, 66, 114), 0.664: RGB(224, 186, 187), 1: RGB(255, 255, 255)])
ungroup = Ungroup(Group=orient.Geometry)  # -> flatten(Objects)
item_3 = ListItem(List=type_colors, Index=graft(aotype), Wrap=True)  # -> simplify(Item)
aocmesh_6 = ExtractCollisionMesh(AssemblyObject=gate_2.Target0)
aocmesh_7 = ExtractCollisionMesh(AssemblyObject=gate.Target1)
filter_3 = StreamFilter(Gate=stop_and_go_bool, Stream0=ungroup)

# ---- group: display by component type
mcol_3 = MeshColours(Mesh=graft(aocmesh_3), Colours=item_3)  # -> flatten(Mesh)

# ----
mcol_4 = MeshColours(Mesh=graft(aocmesh_5), Colours=graft(gradient_2))  # -> flatten(Mesh)
filter_4 = StreamFilter(Gate=vizmode, Stream0=aocmesh_6, Stream1=mcol_2, Stream2=mcol_3, Stream3=mcol, Stream4=mcol_4)
filter_5 = StreamFilter(Gate=stop_and_go_bool, Stream0=filter_4, Stream1=aocmesh_7)
meshes = ClusterOutput(filter_5)
edges = ClusterOutput(filter_3)
