# Grasshopper definition 02-01_Heuristics Save-Load.gh (Grasshopper 1.0.7)
# Copyright: Co-de-iT
# plug-ins: froGH

# ---- group: Heuristics from Heuristics Writer or selection
# save heuristics
txt = Text(["slab|0=0<column|1%0", "slab|1=0<column|1%0", "slab|2=0<column|1%0", "slab|3=0<column|1%0", "slab|4=0<column|0%0", "slab|5=0<column|0%0", "slab|6=0<column|0%0", "slab|7=0<column|0%0", "column|0=0<slab|4%0", "column|0=0<slab|5%0", "column|0=0<slab|6%0", "column|0=0<slab|7%0", "column|0=0<column|1%0", "column|1=0<slab|0%0", "column|1=0<slab|1%0", "column|1=0<slab|2%0", "column|1=0<slab|3%0", "column|1=0<column|0%0"])

# ----
f_ghfilepath = GHFilePathInfo()  # -> FileName, FilePath
concat = Concatenate(FragmentA=f_ghfilepath.FilePath, FragmentB="heuristics\")
file_name = Panel("heuristics 00.txt")
# <title>
# 
# <description>
# 
# code by Alessio Erioli
# 
# v 0.1
# © Co-de-iT 2020 / Creative Commons Attribution-Non Commercial-ShareAlike 4.0 International License
file_path = Panel(concat)
panel = Panel(txt)
save = Button()
# load heuristics
# drag&drop
# the .txt file
# directly
f_str2file = SaveStringToFile(String=txt, FilePath=concat, FileName=file_name, SaveTrigger=save)
