# Grasshopper definition 02-04_Assemblage 2 Objects Environment_shortest walk.gh (Grasshopper 1.0.7)
# Copyright: Co-de-iT
# plug-ins: MeshEdit Components, Human, Assembler, froGH, Shortest Walk in Gh

# ---- group: container
pt = Point(Point(-138.3028437, 194.8813592, -3.9998166))
box = CenterBox(Base=pt, X=Slider(60, range=10..200), Y=Slider(150, range=10..200), Z=Slider(6, range=1..200))
mbox = MeshBox(Base=box, XCount="1", YCount="1", ZCount="1")
weldvertices = MeshWeldVertices(Mesh=mbox, Tolerance=0.01)  # -> RuntimeMessage, Mesh

# ---- group: obstacle
pt_2 = Point(Point(-158.4726811, 181.8390975, 0))
box_2 = CenterBox(Base=pt_2, X=Slider(11, range=10..200), Y=Slider(22, range=10..200), Z=Slider(26, range=1..200))
weldvertices_2 = MeshWeldVertices(Mesh=box_2, Tolerance=0.01)  # -> RuntimeMessage, Mesh
mbox_2 = MeshBox(Base=weldvertices_2.Mesh, XCount="1", YCount="1", ZCount="1")

pt_3 = Point(Point(-122.3339923, 282.1586602, 0))
box_3 = CenterBox(Base=pt_3, X=Slider(24, range=10..200), Y=Slider(10, range=10..200), Z=Slider(26, range=1..200))
weldvertices_3 = MeshWeldVertices(Mesh=box_3, Tolerance=0.01)  # -> RuntimeMessage, Mesh
mbox_3 = MeshBox(Base=weldvertices_3.Mesh, XCount="1", YCount="1", ZCount="1")

# ---- group: type 1
crv = Curve([<curve referenced from the Rhino model> x4])

# ---- group: type 2
crv_2 = Curve([<curve referenced from the Rhino model> x2])

# ---- group: type 1
# 0 - construct
crv_3 = Curve([<curve referenced from the Rhino model> x3])

# ---- group: type 2
crv_4 = Curve([<curve referenced from the Rhino model> x2])

# ----
merge = Merge(Data1=flatten(crv), Data2=flatten(crv_2))
merge_2 = Merge(Data1=flatten(crv_3), Data3=flatten(crv_4))

rotations = Panel("""0
180""")
lng = ListLength(List=merge)
type = Panel("""1
1
1
1
2
2""")
repeat = RepeatData(Data=graft(rotations), Length=lng)
weight = Panel("0")
flip = FlipMatrix(Data=repeat)  # -> simplify(Data)
repeat_2 = RepeatData(Data=weight, Length=lng)

# ----
# ASSEMBLAGES IN BRIEF: GENERAL STEPS
# 
# . choose WHERE to add
# 
# . choose WHAT to add
# 
# 
# PROCESS STEPS
# 
# 
# 
# . select receiver object in the assemblage
# 
# . list all possible combinations of free handles and related compatible candidates
# 
# . choose a winnig candidate according to given criteria
# DEFINITION ANATOMY: 00 - constuct
# 
# Construct the object and relationships necessary for the Assemblage
# 
# 
# 
# 01 - simulate
# 
# Simulate the Assemblage growth
# 
# 
# 
# 02 - analyze/post-process
# 
# Analyze results and post-process the obtained assemblage
rotations_2 = Panel("""0
180""")
lng_2 = ListLength(List=merge_2)
type_2 = Panel("""1
1
1
2
2""")
repeat_3 = RepeatData(Data=graft(rotations_2), Length=lng_2)
weight_2 = Panel("0")
flip_2 = FlipMatrix(Data=repeat_3)  # -> simplify(Data)
repeat_4 = RepeatData(Data=weight_2, Length=lng_2)

# ---- group: single container
mesh = Mesh(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)

# ----
environment = ValueList({"single mesh container": 0, "container + obstacles": 1}, selected="single mesh container")

# ---- group: single container
# flip normals: A container must have normals pointing inward
flip_3 = MeshFlip(Mesh=mesh)

# ---- group: Create Handles
handle = ConstructHandle(Polyline=merge, RotationAngles=flip, Type=type, Weight=repeat_2)

handle_2 = ConstructHandle(Polyline=merge_2, RotationAngles=flip_2, Type=type_2, Weight=repeat_4)

# ---- group: container
# flip normals: A container must have normals pointing inward
flip_4 = MeshFlip(Mesh=weldvertices.Mesh)

# ----
model_abs_size = BooleanToggle(True)
model_abs_size_2 = BooleanToggle(True)

merge_3 = Merge(Data1=flip_4, Data2=mbox_2, Data3=mbox_3)  # -> flatten(Result)

mesh_2 = Mesh(<mesh referenced from the Rhino model>)
volume = Volume(Geometry=mesh_2)  # -> Volume, Centroid
name = Panel("blockB")
xy = XYPlane(Origin=volume.Centroid)
X = UnitX(Factor=1)

crv_5 = Curve([<curve referenced from the Rhino model> x12])
pt_4 = Point([<point referenced from the Rhino model> x7])
brep = Brep()
brep_2 = Brep([<brep referenced from the Rhino model> x21])
merge_4 = Merge(Data1=crv_5, Data2=pt_4)
xdcon = ConstructXData(Label="blockB body", ReferencePlane=xy, AssemblyObjectNameReference=name)

# ----
# Assembler
# 
# Framework for Iterative Assemblages workflow
# 
# code by Alessio Erioli
# 
# v 1.0
# © Co-de-iT 2020 / Creative Commons Attribution-Non Commercial-ShareAlike 4.0 International License
mesh_3 = Mesh(<mesh referenced from the Rhino model>)
volume_2 = Volume(Geometry=mesh_3)  # -> Volume, Centroid
name_2 = Panel("blockA")
xy_2 = XYPlane(Origin=volume_2.Centroid)
X_2 = UnitX(Factor=1)

crv_6 = Curve([<curve referenced from the Rhino model> x12])
pt_5 = Point([<point referenced from the Rhino model> x7])
brep_3 = Brep()
brep_4 = Brep(<brep referenced from the Rhino model>)
merge_5 = Merge(Data1=crv_6, Data2=pt_5)
xdcon_2 = ConstructXData(Label="blockA body", ReferencePlane=xy_2, AssemblyObjectNameReference=name_2)

# ---- group: Display Handles
handdisp = DisplayHandle(Handles=handle, DisplaySize=Slider(0.1, range=0..0.5), ModelScreenSize=model_abs_size)

handdisp_2 = DisplayHandle(Handles=handle_2, DisplaySize=Slider(0.1, range=0..0.5), ModelScreenSize=model_abs_size_2)

# ----
filter = StreamFilter(Gate=environment, Stream0=flip_3, Stream1=merge_3)

# ---- group: Create AssemblyObject
aocon = ConstructAssemblyObject(Name=name_2, CollisionMesh=mesh_3, ReferencePlane=xy_2, Direction=X_2, Weight="1.0", Handles=handle_2)

aocon_2 = ConstructAssemblyObject(Name=name, CollisionMesh=mesh_2, ReferencePlane=xy, Direction=X, Weight="1.0", Handles=handle)

# ---- group: display Environment Geometries
obstacles = ColourSwatch(SwatchColor=RGB(115, 124, 148))
containers = ColourSwatch(SwatchColor=RGB(0, 0, 0))
merge_6 = Merge(Data1=obstacles, Data2=containers)
mesh_4 = Mesh(filter)
cluster = Cluster(environment_meshes=mesh_4, colours=merge_6, normal_size=Slider(10, range=1..100))

# ---- group: XData
merge_7 = Merge(Data1=flatten(xdcon_2), Data2=flatten(xdcon))
data = Data(merge_7)

# ---- group: AssemblyObjects
merge_8 = Merge(Data1=flatten(aocon), Data2=flatten(aocon_2))
data_2 = Data(merge_8)

# ----
self_object = BooleanToggle(True)
self_handle = BooleanToggle(True)
cross_type = BooleanToggle(False)
heuw = HeuristicsWriter(
    AssemblyObjectsSet=data_2,
    AllowSelfObjectConnections=self_object,
    AllowSelfHandleConnections=self_handle,
    AllowCrossTypeConnections=cross_type)

# ---- group: filter heuristics
heudex = HeuristicsDisplayEx(OriginPoint=Point(0, 0, 0), AssemblyObjectsSet=data_2, HeuristicsString=heuw, XSize=1, YSize=1, NRows=10)  # -> AssemblyObjectPairs, CoherencePattern, HeuristicsStringTree, TextBasePoints, XData
cull = CullPattern(List=flatten(heudex.HeuristicsStringTree), CullPattern=flatten(heudex.CoherencePattern))

# ----
display = ValueList({"by Type": 0, "by s/r status": 1}, selected="by Type")
heuset = HeuristicsSettings(HeuristicsString=cull, CurrentHeuristics=0, ReceiverSelectionMode=0, RuleSelectionMode=0)
go = BooleanToggle(False)
step = Button()
max_objects = Panel("2000")
resetex = Button()
exoset = ExogeousSettings(
    EnvironmentMeshes=filter,
    EnvironmentMode=1,
    FieldScalarThreshold=0.5,
    Sandbox={Plane=PlaneXY(0, 0, 0), X=Domain(-1, 1), Y=Domain(0, 0), Z=Domain(0, 0)})
reset = Button()
cell_size = Slider(1.2, range=1..2)
show_edges = BooleanToggle(True)

# ---- group: base point
pt_6 = Point(Point(0, 1500, 0))

# ----
pt_7 = Point(Point(-129.8796384, 113.0177957, 0))

# ---- group: Heuristics Display
heud = HeuristicDisplay(
    OriginPoint=pt_6,
    AssemblyObjectsSet=data_2,
    HeuristicsString=heuw,
    XSize=cell_size,
    YSize=cell_size,
    NRows=Slider(10, range=10..50),
    ShowEdges=show_edges,
    DisplayMode=display)

# ----
# 1 - simulate
xy_3 = XYPlane(Origin=pt_7)

# ---- group: Assemblage Engine Xtended
aoengx = AssemblerEngineX(
    AssemblyObjectsSet=data_2,
    StartingPlane=xy_3,
    StartingObjectType=0,
    HeuristicsSettings=heuset,
    ExogenousSettings=exoset,
    Go=go,
    Step=step,
    NIterations=Slider(100, range=10..100),
    MaxNObjects=max_objects,
    ResetExogenous=resetex,
    Reset=reset)  # -> Assemblage, AssemblageCount

# ----
n_of_objects = Panel(aoengx.AssemblageCount)

# ---- group: auto-stop
larger = LargerThan(FirstNumber=aoengx.AssemblageCount, SecondNumber=max_objects)  # -> LargerThan, OrEqualTo
f_tas = ToggleAutostop(Toggle=go, Condition=larger.OrEqualTo)

# ----
or = GateOr(A=go, B=step)
display_2 = ValueList({"objects": 0, "occupancy": 1, "type": 2, "sequence": 3, "Z height": 4, "none": 5}, selected="occupancy")
# Data Dam: Click on the play symbol (when present) to manually update the data
dam = DataDam(DataA=aoengx.Assemblage, BufferDelay=10000000, BufferMode=0)
panel = Panel("""AliceBlue
SlateGray
GoldenRod
YellowGreen
DarkKhaki""")
# shortest walk - AssemblyObjects connections
aoadecon = DeconstructAssemblage(Assemblage=dam)  # -> AssemblageObjects, AssemblageRules, ReceiverObjectsIndexes, AvailableObjectIndexes, UnreachableObjectIndexes
# Assemblage Topology: hO - Handle Occupancy
# 
# 0 - available
# 1 - connected
# 2 - occluded
# 
# nO - neighbour AssemblyObject index (-1 if handle is available)
# 
# nH - neighbour Handle index (-1 if handle is available or occluded)
aotopo = ExtractTopology(Assemblage=dam)  # -> HandleOccupancy, NeighbourObjectIndex, NeighbourHandleIndex
# 2 - analyze/post-process
cluster_2 = Cluster_2(vizmode=display_2, assemblage=aoengx.Assemblage, type_colors=panel, stop_and_go_bool=or)  # -> meshes, edges

# ---- group: filter connected handles
aosp = ExtractSenderHandlesPlanes(AssemblyObject=aoadecon.AssemblageObjects)
equals = Equality(FirstNumber=aotopo.HandleOccupancy, SecondNumber="1")  # -> Equality, Inequality
dispatch = Dispatch(List=aosp, DispatchPattern=equals.Equality)  # -> ListA, ListB

# ----
aoplane = ExtractReferencePlane(AssemblyObject=aoadecon.AssemblageObjects)  # -> graft(ReferencePlane)
ln = Line(StartPoint=aoplane, EndPoint=dispatch.ListA)
line = Line(flatten(ln))
explode = Explode(Curve=line, Recursive=True)  # -> Segments, flatten(Vertices)
pt_8 = Point(Point(-135.1267271, 89.91773086, 40.85860484))
pt_9 = Point(Point(-112.3993947, 152.29993, -36.42701588))
cp = ClosestPoint(Point=pt_8, Cloud=explode.Vertices)  # -> ClosestPoint, CPIndex, Distance
cp_2 = ClosestPoint(Point=pt_9, Cloud=explode.Vertices)  # -> ClosestPoint, CPIndex, Distance
ln_2 = Line(StartPoint=cp.ClosestPoint, EndPoint=cp_2.ClosestPoint)
shortwalk = ShortestWalk(Curves=line, WantedPath=ln_2)  # -> ShortestWalk, Succession, Direction, Length
previewlw = CustomPreviewLineweights(Geometry=shortwalk.ShortestWalk, Shader=ColourSwatch(SwatchColor=RGB(255, 212, 0)), Thickness="5", Absolute=False)

panel_2 = Panel(aotopo.HandleOccupancy)

# ---- group: display components / display edges
previewlw_2 = CustomPreviewLineweights(Geometry=cluster_2.edges, Shader=ColourSwatch(SwatchColor=RGB(0, 0, 0)), Thickness=Slider(1, range=1..3), Absolute=False)

# ---- group: display components
mjoin = MeshJoin(Meshes=cluster_2.meshes)
preview = CustomPreview(Geometry=mjoin, Material=ColourSwatch(SwatchColor=RGB(255, 255, 255)))

# ----
panel_3 = Panel(ln)

# ---- group: network of connected objects
previewlw_3 = CustomPreviewLineweights(Geometry=line, Shader=ColourSwatch(SwatchColor=RGB(255, 0, 0)), Absolute=False)

# ---- group: extract indexes of involved objects
f_ifroml = IndexesFromList(Data=line)
unflatten = UnflattenTree(Tree=f_ifroml, Guide=ln)
mindex = MemberIndex(Set=unflatten, Member=shortwalk.Succession)  # -> Index, Count
f_massbool = MassBoolean(Values=mindex.Count, BooleanOperator="1", Boolean_operator=1)  # -> flatten(Result)

# ----
panel_4 = Panel(unflatten)
panel_5 = Panel(shortwalk.Succession)
panel_6 = Panel(mindex.Count)
aocmesh = ExtractCollisionMesh(AssemblyObject=aoadecon.AssemblageObjects)
# finding objects involved in the shortest walk: the steps are:
# 
# . generate an index for each of the lines in the network
# 
# . rebuild the original tree structure for the indexes (this puts the index of each line in a branch which index corresponds to the Object the line belongs to)
# 
# . check in which branches are the indexes involved in the shortest walk (see how Member Index works below)
dispatch_2 = Dispatch(List=aocmesh, DispatchPattern=f_massbool)  # -> ListA, ListB

# ---- group: how Member Index works / set to search from
int = Integer(Tree({0;0;0}: [2, 1, 5, 8, 7], {0;0;1}: [7, 8, 8, 6, 2], {0;0;2}: [7, 8, 8, 6, 2], {0;0;3}: [2, 1, 5, 8, 7], {0;0;4}: [7, 8, 8, 6, 2]))

# ----
preview_2 = CustomPreview(Geometry=dispatch_2.ListA, Material=ColourSwatch(SwatchColor=RGB(255, 244, 186)))

# ---- group: how Member Index works
# This tells us if any number occurs in any of the provided sets (each branch is considered one separate set)
members = Panel("""5
9
1
3""")
panel_7 = Panel(int)

# ---- group: how Member Index works / members to search for
int_2 = Integer(members)

# ---- group: how Member Index works (continued)
mindex_2 = MemberIndex(Set=int, Member=int_2)  # -> Index, Count
numbers_of_occurrences = Panel(mindex_2.Count)

# ==== cluster Cluster
environment_meshes = ClusterInput()
colours = ClusterInput()  # First Colour for obstacles, second for containers
normal_size = ClusterInput()
volume = MeshVolume(Mesh=environment_meshes)  # -> Volume, Centroid
smaller = SmallerThan(FirstNumber=volume.Volume, SecondNumber=0)  # -> SmallerThan, OrEqualTo
panel = Panel("""3
1""")
item = ListItem(List=colours, Index=graft(smaller.SmallerThan), Wrap=True)
item_2 = ListItem(List=panel, Index=graft(smaller.SmallerThan), Wrap=True)
medges = MeshEdges(Mesh=environment_meshes)  # -> NakedEdges, InteriorEdges, NonManifoldEdges
facen = FaceNormals(Mesh=environment_meshes)  # -> Centers, Normals
multiplication = Multiplication(A=facen.Normals, B=normal_size)
previewlw = CustomPreviewLineweights(Geometry=medges.InteriorEdges, Shader=graft(item), Thickness=graft(item_2), Absolute=False)
vdisex = VectorDisplayEx(Point=facen.Centers, Vector=multiplication, Colour=graft(item), Width=2)

# ==== cluster Cluster_2
vizmode = ClusterInput()
assemblage = ClusterInput()
type_colors = ClusterInput()
stop_and_go_bool = ClusterInput()
aoadecon = DeconstructAssemblage(Assemblage=assemblage)  # -> AssemblageObjects, AssemblageRules, ReceiverObjectsIndexes, AvailableObjectIndexes, UnreachableObjectIndexes
filter = StreamFilter(Gate=stop_and_go_bool, Stream0=assemblage)
gate = StreamGate(Stream=aoadecon.AssemblageObjects, Gate=stop_and_go_bool)  # -> Target0, Target1
aoset = ExtractAOSet(Assemblage=filter)
gate_2 = StreamGate(Stream=gate.Target0, Gate=vizmode)  # -> Target0, Target1, Target2, Target3, Target4, Target5
aocmesh = ExtractCollisionMesh(AssemblyObject=aoset)
f_mseea = MeshExtractEdgesWithToleranceAngle(Mesh=aocmesh, Angle="45")  # -> InternalEdges, NakedEdges

# ---- group: extract object type
aotype = ExtractType(AssemblyObject=gate.Target0)

# ----
aocmesh_2 = ExtractCollisionMesh(AssemblyObject=gate_2.Target3)
aocmesh_3 = ExtractCollisionMesh(AssemblyObject=gate_2.Target2)
aocmesh_4 = ExtractCollisionMesh(AssemblyObject=gate_2.Target1)
aocmesh_5 = ExtractCollisionMesh(AssemblyObject=gate_2.Target4)
group = Group(Objects=f_mseea.InternalEdges)  # -> flatten(Group)
lng = ListLength(List=aocmesh_4)
aoplane = ExtractReferencePlane(AssemblyObject=aoset)
aoplane_2 = ExtractReferencePlane(AssemblyObject=gate_2.Target4)
repeat = RepeatData(Data="0", Length=lng)

# ---- group: display by assemblage sequence
lng_2 = ListLength(List=aocmesh_2)  # -> expr("x-1", Length)
f_ifroml = IndexesFromList(D=aocmesh_2)  # -> i; inputs D: list
# ---------- f_ifroml: C# usings ----------
using System.Linq;
# ---------- f_ifroml: C# ----------
   
 /*
    froGH - a sparse collection of (in)utilities for Grasshopper

    Indexes from Number
    code by Alessio Erioli

    froGH by Co-de-iT is licensed under a Creative Commons Attribution 4.0 International License.
    http://creativecommons.org/licenses/by/4.0/

    */
    initComp();
   
    GH_Integer[] indexes = new GH_Integer[D.Count];

    for(int j = 0; j < D.Count; j++)
      indexes[j] = new GH_Integer(j);

    //A = indexes.Sum(j => j.Value); // uses System.Linq Sum selector function - for each GH_Integer j in indexes add its value to the total sum

    i = indexes;
# ---------- f_ifroml: C# additional code ----------
  void initComp(){
    Component.Name = "Indexes from List";
    Component.NickName = "f_iFromL";
    Component.Description = "Generates a list of 0-based integer indexes from a given list of data";
    Component.Params.Input[0].Name = "Data";
    Component.Params.Input[0].Description = "the list to index";
    Component.Params.Output[0].Name = "Indexes";
    Component.Params.Output[0].Description = "the generated indexes";
  }
# ---------- end f_ifroml ----------
one_over_x = OneOverX(Value=lng_2)
multiplication = Multiplication(A=f_ifroml, B=one_over_x)
sqr = Square(Value=multiplication)
gradient = Gradient(
    LowerLimit=0,
    UpperLimit=1,
    Parameter=sqr,
    stops=[0: RGB(0, 0, 0), 0.498: RGB(56, 136, 150), 0.904: RGB(186, 224, 224), 1: RGB(255, 255, 255)])
mcol = MeshColours(Mesh=graft(aocmesh_2), Colours=graft(gradient))  # -> flatten(Mesh)

# ----
filter_2 = StreamFilter(Gate=stop_and_go_bool, Stream0=aotype)
pdecon = Deconstruct(Point=aoplane_2)  # -> XComponent, YComponent, ZComponent
aoplane_3 = ExtractReferencePlane(AssemblyObject=gate.Target0)
item = ListItem(List=group, Index=filter_2, Wrap=True)
item_2 = ListItem(List=aoplane, Index=filter_2, Wrap=True)
replace = ReplaceItems(List=repeat, Item="1", Indices=aoadecon.AvailableObjectIndexes, Wrap=False)
bnd = Bounds(Numbers=pdecon.ZComponent)
replace_2 = ReplaceItems(List=replace, Item="2", Indices=aoadecon.UnreachableObjectIndexes, Wrap=False)
orient = Orient(Geometry=item, Source=item_2, Target=aoplane_3)  # -> Geometry, Transform
remap = RemapNumbers(Value=pdecon.ZComponent, Source=bnd, Target=Domain(0, 1))  # -> Mapped, Clipped

# ---- group: occupied/available visualization
saturated = ColourSwatch(SwatchColor=RGB(112, 117, 57))
available = ColourSwatch(SwatchColor=RGB(255, 255, 255))
unreachable = ColourSwatch(SwatchColor=RGB(194, 199, 137))
weave = Weave(Pattern=graft(replace_2), Stream0=saturated, Stream1=available, Stream2=unreachable, NullGaps=False)  # -> simplify(Weave)
mcol_2 = MeshColours(Mesh=graft(aocmesh_4), Colours=weave)  # -> flatten(Mesh)

# ----
gradient_2 = Gradient(
    LowerLimit=0,
    UpperLimit=1,
    Parameter=remap.Mapped,
    stops=[0: RGB(21, 0, 33), 0.326: RGB(150, 66, 114), 0.664: RGB(224, 186, 187), 1: RGB(255, 255, 255)])
ungroup = Ungroup(Group=orient.Geometry)  # -> flatten(Objects)
item_3 = ListItem(List=type_colors, Index=graft(aotype), Wrap=True)  # -> simplify(Item)
aocmesh_6 = ExtractCollisionMesh(AssemblyObject=gate_2.Target0)
aocmesh_7 = ExtractCollisionMesh(AssemblyObject=gate.Target1)
filter_3 = StreamFilter(Gate=stop_and_go_bool, Stream0=ungroup)

# ---- group: display by component type
mcol_3 = MeshColours(Mesh=graft(aocmesh_3), Colours=item_3)  # -> flatten(Mesh)

# ----
mcol_4 = MeshColours(Mesh=graft(aocmesh_5), Colours=graft(gradient_2))  # -> flatten(Mesh)
filter_4 = StreamFilter(Gate=vizmode, Stream0=aocmesh_6, Stream1=mcol_2, Stream2=mcol_3, Stream3=mcol, Stream4=mcol_4)
filter_5 = StreamFilter(Gate=stop_and_go_bool, Stream0=filter_4, Stream1=aocmesh_7)
meshes = ClusterOutput(filter_5)
edges = ClusterOutput(filter_3)
