# Grasshopper definition 03-00_Fields - construct.gh (Grasshopper 1.0.7)
# Copyright: Co-de-iT
# plug-ins: Human, Assembler, froGH

# Fields from Box
number_slider = Slider(94, range=1..200)
xy = XYPlane(Origin="220,0,0")
xy_2 = XYPlane(Origin=Point(0, 0, 0))
prot = RotatePlane(Plane=xy, Angle=Slider(0, range=0..3.142))
prot_2 = RotatePlane(Plane=xy_2, Angle=Slider(0, range=0..3.142))
# Fields from Mesh
mesh = Mesh(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)
box = CenterBox(Base="0,0,0", X=number_slider, Y=Slider(120, range=1..200), Z=Slider(85, range=1..200))
box_2 = CenterBox(Base=prot, X=Slider(94, range=1..200), Y=Slider(120, range=1..200), Z=Slider(85, range=1..200))
X = UnitX(Factor="400")
move = Move(Geometry=mesh, Motion=X)  # -> Geometry, Transform
f_mmeea = MeshesExtractEdgesWithToleranceAngle(Mesh=[mesh, move.Geometry], Angle=45)  # -> InternalEdges, NakedEdges
previewlw = CustomPreviewLineweights(Geometry=f_mmeea.InternalEdges, Shader=ColourSwatch(SwatchColor=RGB(255, 255, 255)), Thickness="3", Absolute=False)
# Assembler
# 
# Framework for Iterative Assemblages workflow
# 
# code by Alessio Erioli
# 
# v 1.0
# © Co-de-iT 2020 / Creative Commons Attribution-Non Commercial-ShareAlike 4.0 International License
edges = BrepEdges(Brep=box)  # -> Naked, Interior, NonManifold
afieldn = ConstructFieldN(Box=box, NCells=Slider(13, range=10..30))  # -> Field, FieldPoints
edges_2 = BrepEdges(Brep=box_2)  # -> Naked, Interior, NonManifold
afieldxyz = ConstructFieldXYZ(Box=box_2, NCellsX=Slider(10, range=10..30), NCellsY=Slider(13, range=10..30), NCellsZ=Slider(13, range=10..30))  # -> Field, FieldPoints

# ---- group: Construct Field Mesh XYZ
afieldmxyz = ConstructFieldFromMeshXYZ(
    Mesh=move.Geometry,
    Plane=prot_2,
    NCellsX=Slider(10, range=10..30),
    NCellsY=Slider(10, range=10..30),
    NCellsZ=Slider(10, range=10..30))  # -> Field, FieldPoints

# ---- group: Construct Field Mesh N
afieldmn = ConstructFieldFormMeshN(Mesh=mesh, Plane=prot_2, NCells=Slider(10, range=10..30))  # -> Field, FieldPoints

# ----
panel = Panel(afieldxyz.Field)
panel_2 = Panel(afieldn.Field)
previewlw_2 = CustomPreviewLineweights(Geometry=edges.Interior, Shader=ColourSwatch(SwatchColor=RGB(0, 0, 0)), Absolute=False)
previewlw_3 = CustomPreviewLineweights(Geometry=edges_2.Interior, Shader=ColourSwatch(SwatchColor=RGB(255, 255, 255)), Absolute=False)
