# Grasshopper definition 03-01_Fields - populate.gh (Grasshopper 1.0.7)
# Copyright: Co-de-iT
# plug-ins: Human, Assembler, froGH

box = CenterBox(Base="0,0,0", X=Slider(94, range=1..200), Y=Slider(120, range=1..200), Z=Slider(85, range=1..200))

edges = BrepEdges(Brep=box)  # -> Naked, Interior, NonManifold
previewlw = CustomPreviewLineweights(Geometry=edges.Interior, Shader=ColourSwatch(SwatchColor=RGB(0, 0, 0)), Absolute=False)

# ---- group: empty field
afieldn = ConstructFieldN(Box=box, NCells=Slider(15, range=10..30))  # -> Field, FieldPoints

# ----
panel = Panel(afieldn.Field)

# ---- group: multiple attractor points
pt = Point(Point(-48.84849901, -75.02945501, -5.148424688))
pt_2 = Point(Point(-42.49842075, 73.73951069, -41.80343786))
pt_3 = Point(Point(68.60664749, -31.08153187, 43.23515265))
merge = Merge(Data1=pt, Data2=pt_3, Data3=pt_2)

# ---- group: polyline
crv = Curve(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)

# ---- group: smooth curve
crv_2 = Curve(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)

# ---- group: multiple curves
crv_3 = Curve([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])

# ---- group: multiple attractor points
pt_4 = Point(Point(-48.84849901, -75.02945501, -5.148424688))
pt_5 = Point(Point(-42.49842075, 73.73951069, -41.80343786))
pt_6 = Point(Point(68.60664749, -31.08153187, 43.23515265))
merge_2 = Merge(Data1=pt_4, Data2=pt_6, Data3=pt_5)

# ---- group: calculate vector
xprod = CrossProduct(VectorA=graft(afieldn.FieldPoints), VectorB=merge, Unitize=True)  # -> Vector, Length
avr = Average(Input=xprod.Vector)  # -> flatten(ArithmeticMean)
unit = UnitVector(Vector=avr)

# ---- group: calculate scalar
dist = Distance(PointA=graft(afieldn.FieldPoints), PointB=merge)
log = Logarithm(Value=dist)
avr_2 = Average(Input=log)  # -> flatten(ArithmeticMean)

# ---- group: attractor curves
crv_4 = Curve(crv_3)
previewlw_2 = CustomPreviewLineweights(Geometry=crv_4, Shader=ColourSwatch(SwatchColor=RGB(32, 20, 140)), Thickness="5", Absolute=False)

# ---- group: attractor curve
crv_5 = Curve(crv_2)
previewlw_3 = CustomPreviewLineweights(Geometry=crv_5, Shader=ColourSwatch(SwatchColor=RGB(255, 0, 0)), Thickness="5", Absolute=False)

# ---- group: single attractor point
pt_7 = Point(Point(-4.544887498, 33.05572667, -2.639582865))

# ---- group: 1 vector for each attractor point
X = UnitX(Factor=1)
Y = UnitY(Factor=1)
Z = UnitZ(Factor=1)
merge_3 = Merge(Data1=X, Data2=Y, Data3=Z)

# ---- group: geometry
geo = Geometry(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)
geo_2 = Geometry(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)
geo_3 = Geometry(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)

# ---- group: calculate scalar
crv_cp = CurveClosestPoint(Point=graft(afieldn.FieldPoints), Curve=crv_4)  # -> Point, Parameter, Distance

# ---- group: modulate values
num = Number(avr_2)
bnd = Bounds(Numbers=num)
remap = RemapNumbers(Value=num, Source=bnd, Target=Domain(0, 1))  # -> Mapped, Clipped
graph = GraphMapper(
    remap.Mapped,
    x0=0,
    x1=1,
    y0=0,
    y1=1,
    container_name="Bezier",
    cpx=[0, 0.5385872126, 0.5452620983, 1],
    cpy=[0, 0.1508975029, 0.5873855352, 1])

# ---- group: calculate scalar
crv_cp_2 = CurveClosestPoint(Point=afieldn.FieldPoints, Curve=crv_5)  # -> Point, Parameter, Distance

# ---- group: calculate vector
eval = EvaluateCurve(Curve=crv_5, Parameter=crv_cp_2.Parameter)  # -> Point, Tangent, Angle

# ----
# multiple points
afpop = PopulateField(Field=afieldn.Field, ScalarValues=graph, VectorValues=unit)

# ----
# curve
afpop_2 = PopulateField(Field=afieldn.Field, ScalarValues=crv_cp_2.Distance, VectorValues=eval.Tangent)

list = ValueList({"space partition - coords": 0, "space partition - points": 1, "single point": 2, "multiple points": 3, "curve": 4, "multiple curves": 5, "surfaces/meshes": 6}, selected="multiple curves")
multiple_curves = ColourSwatch(SwatchColor=RGB(118, 106, 222))
surfaces_meshes = ColourSwatch(SwatchColor=RGB(22, 148, 186))

# ---- group: data color
partition = ColourSwatch(SwatchColor=RGB(255, 255, 255))
single_point = ColourSwatch(SwatchColor=RGB(170, 255, 0))
multiple_points = ColourSwatch(SwatchColor=RGB(255, 212, 0))
curve = ColourSwatch(SwatchColor=RGB(255, 0, 0))
filter = StreamFilter(
    Gate=list,
    Stream0=partition,
    Stream1=partition,
    Stream2=single_point,
    Stream3=multiple_points,
    Stream4=curve,
    Stream5=multiple_curves,
    Stream6=surfaces_meshes)

# ----
# Assembler
# 
# Framework for Iterative Assemblages workflow
# 
# code by Alessio Erioli
# 
# v 1.0
# © Co-de-iT 2020 / Creative Commons Attribution-Non Commercial-ShareAlike 4.0 International License
# space partition - by coordinate
z_threshold = Slider(-29.229, range=-1000..1000)
pdecon = Deconstruct(Point=afieldn.FieldPoints)  # -> XComponent, YComponent, ZComponent

# ---- group: allocate vectors
larger = LargerThan(FirstNumber=pdecon.ZComponent, SecondNumber=z_threshold)  # -> LargerThan, OrEqualTo
X_2 = UnitX(Factor=1)
Z_2 = UnitZ(Factor=1)
merge_4 = Merge(Data1=X_2, Data2=Z_2)
item = ListItem(List=merge_4, Index=larger.LargerThan, Wrap=True)
unit_2 = UnitVector(Vector=item)

# ---- group: allocate scalars
scalar_values_to_allocate = Panel("""0
1""")
item_2 = ListItem(List=scalar_values_to_allocate, Index=larger.LargerThan, Wrap=True)

# ----
afpop_3 = PopulateField(Field=afieldn.Field, ScalarValues=item_2, VectorValues=unit_2)

# ----
# space partition - by points
# get the scalar and vector value corresponding to the closest attractor point
# scalar and vector values number must equal the number of points:
# 
# . 3 points> 3 scalars, 3 vectors
# . 4 points > 4 scalars, 4 vectors
# 
# etc.
scalar_values_to_allocate_2 = Panel("""0
1
2""")
dist_2 = Distance(PointA=graft(afieldn.FieldPoints), PointB=merge_2)

sort = SortList(Keys=dist_2, ValuesA=scalar_values_to_allocate_2, ValuesB=merge_3)  # -> Keys, ValuesA, ValuesB
item_3 = ListItem(List=sort.ValuesB, Index=0, Wrap=True)  # -> flatten(Item)

item_4 = ListItem(List=sort.ValuesA, Index=0, Wrap=True)  # -> flatten(Item)
afpop_4 = PopulateField(Field=afieldn.Field, ScalarValues=item_4, VectorValues=item_3)

# ----
# multiple curves
f_ifroml = IndexesFromList(Data=crv_4)
sort_2 = SortList(Keys=crv_cp.Distance, ValuesA=f_ifroml, ValuesB=crv_cp.Parameter)  # -> Keys, ValuesA, ValuesB
item_5 = ListItem(List=sort_2.Keys, Index=0, Wrap=True)  # -> flatten(Item)
item_6 = ListItem(List=sort_2.ValuesB, Index=0, Wrap=True)
item_7 = ListItem(List=sort_2.ValuesA, Index=0, Wrap=True)
item_8 = ListItem(List=crv_4, Index=item_7, Wrap=True)

# ---- group: calculate vector
eval_2 = EvaluateCurve(Curve=item_8, Parameter=item_6)  # -> Point, flatten(Tangent), Angle

# ----
afpop_5 = PopulateField(Field=afieldn.Field, ScalarValues=item_5, VectorValues=eval_2.Tangent)

# ---- group: calculate vectors
Z_3 = UnitZ(Factor=1)

# ----
# surfaces, polysurfaces, meshes
geo_4 = Geometry(geo)

preview = CustomPreview(Geometry=geo_4, Material=ColourSwatch(SwatchColor=RGBA(255, 255, 255, 75)))

# ---- group: signed/unsigned distance field
cluster = Cluster(field_points=afieldn.FieldPoints, geometry=geo_4)  # -> unsigned_values, signed_values, tangent_vectors

# ----
afpop_6 = PopulateField(Field=afieldn.Field, ScalarValues=cluster.unsigned_values, VectorValues=cluster.tangent_vectors)

# ----
# single point
vec2pt = Vector2Pt(PointA=afieldn.FieldPoints, PointB=pt_7, Unitize=False)  # -> Vector, Length

# ---- group: calculate vectors (continued)
xprod_2 = CrossProduct(VectorA=vec2pt.Vector, VectorB=Z_3, Unitize=True)  # -> Vector, Length
unit_3 = UnitVector(Vector=xprod_2.Vector)

# ----
afpop_7 = PopulateField(Field=afieldn.Field, ScalarValues=vec2pt.Length, VectorValues=unit_3)

# ---- group: Field
filter_2 = StreamFilter(
    Gate=list,
    Stream0=afpop_3,
    Stream1=afpop_4,
    Stream2=afpop_7,
    Stream3=afpop,
    Stream4=afpop_2,
    Stream5=afpop_5,
    Stream6=afpop_6)

# ---- group: display Field
blend = BooleanToggle(False)
merge_5 = Merge(Data1=filter, Data2=ColourSwatch(SwatchColor=RGB(0, 0, 0)))
afcols = ColorFieldByScalar(Field=filter_2, Colors=merge_5, Index=0, Threshold=Slider(0.26, range=0..1), Blend=blend)  # -> Field, Colors

# ---- group: Field for Assemblage
data = Data(afcols.Field)

# ----
afdecon = DeconstructField(Field=data)  # -> Points, ScalarValues, Vectors, IWeights, Colors

# ---- group: display field
vector_scale = Slider(5.568, range=1..10)
vec = Vector(flatten(afdecon.Vectors))
multiplication = Multiplication(A=vec, B=vector_scale)
unit_4 = UnitVector(Vector=multiplication)
preview_2 = CustomPreview(Geometry=afdecon.Points, Material=afcols.Colors)
vdisex = VectorDisplayEx(Point=afdecon.Points, Vector=multiplication, Colour=unit_4, Width=2)

# ----
scalar_values = Panel(afdecon.ScalarValues)
vector_values = Panel(afdecon.Vectors)
points = Panel(afdecon.Points)
color_values = Panel(afdecon.Colors)

# ==== cluster Cluster
geometry = ClusterInput()  # Surfaces, polysurfaces or meshes
field_points = ClusterInput()
pull = PullPoint(Point=field_points, Geometry=geometry, ClosestOnly=True)  # -> ClosestPoint, Distance
mesh = Mesh(geometry)
meshcp = MeshClosestPoint(Point=pull.ClosestPoint, Mesh=mesh)  # -> Point, Index, Parameter
num = Number(pull.Distance)
meval = MeshEval(Mesh=mesh, Parameter=meshcp.Parameter)  # -> Point, Normal, Colour
bnd = Bounds(Numbers=num)
remap = RemapNumbers(Value=num, Source=bnd, Target=Domain(0, 1))  # -> Mapped, Clipped
vec2pt = Vector2Pt(PointA=field_points, PointB=meval.Point, Unitize=False)  # -> Vector, Length
xprod = CrossProduct(VectorA=vec2pt.Vector, VectorB=meval.Normal, Unitize=False)  # -> Vector, Length
angle = Angle(VectorA=vec2pt.Vector, VectorB=meval.Normal)  # -> Angle, Reflex
larger = LargerThan(FirstNumber=angle.Angle, SecondNumber="Pi*0.5")  # -> LargerThan, OrEqualTo
int = Integer(larger.LargerThan)
expression = Expression(y=remap.Mapped, x=int, Expression="y*2*(x-0.5)")
unit = UnitVector(Vector=xprod.Vector)
unsigned_values = ClusterOutput(remap.Mapped)
tangent_vectors = ClusterOutput(unit)
signed_values = ClusterOutput(expression)
