# Grasshopper definition 04-00_Assemblage 2 Objects Environment-Field.gh (Grasshopper 1.0.7)
# Copyright: Co-de-iT
# plug-ins: MeshEdit Components, Human, EleFront, Assembler, froGH

# ---- group: obstacle
pt = Point(Point(-122.3339923, 282.1586602, 0))
box = CenterBox(Base=pt, X=Slider(24, range=1..200), Y=Slider(9, range=1..200), Z=Slider(26, range=1..200))
mbox = MeshBox(Base=box, XCount="1", YCount="1", ZCount="1")

pt_2 = Point(Point(-158.4726811, 157.9892994, 0))
box_2 = CenterBox(Base=pt_2, X=Slider(11, range=1..200), Y=Slider(22.5, range=1..200), Z=Slider(26, range=1..200))
mbox_2 = MeshBox(Base=box_2, XCount="1", YCount="1", ZCount="1")

# ---- group: container
pt_3 = Point(Point(-140.2744565, 231.4122939, 0))
box_3 = CenterBox(Base=pt_3, X=Slider(100, range=1..200), Y=Slider(140, range=1..200), Z=Slider(85, range=1..200))
mbox_3 = MeshBox(Base=box_3, XCount="1", YCount="1", ZCount="1")

# ---- group: type 1
crv = Curve([<curve referenced from the Rhino model> x4])

# ---- group: type 2
# environment
crv_2 = Curve([<curve referenced from the Rhino model> x2])

# ---- group: type 1
# 0 - construct
# AssemblyObjects
crv_3 = Curve([<curve referenced from the Rhino model> x3])

# ---- group: type 2
crv_4 = Curve([<curve referenced from the Rhino model> x2])

# ---- group: container for Field
pt_4 = Point(Point(-140.2744565, 231.4122939, 0))
box_4 = CenterBox(Base=pt_4, X=Slider(100, range=1..200), Y=Slider(140, range=1..200), Z=Slider(85, range=1..200))

# ----
merge = Merge(Data1=flatten(crv), Data2=flatten(crv_2))
merge_2 = Merge(Data1=flatten(crv_3), Data3=flatten(crv_4))

rotations = Panel("""0
180""")
lng = ListLength(List=merge)
type = Panel("""1
1
1
1
2
2""")
repeat = RepeatData(Data=graft(rotations), Length=lng)
weight = Panel("0")
flip = FlipMatrix(Data=repeat)  # -> simplify(Data)
repeat_2 = RepeatData(Data=weight, Length=lng)

# ----
# ASSEMBLAGES IN BRIEF: GENERAL STEPS
# 
# . choose WHERE to add
# 
# . choose WHAT to add
# 
# 
# PROCESS STEPS
# 
# 
# 
# . select receiver object in the assemblage
# 
# . list all possible combinations of free handles and related compatible candidates
# 
# . choose a winnig candidate according to given criteria
# DEFINITION ANATOMY: 00 - constuct
# 
# Construct the object and relationships necessary for the Assemblage
# 
# 
# 
# 01 - simulate
# 
# Simulate the Assemblage growth
# 
# 
# 
# 02 - analyze/post-process
# 
# Analyze results and post-process the obtained assemblage
rotations_2 = Panel("""0
180""")
lng_2 = ListLength(List=merge_2)
type_2 = Panel("""1
1
1
2
2""")
repeat_3 = RepeatData(Data=graft(rotations_2), Length=lng_2)
weight_2 = Panel("0")
flip_2 = FlipMatrix(Data=repeat_3)  # -> simplify(Data)
repeat_4 = RepeatData(Data=weight_2, Length=lng_2)

# ---- group: single container
mesh = Mesh(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)

# ---- group: container
# flip normals: A container must have normals pointing inward
flip_3 = MeshFlip(Mesh=mbox_3)

# ---- group: polyline
crv_5 = Curve(<curve referenced from the Rhino model>)

# ---- group: smooth curve
crv_6 = Curve(<curve referenced from the Rhino model>)

# ---- group: single container
# flip normals: A container must have normals pointing inward
flip_4 = MeshFlip(Mesh=mesh)

# ---- group: Create Handles
handle = ConstructHandle(Polyline=merge, RotationAngles=flip, Type=type, Weight=repeat_2)

handle_2 = ConstructHandle(Polyline=merge_2, RotationAngles=flip_2, Type=type_2, Weight=repeat_4)

# ---- group: set box as environment container
smesh = SimpleMesh(Brep=box_4)
flip_5 = MeshFlip(Mesh=smesh)

# ----
model_abs_size = BooleanToggle(True)
model_abs_size_2 = BooleanToggle(True)

# ---- group: attractor curve
crv_7 = Curve(crv_6)
previewlw = CustomPreviewLineweights(Geometry=crv_7, Shader=ColourSwatch(SwatchColor=RGB(255, 0, 0)), Thickness="5", Absolute=False)

# ----
merge_3 = Merge(Data1=flip_3, Data2=mbox_2, Data3=mbox)  # -> flatten(Result)

environment = ValueList({"single mesh container": 0, "container + obstacles": 1, "field container": 2, "field + obstacles": 3}, selected="container + obstacles")
merge_4 = Merge(Data1=flip_5, Data2=mbox_2, Data3=mbox)  # -> flatten(Result)
filter = StreamFilter(Gate=environment, Stream0=flip_4, Stream1=merge_3, Stream2=flip_5, Stream3=merge_4)

mesh_2 = Mesh(<mesh referenced from the Rhino model>)
volume = Volume(Geometry=mesh_2)  # -> Volume, Centroid
name = Panel("blockB")
xy = XYPlane(Origin=volume.Centroid)
X = UnitX(Factor=1)

# ----
# Assembler
# 
# Framework for Iterative Assemblages workflow
# 
# code by Alessio Erioli
# 
# v 1.0
# © Co-de-iT 2020 / Creative Commons Attribution-Non Commercial-ShareAlike 4.0 International License
mesh_3 = Mesh(<mesh referenced from the Rhino model>)
volume_2 = Volume(Geometry=mesh_3)  # -> Volume, Centroid
name_2 = Panel("blockA")
xy_2 = XYPlane(Origin=volume_2.Centroid)
X_2 = UnitX(Factor=1)

# ---- group: Display Handles
handdisp = DisplayHandle(Handles=handle, DisplaySize=Slider(0.1, range=0..0.5), ModelScreenSize=model_abs_size)

handdisp_2 = DisplayHandle(Handles=handle_2, DisplaySize=Slider(0.1, range=0..0.5), ModelScreenSize=model_abs_size_2)

# ----
crv_8 = Curve([<curve referenced from the Rhino model> x13])
pt_5 = Point([<point referenced from the Rhino model> x7])
brep = Brep(<brep referenced from the Rhino model>)
brep_2 = Brep()
xdcon = ConstructXData(Label="blockA body", Data=crv_8, ReferencePlane=xy_2, AssemblyObjectNameReference=name_2)

crv_9 = Curve([<curve referenced from the Rhino model> x11])
pt_6 = Point([<point referenced from the Rhino model> x7])
brep_3 = Brep()
brep_4 = Brep([<brep referenced from the Rhino model> x21])
xdcon_2 = ConstructXData(Label="blockB body", Data=crv_9, ReferencePlane=xy, AssemblyObjectNameReference=name)

# ---- group: Create AssemblyObject
aocon = ConstructAssemblyObject(Name=name_2, CollisionMesh=mesh_3, ReferencePlane=xy_2, Direction=X_2, Weight="1.0", Handles=handle_2)

aocon_2 = ConstructAssemblyObject(Name=name, CollisionMesh=mesh_2, ReferencePlane=xy, Direction=X, Weight="1.0", Handles=handle)

# ---- group: display Environment Geometries
obstacles = ColourSwatch(SwatchColor=RGB(115, 124, 148))
containers = ColourSwatch(SwatchColor=RGB(0, 0, 0))
merge_5 = Merge(Data1=obstacles, Data2=containers)
mesh_4 = Mesh(filter)
cluster = Cluster(environment_meshes=mesh_4, colours=merge_5, normal_size=Slider(10, range=1..20))

# ---- group: XData
merge_6 = Merge(Data1=flatten(xdcon), Data2=flatten(xdcon_2))
data = Data(merge_6)

# ---- group: AssemblyObjects
merge_7 = Merge(Data1=flatten(aocon), Data2=flatten(aocon_2))
data_2 = Data(merge_7)

# ----
self_object = BooleanToggle(True)
self_handle = BooleanToggle(True)
cross_type = BooleanToggle(False)
heuw = HeuristicsWriter(
    AssemblyObjectsSet=data_2,
    AllowSelfObjectConnections=self_object,
    AllowSelfHandleConnections=self_handle,
    AllowCrossTypeConnections=cross_type)

display = ValueList({"by Type": 0, "by s/r status": 1}, selected="by Type")
go = BooleanToggle(False)
step = Button()
max_objects = Panel("1000")
resetex = Button()
reset = Button()
cell_size = Slider(1.2, range=1..2)
show_edges = BooleanToggle(True)

# ---- group: base point
pt_7 = Point(Point(0, 20, 0))

# ----
jitter_rules = ValueList({"no": 0, "yes": 1}, selected="no")
pt_8 = Point(Point(-140.8710125, 214.0670038, 0))
jitter = Jitter(List=heuw, Jitter=Slider(1, range=0..1), Seed=Slider(0, range=0..100))  # -> Values, Indices
# 1 - simulate
xy_3 = XYPlane(Origin=pt_8)
filter_2 = StreamFilter(Gate=jitter_rules, Stream0=heuw, Stream1=jitter.Values)

# ---- group: filter heuristics
heudex = HeuristicsDisplayEx(OriginPoint=Point(0, 0, 0), AssemblyObjectsSet=data_2, HeuristicsString=filter_2, XSize=1, YSize=1, NRows=10)  # -> AssemblyObjectPairs, CoherencePattern, HeuristicsStringTree, TextBasePoints, XData
cull = CullPattern(List=flatten(heudex.HeuristicsStringTree), CullPattern=flatten(heudex.CoherencePattern))

# ----
selrec = ValueList({"random": 0, "scalar field": 1, "scalar field acc": 2, "dense packing (SLOW)": 3}, selected="scalar field acc")
heuristics_mode = ValueList({"manual": 0, "field driven": 1}, selected="manual")
selrule = ValueList({"random": 0, "scalar field": 1, "scalar field acc": 2, "vector field": 3, "vector field acc": 4, "min locl bb vol": 5, "min loc bb diag": 6}, selected="vector field acc")
heuset = HeuristicsSettings(
    HeuristicsString=cull,
    CurrentHeuristics=Slider(0, range=0..3),
    HeuristicsMode=heuristics_mode,
    ReceiverSelectionMode=selrec,
    RuleSelectionMode=selrule)

# ---- group: Heuristics Display
heud = HeuristicDisplay(
    OriginPoint=pt_7,
    AssemblyObjectsSet=data_2,
    HeuristicsString=filter_2,
    XSize=cell_size,
    YSize=cell_size,
    NRows=Slider(10, range=10..50),
    ShowEdges=show_edges,
    DisplayMode=display)

# ----
or = GateOr(A=go, B=step)
# 2 - analyze/post-process
display_2 = ValueList({"objects": 0, "occupancy": 1, "type": 2, "sequence": 3, "Z height": 4, "none": 5}, selected="occupancy")
panel = Panel("""AliceBlue
SlateGray
GoldenRod
YellowGreen
DarkKhaki""")
panel_2 = Panel("recombine horizontal/vertical")
bake = BooleanToggle(False)

# ----
# field
afieldn = ConstructFieldN(Box=box_4, NCells=Slider(15, range=10..30))  # -> Field, FieldPoints
list = ValueList({"by curve tangent": 0, "by threshold": 1}, selected="by threshold")

# ---- group: calculate vector by coordinate threshold
pdecon = Deconstruct(Point=afieldn.FieldPoints)  # -> XComponent, YComponent, ZComponent
bnd = Bounds(Numbers=pdecon.YComponent)
remap = RemapNumbers(Value=Slider(0.457, range=0..1), Source=Domain(0, 1), Target=bnd)  # -> Mapped, Clipped
smaller = SmallerThan(FirstNumber=pdecon.YComponent, SecondNumber=remap.Mapped)  # -> SmallerThan, OrEqualTo
Y = UnitY(Factor=1)
Z = UnitZ(Factor=1)
weave = Weave(Pattern=graft(smaller.SmallerThan), Stream0=Y, Stream1=Z, NullGaps=False)  # -> flatten(Weave)

# ---- group: calculate scalar
crv_cp = CurveClosestPoint(Point=afieldn.FieldPoints, Curve=crv_7)  # -> Point, Parameter, Distance

# ---- group: calculate vector from curve tangent
eval = EvaluateCurve(Curve=crv_7, Parameter=crv_cp.Parameter)  # -> Point, Tangent, Angle

# ----
filter_3 = StreamFilter(Gate=list, Stream0=eval.Tangent, Stream1=weave)
afpop = PopulateField(Field=afieldn.Field, ScalarValues=crv_cp.Distance, VectorValues=filter_3)

# ---- group: display Field
blend = BooleanToggle(False)
merge_8 = Merge(Data1=ColourSwatch(SwatchColor=RGB(255, 0, 0)), Data2=ColourSwatch(SwatchColor=RGB(0, 0, 0)))
multiplication = Multiplication(A=filter_3, B=Slider(6.539, range=1..10))
afcols = ColorFieldByScalar(Field=afpop, Colors=merge_8, Index=0, Threshold=Slider(0.2, range=0..1), Blend=blend)  # -> Field, Colors
unit = UnitVector(Vector=multiplication)
vdisex = VectorDisplayEx(Point=afieldn.FieldPoints, Vector=multiplication, Colour=unit, Width=2)
preview = CustomPreview(Geometry=afieldn.FieldPoints, Material=afcols.Colors)

# ---- group: Field for Assemblage
data_3 = Data(afcols.Field)

# ----
environment_mode = ValueList({"none": 0, "collision": 1, "centroid": 2}, selected="collision")
box_5 = Box()
exoset = ExogeousSettings(
    EnvironmentMeshes=filter,
    EnvironmentMode=environment_mode,
    Field=data_3,
    FieldScalarThreshold=Slider(0.1, range=0..1),
    Sandbox={Plane=PlaneXY(0, 0, 0), X=Domain(-1, 1), Y=Domain(0, 0), Z=Domain(0, 0)})

# ---- group: Assemblage Engine Xtended
aoengx = AssemblerEngineX(
    AssemblyObjectsSet=data_2,
    StartingPlane=xy_3,
    StartingObjectType="1",
    HeuristicsSettings=heuset,
    ExogenousSettings=exoset,
    Go=go,
    Step=step,
    NIterations=Slider(100, range=10..100),
    MaxNObjects=max_objects,
    ResetExogenous=resetex,
    Reset=reset,
    FastCollisionCheck=False)  # -> Assemblage, AssemblageCount

# ----
n_of_objects = Panel(aoengx.AssemblageCount)

# ---- group: auto-stop
larger = LargerThan(FirstNumber=aoengx.AssemblageCount, SecondNumber=max_objects)  # -> LargerThan, OrEqualTo
f_tas = ToggleAutostop(Toggle=go, Condition=larger.OrEqualTo)

# ---- group: data dam
# delays updated data transmission by a certain amount of time or only when clicked
dam = DataDam(DataA=aoengx.Assemblage, BufferDelay=10000000, BufferMode=0)

# ----
cluster_2 = Cluster_2(vizmode=display_2, assemblage=aoengx.Assemblage, type_colors=panel, stop_and_go_bool=or)  # -> meshes, edges
aoadecon = DeconstructAssemblage(Assemblage=dam)  # -> AssemblageObjects, AssemblageRules, ReceiverObjectsIndexes, AvailableObjectIndexes, UnreachableObjectIndexes; disabled

# ---- group: objects statistics
aoadecon_2 = DeconstructAssemblage(Assemblage=dam)  # -> AssemblageObjects, AssemblageRules, ReceiverObjectsIndexes, AvailableObjectIndexes, UnreachableObjectIndexes
aoset = ExtractAOSet(Assemblage=dam)
aotype = ExtractType(AssemblyObject=aoadecon_2.AssemblageObjects)
f_ifroml = IndexesFromList(Data=aoset)
mindex = MemberIndex(Set=aotype, Member=f_ifroml)  # -> Index, Count
expression = Expression(x=f_ifroml, y=mindex.Count, Expression="Format(\"type {0}: {1}\", x, y)")
pt_9 = Point(Point(-218.075651, 73.00729024, 0))
join = TextJoin(Text=expression)
xy_4 = XYPlane(Origin=pt_9)
tag = TextTag3D(Location=xy_4, Text=join, Size="5", Colour=ColourSwatch(SwatchColor=RGB(0, 0, 0)), Justification=7)

# ---- group: display components
mjoin = MeshJoin(Meshes=cluster_2.meshes)
preview_2 = CustomPreview(Geometry=mjoin, Material=ColourSwatch(SwatchColor=RGB(255, 255, 255)))

# ---- group: display components / display edges
previewlw_2 = CustomPreviewLineweights(Geometry=cluster_2.edges, Shader=ColourSwatch(SwatchColor=RGB(0, 0, 0)), Thickness=Slider(1, range=1..3), Absolute=False)

# ----
aotype_2 = ExtractType(AssemblyObject=aoadecon.AssemblageObjects)
# sift by type: filters by a pattern of integers. In case of more than 2 types, add other channels to the output.
sift = SiftPattern(List=aoadecon.AssemblageObjects, SiftPattern=aotype_2)  # -> Output0, Output1
aoplane = ExtractReferencePlane(AssemblyObject=sift.Output0)
aoplane_2 = ExtractReferencePlane(AssemblyObject=sift.Output1)

# ---- group: separate horizontal/vertical
# recognizing horizontal and vertical: The dot product of 2 unit vectors is equal to the cosine of the comprised angle.
# 
# Two perpendicular vectors have a dot product of 0 (angle is 90), while for two parallel vectors the dot product can be 1 or -1 (if their arrows are concord or discord respectively, which means an angle of 0 or 180). Using the absolute value function, the value becomes 1 regardless of the sign.
# 
# In this case we test the angle of each AssemblyObject's  reference plane X vector with the global Z vector. If they are parallel (absolute dot product = 1) then the object is oriented vertically, if they are perpendicular (absolute dot product = 0) the object is horizontal.
Z_2 = UnitZ(Factor=1)
deplane = DeconstructPlane(Plane=aoplane)  # -> Origin, XAxis, YAxis, ZAxis
dprod = DotProduct(VectorA=deplane.XAxis, VectorB=Z_2, Unitize=False)
abs = Absolute(Value=dprod)
dispatch = Dispatch(List=aoplane, DispatchPattern=abs)  # -> ListA, ListB

# ---- group: associate blocks / vertical elements
pln = Plane(dispatch.ListA)

# ---- group: associate blocks / horizontal elements
pln_2 = Plane(dispatch.ListB)

# ---- group: associate blocks
# blockA / type 0
# blockB / type 1
pln_3 = Plane(aoplane_2)
inblock = InsertBlock(BlockName="blockA_v1", SourcePlane=pln_2)
inblock_2 = InsertBlock(BlockName="blockB", SourcePlane=pln_3)
inblock_3 = InsertBlock(BlockName="blockA_v2", SourcePlane=pln)

# ----
weave_2 = Weave(Pattern=abs, Stream0=inblock, Stream1=inblock_3, NullGaps=False)
# recombine types: In case of more than 2 types, add other channels to the input accordingly.
combine = CombineData(Input0=weave_2, Input1=inblock_2)  # -> Result, Index
data_4 = Data(combine.Result)
bake_2 = BakeObjects(Geometry=data_4, Bake=bake)
preview_3 = CustomPreview(
    Geometry=data_4,
    Material={diffuse=RGB(221, 160, 221), emission=RGB(66, 48, 66), shine=0.5, specular=RGB(255, 255, 255), transparency=0})

# ==== cluster Cluster
environment_meshes = ClusterInput()
colours = ClusterInput()  # First Colour for obstacles, second for containers
normal_size = ClusterInput()
volume = MeshVolume(Mesh=environment_meshes)  # -> Volume, Centroid
smaller = SmallerThan(FirstNumber=volume.Volume, SecondNumber=0)  # -> SmallerThan, OrEqualTo
panel = Panel("""3
1""")
item = ListItem(List=colours, Index=graft(smaller.SmallerThan), Wrap=True)
item_2 = ListItem(List=panel, Index=graft(smaller.SmallerThan), Wrap=True)
medges = MeshEdges(Mesh=environment_meshes)  # -> NakedEdges, InteriorEdges, NonManifoldEdges
facen = FaceNormals(Mesh=environment_meshes)  # -> Centers, Normals
multiplication = Multiplication(A=facen.Normals, B=normal_size)
previewlw = CustomPreviewLineweights(Geometry=medges.InteriorEdges, Shader=graft(item), Thickness=graft(item_2), Absolute=False)
vdisex = VectorDisplayEx(Point=facen.Centers, Vector=multiplication, Colour=graft(item), Width=2)

# ==== cluster Cluster_2
vizmode = ClusterInput()
assemblage = ClusterInput()
type_colors = ClusterInput()
stop_and_go_bool = ClusterInput()
aoadecon = DeconstructAssemblage(Assemblage=assemblage)  # -> AssemblageObjects, AssemblageRules, ReceiverObjectsIndexes, AvailableObjectIndexes, UnreachableObjectIndexes
filter = StreamFilter(Gate=stop_and_go_bool, Stream0=assemblage)
gate = StreamGate(Stream=aoadecon.AssemblageObjects, Gate=stop_and_go_bool)  # -> Target0, Target1
aoset = ExtractAOSet(Assemblage=filter)
gate_2 = StreamGate(Stream=gate.Target0, Gate=vizmode)  # -> Target0, Target1, Target2, Target3, Target4, Target5
aocmesh = ExtractCollisionMesh(AssemblyObject=aoset)
f_mseea = MeshExtractEdgesWithToleranceAngle(Mesh=aocmesh, Angle="45")  # -> InternalEdges, NakedEdges

# ---- group: extract object type
aotype = ExtractType(AssemblyObject=gate.Target0)

# ----
aocmesh_2 = ExtractCollisionMesh(AssemblyObject=gate_2.Target3)
aocmesh_3 = ExtractCollisionMesh(AssemblyObject=gate_2.Target2)
aocmesh_4 = ExtractCollisionMesh(AssemblyObject=gate_2.Target1)
aocmesh_5 = ExtractCollisionMesh(AssemblyObject=gate_2.Target4)
group = Group(Objects=f_mseea.InternalEdges)  # -> flatten(Group)
lng = ListLength(List=aocmesh_4)
aoplane = ExtractReferencePlane(AssemblyObject=aoset)
aoplane_2 = ExtractReferencePlane(AssemblyObject=gate_2.Target4)
repeat = RepeatData(Data="0", Length=lng)

# ---- group: display by assemblage sequence
lng_2 = ListLength(List=aocmesh_2)  # -> expr("x-1", Length)
f_ifroml = IndexesFromList(D=aocmesh_2)  # -> i; inputs D: list
# ---------- f_ifroml: C# usings ----------
using System.Linq;
# ---------- f_ifroml: C# ----------
   
 /*
    froGH - a sparse collection of (in)utilities for Grasshopper

    Indexes from Number
    code by Alessio Erioli

    froGH by Co-de-iT is licensed under a Creative Commons Attribution 4.0 International License.
    http://creativecommons.org/licenses/by/4.0/

    */
    initComp();
   
    GH_Integer[] indexes = new GH_Integer[D.Count];

    for(int j = 0; j < D.Count; j++)
      indexes[j] = new GH_Integer(j);

    //A = indexes.Sum(j => j.Value); // uses System.Linq Sum selector function - for each GH_Integer j in indexes add its value to the total sum

    i = indexes;
# ---------- f_ifroml: C# additional code ----------
  void initComp(){
    Component.Name = "Indexes from List";
    Component.NickName = "f_iFromL";
    Component.Description = "Generates a list of 0-based integer indexes from a given list of data";
    Component.Params.Input[0].Name = "Data";
    Component.Params.Input[0].Description = "the list to index";
    Component.Params.Output[0].Name = "Indexes";
    Component.Params.Output[0].Description = "the generated indexes";
  }
# ---------- end f_ifroml ----------
one_over_x = OneOverX(Value=lng_2)
multiplication = Multiplication(A=f_ifroml, B=one_over_x)
sqr = Square(Value=multiplication)
gradient = Gradient(
    LowerLimit=0,
    UpperLimit=1,
    Parameter=sqr,
    stops=[0: RGB(0, 0, 0), 0.498: RGB(56, 136, 150), 0.904: RGB(186, 224, 224), 1: RGB(255, 255, 255)])
mcol = MeshColours(Mesh=graft(aocmesh_2), Colours=graft(gradient))  # -> flatten(Mesh)

# ----
filter_2 = StreamFilter(Gate=stop_and_go_bool, Stream0=aotype)
pdecon = Deconstruct(Point=aoplane_2)  # -> XComponent, YComponent, ZComponent
aoplane_3 = ExtractReferencePlane(AssemblyObject=gate.Target0)
item = ListItem(List=group, Index=filter_2, Wrap=True)
item_2 = ListItem(List=aoplane, Index=filter_2, Wrap=True)
replace = ReplaceItems(List=repeat, Item="1", Indices=aoadecon.AvailableObjectIndexes, Wrap=False)
bnd = Bounds(Numbers=pdecon.ZComponent)
replace_2 = ReplaceItems(List=replace, Item="2", Indices=aoadecon.UnreachableObjectIndexes, Wrap=False)
orient = Orient(Geometry=item, Source=item_2, Target=aoplane_3)  # -> Geometry, Transform
remap = RemapNumbers(Value=pdecon.ZComponent, Source=bnd, Target=Domain(0, 1))  # -> Mapped, Clipped

# ---- group: occupied/available visualization
saturated = ColourSwatch(SwatchColor=RGB(112, 117, 57))
available = ColourSwatch(SwatchColor=RGB(255, 255, 255))
unreachable = ColourSwatch(SwatchColor=RGB(194, 199, 137))
weave = Weave(Pattern=graft(replace_2), Stream0=saturated, Stream1=available, Stream2=unreachable, NullGaps=False)  # -> simplify(Weave)
mcol_2 = MeshColours(Mesh=graft(aocmesh_4), Colours=weave)  # -> flatten(Mesh)

# ----
gradient_2 = Gradient(
    LowerLimit=0,
    UpperLimit=1,
    Parameter=remap.Mapped,
    stops=[0: RGB(21, 0, 33), 0.326: RGB(150, 66, 114), 0.664: RGB(224, 186, 187), 1: RGB(255, 255, 255)])
ungroup = Ungroup(Group=orient.Geometry)  # -> flatten(Objects)
item_3 = ListItem(List=type_colors, Index=graft(aotype), Wrap=True)  # -> simplify(Item)
aocmesh_6 = ExtractCollisionMesh(AssemblyObject=gate_2.Target0)
aocmesh_7 = ExtractCollisionMesh(AssemblyObject=gate.Target1)
filter_3 = StreamFilter(Gate=stop_and_go_bool, Stream0=ungroup)

# ---- group: display by component type
mcol_3 = MeshColours(Mesh=graft(aocmesh_3), Colours=item_3)  # -> flatten(Mesh)

# ----
mcol_4 = MeshColours(Mesh=graft(aocmesh_5), Colours=graft(gradient_2))  # -> flatten(Mesh)
filter_4 = StreamFilter(Gate=vizmode, Stream0=aocmesh_6, Stream1=mcol_2, Stream2=mcol_3, Stream3=mcol, Stream4=mcol_4)
filter_5 = StreamFilter(Gate=stop_and_go_bool, Stream0=filter_4, Stream1=aocmesh_7)
meshes = ClusterOutput(filter_5)
edges = ClusterOutput(filter_3)
