# Grasshopper definition 04-01_Assemblage 2 Objects Environment-Field selective heuristics.gh (Grasshopper 1.0.7)
# Copyright: Co-de-iT
# plug-ins: MeshEdit Components, Human, EleFront, Assembler, froGH

# ---- group: obstacle
pt = Point(Point(-122.3339923, 282.1586602, 0))
box = CenterBox(Base=pt, X=Slider(24, range=1..200), Y=Slider(9, range=1..200), Z=Slider(26, range=1..200))
mbox = MeshBox(Base=box, XCount="1", YCount="1", ZCount="1")

pt_2 = Point(Point(-158.4726811, 157.9892994, 0))
box_2 = CenterBox(Base=pt_2, X=Slider(11, range=1..200), Y=Slider(22.5, range=1..200), Z=Slider(26, range=1..200))
mbox_2 = MeshBox(Base=box_2, XCount="1", YCount="1", ZCount="1")

# ---- group: container
pt_3 = Point(Point(-140.2744565, 231.4122939, 0))
box_3 = CenterBox(Base=pt_3, X=Slider(100, range=1..200), Y=Slider(140, range=1..200), Z=Slider(85, range=1..200))
mbox_3 = MeshBox(Base=box_3, XCount="1", YCount="1", ZCount="1")

# ---- group: type 1
crv = Curve([<curve referenced from the Rhino model> x5])

# ASSEMBLAGES IN BRIEF: GENERAL STEPS
# 
# . choose WHERE to add
# 
# . choose WHAT to add
# 
# 
# PROCESS STEPS
# 
# 
# 
# . select receiver object in the assemblage
# 
# . list all possible combinations of free handles and related compatible candidates
# 
# . choose a winnig candidate according to given criteria
# DEFINITION ANATOMY: 00 - constuct
# 
# Construct the object and relationships necessary for the Assemblage
# 
# 
# 
# 01 - simulate
# 
# Simulate the Assemblage growth
# 
# 
# 
# 02 - analyze/post-process
# 
# Analyze results and post-process the obtained assemblage
crv_2 = Curve([<curve referenced from the Rhino model> x4])

# environment
crv_3 = Curve([<curve referenced from the Rhino model> x4])

# ---- group: container for Field
pt_4 = Point(Point(-140.2744565, 231.4122939, 0))
box_4 = CenterBox(Base=pt_4, X=Slider(100, range=1..200), Y=Slider(140, range=1..200), Z=Slider(85, range=1..200))

# ----
crv_4 = Curve(crv)
crv_5 = Curve(crv_2)

rotations = Panel("0")
lng = ListLength(List=crv_4)
repeat = RepeatData(Data=graft(rotations), Length=lng)
weight = Panel("0")
flip = FlipMatrix(Data=repeat)  # -> simplify(Data)
repeat_2 = RepeatData(Data=weight, Length=lng)

# ----
# 0 - construct
# AssemblyObjects
rotations_2 = Panel("0")
lng_2 = ListLength(List=crv_5)
repeat_3 = RepeatData(Data=graft(rotations_2), Length=lng_2)
weight_2 = Panel("0")
flip_2 = FlipMatrix(Data=repeat_3)  # -> simplify(Data)
repeat_4 = RepeatData(Data=weight_2, Length=lng_2)

crv_6 = Curve(crv_3)

rotations_3 = Panel("0")
lng_3 = ListLength(List=crv_6)
repeat_5 = RepeatData(Data=graft(rotations_3), Length=lng_3)
weight_3 = Panel("0")
flip_3 = FlipMatrix(Data=repeat_5)  # -> simplify(Data)
repeat_6 = RepeatData(Data=weight_3, Length=lng_3)

type = Panel("2")
type_2 = Panel("1")
type_3 = Panel("1")
repeat_7 = RepeatData(Data=type, Length=lng)
repeat_8 = RepeatData(Data=type_2, Length=lng_2)
repeat_9 = RepeatData(Data=type_3, Length=lng_3)

# ---- group: single container
mesh = Mesh(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)

# ---- group: container
# flip normals: A container must have normals pointing inward
flip_4 = MeshFlip(Mesh=mbox_3)

# ---- group: single container
# flip normals: A container must have normals pointing inward
flip_5 = MeshFlip(Mesh=mesh)

# ---- group: Create Handles
handle = ConstructHandle(Polyline=crv_4, RotationAngles=flip, Type=repeat_7, Weight=repeat_2)

# © Co-de-iT 2020 / Creative Commons Attribution-Non Commercial-ShareAlike 4.0 International License
handle_2 = ConstructHandle(Polyline=crv_5, RotationAngles=flip_2, Type=repeat_8, Weight=repeat_4)

handle_3 = ConstructHandle(Polyline=crv_6, RotationAngles=flip_3, Type=repeat_9, Weight=repeat_6)

# ---- group: set box as environment container
smesh = SimpleMesh(Brep=box_4)
flip_6 = MeshFlip(Mesh=smesh)

# ----
model_abs_size = BooleanToggle(True)

# ---- group: multiple attractor points
pt_5 = Point(Point(-106.1954929, 169.2417387, -5.148424688))
pt_6 = Point(Point(-139.562713, 346.229302, -41.80343786))
pt_7 = Point(Point(-199.2746517, 257.2703911, 43.23515265))
merge = Merge(Data1=pt_5, Data2=pt_7, Data3=pt_6)

# ----
model_abs_size_2 = BooleanToggle(True)
model_abs_size_3 = BooleanToggle(True)

merge_2 = Merge(Data1=flip_4, Data2=mbox_2, Data3=mbox)  # -> flatten(Result)

environment = ValueList({"single mesh container": 0, "container + obstacles": 1, "field container": 2, "field + obstacles": 3}, selected="container + obstacles")
merge_3 = Merge(Data1=flip_6, Data2=mbox_2, Data3=mbox)  # -> flatten(Result)
filter = StreamFilter(Gate=environment, Stream0=flip_5, Stream1=merge_2, Stream2=flip_6, Stream3=merge_3)

merge_4 = Merge(Data1=handle_2, Data2=handle)

# ----
# Assembler
# 
# Framework for Iterative Assemblages workflow
# 
# code by Alessio Erioli
# 
# v 1.0
mesh_2 = Mesh(<mesh referenced from the Rhino model>)
volume = Volume(Geometry=mesh_2)  # -> Volume, Centroid
name = Panel("typeA")
xy = XYPlane(Origin=volume.Centroid)
X = UnitX(Factor=1)

mesh_3 = Mesh(<mesh referenced from the Rhino model>)
volume_2 = Volume(Geometry=mesh_3)  # -> Volume, Centroid
name_2 = Panel("typeB")
xy_2 = XYPlane(Origin=volume_2.Centroid)
X_2 = UnitX(Factor=1)

# ---- group: Display Handles
handdisp = DisplayHandle(Handles=handle, DisplaySize=Slider(7.261, range=0..10), ModelScreenSize=model_abs_size)

handdisp_2 = DisplayHandle(Handles=handle_2, DisplaySize=Slider(7.261, range=0..10), ModelScreenSize=model_abs_size_2)

handdisp_3 = DisplayHandle(Handles=handle_3, DisplaySize=Slider(7.261, range=0..10), ModelScreenSize=model_abs_size_3)

# ----
crv_7 = Curve()
pt_8 = Point()
brep = Brep()
merge_5 = Merge()
xdcon = ConstructXData(Label="blockA body", Data=merge_5, ReferencePlane=xy, AssemblyObjectNameReference=name)

brep_2 = Brep([<brep referenced from the Rhino model> x20])
xdcon_2 = ConstructXData(Label="typeB extra", Data=brep_2, ReferencePlane=xy_2, AssemblyObjectNameReference=name_2)

# ---- group: Create AssemblyObject
aocon = ConstructAssemblyObject(Name=name, CollisionMesh=mesh_2, ReferencePlane=xy, Direction=X, Weight="1.0", Handles=merge_4)

aocon_2 = ConstructAssemblyObject(Name=name_2, CollisionMesh=mesh_3, ReferencePlane=xy_2, Direction=X_2, Weight="1.0", Handles=handle_3)

# ---- group: display Environment Geometries
obstacles = ColourSwatch(SwatchColor=RGB(115, 124, 148))
containers = ColourSwatch(SwatchColor=RGB(0, 0, 0))
merge_6 = Merge(Data1=obstacles, Data2=containers)
mesh_4 = Mesh(filter)
cluster = Cluster_2(environment_meshes=mesh_4, colours=merge_6, normal_size=Slider(10, range=1..20))

# ---- group: XData
merge_7 = Merge(Data1=flatten(xdcon))
data = Data(merge_7)

# ---- group: AssemblyObjects
merge_8 = Merge(Data1=flatten(aocon), Data2=flatten(aocon_2))
data_2 = Data(merge_8)

# ----
self_object = BooleanToggle(True)
self_handle = BooleanToggle(True)
cross_type = BooleanToggle(False)
heuw = HeuristicsWriter(
    AssemblyObjectsSet=data_2,
    AllowSelfObjectConnections=self_object,
    AllowSelfHandleConnections=self_handle,
    AllowCrossTypeConnections=cross_type)

display = ValueList({"by Type": 0, "by s/r status": 1}, selected="by Type")
go = BooleanToggle(False)
step = Button()
max_objects = Panel("2000")
resetex = Button()
reset = Button()
cell_size = Slider(1.2, range=1..2)

# ---- group: base point
pt_9 = Point(Point(0, 20, 0))

# ----
show_edges = BooleanToggle(True)

# ---- group: filter heuristics
heudex = HeuristicsDisplayEx(OriginPoint=Point(0, 0, 0), AssemblyObjectsSet=data_2, HeuristicsString=heuw, XSize=1, YSize=1, NRows=10)  # -> AssemblyObjectPairs, CoherencePattern, HeuristicsStringTree, TextBasePoints, XData
cull = CullPattern(List=flatten(heudex.HeuristicsStringTree), CullPattern=flatten(heudex.CoherencePattern))

# ----
pt_10 = Point(Point(-128.0493523, 231.6872502, 0))

# ---- group: Heuristics Display
heud = HeuristicDisplay(
    OriginPoint=pt_9,
    AssemblyObjectsSet=data_2,
    HeuristicsString=cull,
    XSize=cell_size,
    YSize=cell_size,
    NRows=Slider(10, range=10..50),
    ShowEdges=show_edges,
    DisplayMode=display)

# ----
xy_3 = XYPlane(Origin=pt_10)

# ---- group: create 2 heuristics sets
# 1 - simulate
panel = Panel("0 to 23")
subset = SubList(List=cull, Domain="24 to 48", Wrap=True)  # -> List, Index
subset_2 = SubList(List=cull, Domain=panel, Wrap=True)  # -> List, Index
entwine = Entwine(Branch00=subset.List, Branch01=subset_2.List, FlattenInputs=True)

# ----
selrec = ValueList({"random": 0, "scalar field": 1, "scalar field acc": 2, "dense packing (SLOW)": 3}, selected="random")
heuristics_mode = ValueList({"manual": 0, "field driven": 1}, selected="field driven")
selrule = ValueList({"random": 0, "scalar field": 1, "scalar field acc": 2, "vector field": 3, "vector field acc": 4, "min locl bb vol": 5, "min loc bb diag": 6}, selected="random")
heuset = HeuristicsSettings(
    HeuristicsString=entwine,
    CurrentHeuristics=Slider(0, range=0..3),
    HeuristicsMode=heuristics_mode,
    ReceiverSelectionMode=selrec,
    RuleSelectionMode=selrule)

or = GateOr(A=go, B=step)
# 2 - analyze/post-process
display_2 = ValueList({"objects": 0, "occupancy": 1, "type": 2, "sequence": 3, "Z height": 4, "none": 5}, selected="occupancy")
panel_2 = Panel("""AliceBlue
SlateGray
GoldenRod
YellowGreen
DarkKhaki""")

iweights_one_for_each_point = Panel("""0
1
1""")
# field
afieldn = ConstructFieldN(Box=box_4, NCells=Slider(15, range=10..30))  # -> Field, FieldPoints
cset = CreateSet(List=iweights_one_for_each_point)  # -> Set, Map
sort = SortList(Keys=cset.Set)  # -> Keys, ValuesA

# ---- group: calculate vector
xprod = CrossProduct(VectorA=graft(afieldn.FieldPoints), VectorB=merge, Unitize=True)  # -> Vector, Length
avr = Average(Input=xprod.Vector)  # -> flatten(ArithmeticMean)
unit = UnitVector(Vector=avr)

# ---- group: calculate scalar
dist = Distance(PointA=graft(afieldn.FieldPoints), PointB=merge)
log = Logarithm(Value=dist)
avr_2 = Average(Input=log)  # -> flatten(ArithmeticMean)

# ---- group: Populate Field (scalars, vectors)
afpop = PopulateField(Field=afieldn.Field, ScalarValues=avr_2, VectorValues=unit)

# ---- group: generate colors for iWeights
lng_4 = ListLength(List=sort.Keys)
wheel = ColourWheel(
    lng_4,
    ColourGrips_Style=20,
    ColourGrips_Grip=[3.852552882, 1.572724853, 3.910274516, 2.863076965],
    ColourGrips_Lum=[0.1, 0.5200944508],
    ColourGrips_Range=[0.2617993878, 0.3435557472, 0.2617993878, 0.2617993878],
    ColourGrips_Sat=[0.2, 1])

# ---- group: Display attractor influence volumes
voronoi³ = Voronoi3D(Points=merge, Box=box_4)  # -> Cells, Boundary
material = CreateMaterial(Diffuse=wheel, Specular=RGB(255, 255, 255), Emission=RGB(0, 0, 0), Transparency=Slider(0.9, range=0..1), Shine=0)
item = ListItem(List=material, Index=iweights_one_for_each_point, Wrap=True)
preview = CustomPreview(Geometry=voronoi³.Cells, Material=item)

# ---- group: Populate iWeights
afpopwa = PopulateFieldIWeightsAttractors(Field=afpop, AttractorPoints=merge, IWeightValues=graft(iweights_one_for_each_point), Blend=False)

# ---- group: generate colors for iWeights / colour chart
legend = Legend(Colour=wheel, Tags=sort.Keys, LegendType=1)

# ----
afdecon = DeconstructField(Field=afpopwa)  # -> Points, ScalarValues, Vectors, IWeights, Colors
item_2 = ListItem(List=wheel, Index=afdecon.IWeights, Wrap=True)
tag = TextTag3D(Location=graft(afdecon.Points), Text=afdecon.IWeights, Size="3", Colour=item_2, Justification=5)

# ---- group: Field for Assemblage
data_3 = Data(afpopwa)

# ----
environment_mode = ValueList({"none": 0, "collision": 1, "centroid": 2}, selected="collision")
box_5 = Box()
exoset = ExogeousSettings(
    EnvironmentMeshes=filter,
    EnvironmentMode=environment_mode,
    Field=data_3,
    FieldScalarThreshold=Slider(0.1, range=0..1),
    Sandbox={Plane=PlaneXY(0, 0, 0), X=Domain(-1, 1), Y=Domain(0, 0), Z=Domain(0, 0)})

# ---- group: Assemblage Engine Xtended
aoengx = AssemblerEngineX(
    AssemblyObjectsSet=data_2,
    StartingPlane=xy_3,
    StartingObjectType=0,
    HeuristicsSettings=heuset,
    ExogenousSettings=exoset,
    Go=go,
    Step=step,
    NIterations=Slider(100, range=10..100),
    MaxNObjects=max_objects,
    ResetExogenous=resetex,
    Reset=reset,
    FastCollisionCheck=False)  # -> Assemblage, AssemblageCount

# ----
n_of_objects = Panel(aoengx.AssemblageCount)

# ---- group: auto-stop
larger = LargerThan(FirstNumber=aoengx.AssemblageCount, SecondNumber=max_objects)  # -> LargerThan, OrEqualTo
f_tas = ToggleAutostop(Toggle=go, Condition=larger.OrEqualTo)

# ---- group: data dam
# delays updated data transmission by a certain amount of time or only when clicked
dam = DataDam(DataA=aoengx.Assemblage, BufferDelay=10000000, BufferMode=0)

# ----
aoadecon = DeconstructAssemblage(Assemblage=dam)  # -> AssemblageObjects, AssemblageRules, ReceiverObjectsIndexes, AvailableObjectIndexes, UnreachableObjectIndexes; disabled

# ---- group: objects statistics
aoadecon_2 = DeconstructAssemblage(Assemblage=dam)  # -> AssemblageObjects, AssemblageRules, ReceiverObjectsIndexes, AvailableObjectIndexes, UnreachableObjectIndexes
aoset = ExtractAOSet(Assemblage=dam)
aotype = ExtractType(AssemblyObject=aoadecon_2.AssemblageObjects)
f_ifroml = IndexesFromList(Data=aoset)
mindex = MemberIndex(Set=aotype, Member=f_ifroml)  # -> Index, Count
expression = Expression(x=f_ifroml, y=mindex.Count, Expression="Format(\"type {0}: {1}\", x, y)")
pt_11 = Point(Point(-218.075651, 73.00729024, 0))
join = TextJoin(Text=expression)
xy_4 = XYPlane(Origin=pt_11)
tag_2 = TextTag3D(Location=xy_4, Text=join, Size="5", Colour=ColourSwatch(SwatchColor=RGB(0, 0, 0)), Justification=7)

# ----
cluster_2 = Cluster(vizmode=display_2, assemblage=aoengx.Assemblage, type_colors=panel_2, stop_and_go_bool=or)  # -> meshes, edges
aocmesh = ExtractCollisionMesh(AssemblyObject=aoadecon.AssemblageObjects)  # disabled
aotype_2 = ExtractType(AssemblyObject=aoadecon.AssemblageObjects)

# ---- group: display components
mjoin = MeshJoin(Meshes=cluster_2.meshes)
preview_2 = CustomPreview(Geometry=mjoin, Material=ColourSwatch(SwatchColor=RGB(255, 255, 255)))

# ---- group: display components / display edges
previewlw = CustomPreviewLineweights(Geometry=cluster_2.edges, Shader=ColourSwatch(SwatchColor=RGB(0, 0, 0)), Thickness=Slider(1, range=1..3), Absolute=False)

# ----
sift = SiftPattern(List=aoadecon.AssemblageObjects, SiftPattern=aotype_2)  # -> Output0, Output1
aoplane = ExtractReferencePlane(AssemblyObject=sift.Output0)
aoplane_2 = ExtractReferencePlane(AssemblyObject=sift.Output1)

# ---- group: apply blocks
inblock = InsertBlock(BlockName="blockA_v1", SourcePlane=aoplane)
inblock_2 = InsertBlock(BlockName="blockB", SourcePlane=aoplane_2)
bake = BooleanToggle(False)

# ----
combine = CombineData(Input0=inblock, Input1=inblock_2)  # -> Result, Index

# ---- group: apply blocks (continued)
bake_2 = BakeObjects(Geometry=combine.Result, Bake=bake)

# ==== cluster Cluster
vizmode = ClusterInput()
assemblage = ClusterInput()
type_colors = ClusterInput()
stop_and_go_bool = ClusterInput()
aoadecon = DeconstructAssemblage(Assemblage=assemblage)  # -> AssemblageObjects, AssemblageRules, ReceiverObjectsIndexes, AvailableObjectIndexes, UnreachableObjectIndexes
filter = StreamFilter(Gate=stop_and_go_bool, Stream0=assemblage)
gate = StreamGate(Stream=aoadecon.AssemblageObjects, Gate=stop_and_go_bool)  # -> Target0, Target1
aoset = ExtractAOSet(Assemblage=filter)
gate_2 = StreamGate(Stream=gate.Target0, Gate=vizmode)  # -> Target0, Target1, Target2, Target3, Target4, Target5
aocmesh = ExtractCollisionMesh(AssemblyObject=aoset)
f_mseea = MeshExtractEdgesWithToleranceAngle(Mesh=aocmesh, Angle="45")  # -> InternalEdges, NakedEdges

# ---- group: extract object type
aotype = ExtractType(AssemblyObject=gate.Target0)

# ----
aocmesh_2 = ExtractCollisionMesh(AssemblyObject=gate_2.Target3)
aocmesh_3 = ExtractCollisionMesh(AssemblyObject=gate_2.Target2)
aocmesh_4 = ExtractCollisionMesh(AssemblyObject=gate_2.Target1)
aocmesh_5 = ExtractCollisionMesh(AssemblyObject=gate_2.Target4)
group = Group(Objects=f_mseea.InternalEdges)  # -> flatten(Group)
lng = ListLength(List=aocmesh_4)
aoplane = ExtractReferencePlane(AssemblyObject=aoset)
aoplane_2 = ExtractReferencePlane(AssemblyObject=gate_2.Target4)
repeat = RepeatData(Data="0", Length=lng)

# ---- group: display by assemblage sequence
lng_2 = ListLength(List=aocmesh_2)  # -> expr("x-1", Length)
f_ifroml = IndexesFromList(D=aocmesh_2)  # -> i; inputs D: list
# ---------- f_ifroml: C# usings ----------
using System.Linq;
# ---------- f_ifroml: C# ----------
   
 /*
    froGH - a sparse collection of (in)utilities for Grasshopper

    Indexes from Number
    code by Alessio Erioli

    froGH by Co-de-iT is licensed under a Creative Commons Attribution 4.0 International License.
    http://creativecommons.org/licenses/by/4.0/

    */
    initComp();
   
    GH_Integer[] indexes = new GH_Integer[D.Count];

    for(int j = 0; j < D.Count; j++)
      indexes[j] = new GH_Integer(j);

    //A = indexes.Sum(j => j.Value); // uses System.Linq Sum selector function - for each GH_Integer j in indexes add its value to the total sum

    i = indexes;
# ---------- f_ifroml: C# additional code ----------
  void initComp(){
    Component.Name = "Indexes from List";
    Component.NickName = "f_iFromL";
    Component.Description = "Generates a list of 0-based integer indexes from a given list of data";
    Component.Params.Input[0].Name = "Data";
    Component.Params.Input[0].Description = "the list to index";
    Component.Params.Output[0].Name = "Indexes";
    Component.Params.Output[0].Description = "the generated indexes";
  }
# ---------- end f_ifroml ----------
one_over_x = OneOverX(Value=lng_2)
multiplication = Multiplication(A=f_ifroml, B=one_over_x)
sqr = Square(Value=multiplication)
gradient = Gradient(
    LowerLimit=0,
    UpperLimit=1,
    Parameter=sqr,
    stops=[0: RGB(0, 0, 0), 0.498: RGB(56, 136, 150), 0.904: RGB(186, 224, 224), 1: RGB(255, 255, 255)])
mcol = MeshColours(Mesh=graft(aocmesh_2), Colours=graft(gradient))  # -> flatten(Mesh)

# ----
filter_2 = StreamFilter(Gate=stop_and_go_bool, Stream0=aotype)
pdecon = Deconstruct(Point=aoplane_2)  # -> XComponent, YComponent, ZComponent
aoplane_3 = ExtractReferencePlane(AssemblyObject=gate.Target0)
item = ListItem(List=group, Index=filter_2, Wrap=True)
item_2 = ListItem(List=aoplane, Index=filter_2, Wrap=True)
replace = ReplaceItems(List=repeat, Item="1", Indices=aoadecon.AvailableObjectIndexes, Wrap=False)
bnd = Bounds(Numbers=pdecon.ZComponent)
replace_2 = ReplaceItems(List=replace, Item="2", Indices=aoadecon.UnreachableObjectIndexes, Wrap=False)
orient = Orient(Geometry=item, Source=item_2, Target=aoplane_3)  # -> Geometry, Transform
remap = RemapNumbers(Value=pdecon.ZComponent, Source=bnd, Target=Domain(0, 1))  # -> Mapped, Clipped

# ---- group: occupied/available visualization
saturated = ColourSwatch(SwatchColor=RGB(112, 117, 57))
available = ColourSwatch(SwatchColor=RGB(255, 255, 255))
unreachable = ColourSwatch(SwatchColor=RGB(194, 199, 137))
weave = Weave(Pattern=graft(replace_2), Stream0=saturated, Stream1=available, Stream2=unreachable, NullGaps=False)  # -> simplify(Weave)
mcol_2 = MeshColours(Mesh=graft(aocmesh_4), Colours=weave)  # -> flatten(Mesh)

# ----
gradient_2 = Gradient(
    LowerLimit=0,
    UpperLimit=1,
    Parameter=remap.Mapped,
    stops=[0: RGB(21, 0, 33), 0.326: RGB(150, 66, 114), 0.664: RGB(224, 186, 187), 1: RGB(255, 255, 255)])
ungroup = Ungroup(Group=orient.Geometry)  # -> flatten(Objects)
item_3 = ListItem(List=type_colors, Index=graft(aotype), Wrap=True)  # -> simplify(Item)
aocmesh_6 = ExtractCollisionMesh(AssemblyObject=gate_2.Target0)
aocmesh_7 = ExtractCollisionMesh(AssemblyObject=gate.Target1)
filter_3 = StreamFilter(Gate=stop_and_go_bool, Stream0=ungroup)

# ---- group: display by component type
mcol_3 = MeshColours(Mesh=graft(aocmesh_3), Colours=item_3)  # -> flatten(Mesh)

# ----
mcol_4 = MeshColours(Mesh=graft(aocmesh_5), Colours=graft(gradient_2))  # -> flatten(Mesh)
filter_4 = StreamFilter(Gate=vizmode, Stream0=aocmesh_6, Stream1=mcol_2, Stream2=mcol_3, Stream3=mcol, Stream4=mcol_4)
filter_5 = StreamFilter(Gate=stop_and_go_bool, Stream0=filter_4, Stream1=aocmesh_7)
meshes = ClusterOutput(filter_5)
edges = ClusterOutput(filter_3)

# ==== cluster Cluster_2
environment_meshes = ClusterInput()
colours = ClusterInput()  # First Colour for obstacles, second for containers
normal_size = ClusterInput()
volume = MeshVolume(Mesh=environment_meshes)  # -> Volume, Centroid
smaller = SmallerThan(FirstNumber=volume.Volume, SecondNumber=0)  # -> SmallerThan, OrEqualTo
panel = Panel("""3
1""")
item = ListItem(List=colours, Index=graft(smaller.SmallerThan), Wrap=True)
item_2 = ListItem(List=panel, Index=graft(smaller.SmallerThan), Wrap=True)
medges = MeshEdges(Mesh=environment_meshes)  # -> NakedEdges, InteriorEdges, NonManifoldEdges
facen = FaceNormals(Mesh=environment_meshes)  # -> Centers, Normals
multiplication = Multiplication(A=facen.Normals, B=normal_size)
previewlw = CustomPreviewLineweights(Geometry=medges.InteriorEdges, Shader=graft(item), Thickness=graft(item_2), Absolute=False)
vdisex = VectorDisplayEx(Point=facen.Centers, Vector=multiplication, Colour=graft(item), Width=2)
