# Grasshopper definition 04-02_Assemblage 3 objects alternate heuristics.gh (Grasshopper 1.0.7)
# Copyright: Co-de-iT
# plug-ins: MeshEdit Components, Human, Assembler, froGH

# ---- group: container
# 0.3 - Environments and fields
number_slider = Slider(20, range=10..200)
pt = Point(Point(-124.0556421, 126.8001631, 41.84432795))
box = CenterBox(Base=pt, X=number_slider, Y=Slider(30, range=10..200), Z=Slider(45, range=1..200))
mbox = MeshBox(Base=box, XCount="1", YCount="1", ZCount="1")
weldvertices = MeshWeldVertices(Mesh=mbox, Tolerance=0.01)  # -> RuntimeMessage, Mesh

# ---- group: container 01
pt_2 = Point(Point(-138.3028437, 156.3777527, -3.9998166))
box_2 = CenterBox(Base=pt_2, X=Slider(50, range=10..200), Y=Slider(50, range=10..200), Z=Slider(20, range=1..200))
mbox_2 = MeshBox(Base=box_2, XCount="1", YCount="1", ZCount="1")
weldvertices_2 = MeshWeldVertices(Mesh=mbox_2, Tolerance=0.01)  # -> RuntimeMessage, Mesh

# ---- group: obstacle
pt_3 = Point(Point(-112.5173249, 144.6988427, 0))
box_3 = CenterBox(Base=pt_3, X=Slider(11, range=10..200), Y=Slider(22, range=10..200), Z=Slider(44, range=1..200))
rot3d = Rotate3D(Geometry=box_3, Angle=Slider(0.4, range=0..3.142), Center=pt_3, Axis="1,2,1.5")  # -> Geometry, Transform
mbox_3 = MeshBox(Base=rot3d.Geometry, XCount="1", YCount="1", ZCount="1")
weldvertices_3 = MeshWeldVertices(Mesh=mbox_3, Tolerance=0.01)  # -> RuntimeMessage, Mesh

# ---- group: container 02
pt_4 = Point(Point(-147.4207126, 215.3001639, -15.05919262))
box_4 = CenterBox(Base=pt_4, X=Slider(20, range=10..200), Y=Slider(30, range=10..200), Z=Slider(40, range=1..200))
mbox_4 = MeshBox(Base=box_4, XCount="1", YCount="1", ZCount="1")
weldvertices_4 = MeshWeldVertices(Mesh=mbox_4, Tolerance=0.01)  # -> RuntimeMessage, Mesh

# ---- group: type 1
crv = Curve([<curve referenced from the Rhino model> x4])

# ---- group: type 2
crv_2 = Curve([<curve referenced from the Rhino model> x2])

# ---- group: type 1
# FIELD-DEPENDENT HEURISTICS: This deinition shows how to pair different AssemblyObjects sets with corresponding environments.
# 
# The basic principle is to prepare, for each environment, one heuristic subset (using the desired AssemblyObjects subset) and one field with iWeights set to the corresponding heursitic set number.
# 
# The Heuristic Writer, Heuristic Display and Assembler Engine components should all receive the FULL set of AssemblyObjects.
# 
# The different Heuristics will use subsets of the full set of AssemblyObjects.
# 
# In this example, there are 3 AssemblyObjects: blockA, blockB and blockC.
# 
# 3 different Heuristics sets are created, using respectively blockA-blockB (set 0), blockA-blockC (set 1), blockB-blockC (set 2).
# 
# Correspondingly, 3 environments are created (2 of them share the same obstacle). It is important that each environment has ONLY ONE container, and that the containers overlap to allow the assemblage to continue.
# 
# Finally, 3 fields are created, with iWeights set to 0, 1, and 2 (and some token values for scalar and vector just to build the field). Since the Heuristics will remain constant through the entire field, the resolution is minimal (3).
# 
# Using the "field driven" option in the Heuristic Mode, start the Assemblage from the desired position, choosing an environment that contains said position and a starting object type that is included in the Heuristic Set. To switch from one environment to another, change the environment selector and press the "resetEx" button.
# 
# The default values in the definition are set so that one should go in order through the environments (0, 1, 2).
# 0 - construct
# 0.1 - AssemblyObjects
crv_3 = Curve([<curve referenced from the Rhino model> x3])

# ---- group: type 2
crv_4 = Curve([<curve referenced from the Rhino model> x2])

# ---- group: type 1
crv_5 = Curve([<curve referenced from the Rhino model> x5])

# ----
rotations = Panel("""0
180""")
lng = ListLength(List=crv_5)
repeat = RepeatData(Data=graft(rotations), Length=lng)
weight = Panel("0")
flip = FlipMatrix(Data=repeat)  # -> simplify(Data)
repeat_2 = RepeatData(Data=weight, Length=lng)

merge = Merge(Data1=flatten(crv), Data2=flatten(crv_2))
merge_2 = Merge(Data1=flatten(crv_3), Data3=flatten(crv_4))
type = Panel("1")
repeat_3 = RepeatData(Data=type, Length=lng)
model_abs_size = BooleanToggle(True)
model_abs_size_2 = BooleanToggle(True)
model_abs_size_3 = BooleanToggle(True)

rotations_2 = Panel("""0
180""")
lng_2 = ListLength(List=merge)
type_2 = Panel("""1
1
1
1
2
2""")
repeat_4 = RepeatData(Data=graft(rotations_2), Length=lng_2)
weight_2 = Panel("0")
flip_2 = FlipMatrix(Data=repeat_4)  # -> simplify(Data)
repeat_5 = RepeatData(Data=weight_2, Length=lng_2)

# ----
# ASSEMBLAGES IN BRIEF: GENERAL STEPS
# 
# . choose WHERE to add
# 
# . choose WHAT to add
# 
# 
# PROCESS STEPS
# 
# 
# 
# . select receiver object in the assemblage
# 
# . list all possible combinations of free handles and related compatible candidates
# 
# . choose a winnig candidate according to given criteria
# DEFINITION ANATOMY: 00 - constuct
# 
# Construct the object and relationships necessary for the Assemblage
# 
# 
# 
# 01 - simulate
# 
# Simulate the Assemblage growth
# 
# 
# 
# 02 - analyze/post-process
# 
# Analyze results and post-process the obtained assemblage
rotations_3 = Panel("""0
180""")
lng_3 = ListLength(List=merge_2)
type_3 = Panel("""1
1
1
2
2""")
repeat_6 = RepeatData(Data=graft(rotations_3), Length=lng_3)
weight_3 = Panel("0")
flip_3 = FlipMatrix(Data=repeat_6)  # -> simplify(Data)
repeat_7 = RepeatData(Data=weight_3, Length=lng_3)

# ---- group: field
resolution = Panel("3")
afieldn = ConstructFieldN(Box=box, NCells=resolution)  # -> Field, FieldPoints
lng_4 = ListLength(List=afieldn.FieldPoints)
heuristics = Panel("0")
scalar = Panel("0.0")
Z = UnitZ(Factor=1)
entwine = Entwine(Branch00=scalar, Branch01=Z, Branch02=heuristics, FlattenInputs=True)
repeat_8 = RepeatData(Data=entwine, Length=lng_4)
bang = ExplodeTree(Data=repeat_8)  # -> Branch0, Branch1, Branch2
afpop = PopulateField(Field=afieldn.Field, ScalarValues=bang.Branch0, VectorValues=bang.Branch1, IWeightValues=bang.Branch2)

# ---- group: field 01
resolution_2 = Panel("3")
afieldn_2 = ConstructFieldN(Box=box_2, NCells=resolution_2)  # -> Field, FieldPoints
lng_5 = ListLength(List=afieldn_2.FieldPoints)
Y = UnitY(Factor=1)
heuristics_2 = Panel("1")
scalar_2 = Panel("0.0")
entwine_2 = Entwine(Branch00=scalar_2, Branch01=Y, Branch02=heuristics_2, FlattenInputs=True)
repeat_9 = RepeatData(Data=entwine_2, Length=lng_5)
bang_2 = ExplodeTree(Data=repeat_9)  # -> Branch0, Branch1, Branch2
afpop_2 = PopulateField(Field=afieldn_2.Field, ScalarValues=bang_2.Branch0, VectorValues=bang_2.Branch1, IWeightValues=bang_2.Branch2)

# ----
resolution_3 = Panel("3")
afieldn_3 = ConstructFieldN(Box=box_4, NCells=resolution_3)  # -> Field, FieldPoints
lng_6 = ListLength(List=afieldn_3.FieldPoints)
scalar_3 = Panel("0.0")
X = UnitX(Factor=1)
heuristics_3 = Panel("2")
entwine_3 = Entwine(Branch00=scalar_3, Branch01=X, Branch02=heuristics_3, FlattenInputs=True)
repeat_10 = RepeatData(Data=entwine_3, Length=lng_6)
bang_3 = ExplodeTree(Data=repeat_10)  # -> Branch0, Branch1, Branch2
afpop_3 = PopulateField(Field=afieldn_3.Field, ScalarValues=bang_3.Branch0, VectorValues=bang_3.Branch1, IWeightValues=bang_3.Branch2)

# ---- group: Create Handles
handle = ConstructHandle(Polyline=crv_5, RotationAngles=flip, Type=repeat_3, Weight=repeat_2)

handle_2 = ConstructHandle(Polyline=merge, RotationAngles=flip_2, Type=type_2, Weight=repeat_5)

handle_3 = ConstructHandle(Polyline=merge_2, RotationAngles=flip_3, Type=type_3, Weight=repeat_7)

# ---- group: container
# flip normals: A container must have normals pointing inward
flip_4 = MeshFlip(Mesh=weldvertices.Mesh)

# ---- group: container 01
# flip normals: A container must have normals pointing inward
flip_5 = MeshFlip(Mesh=weldvertices_2.Mesh)

# ---- group: container 02
# flip normals: A container must have normals pointing inward
flip_6 = MeshFlip(Mesh=weldvertices_4.Mesh)

# ----
mesh = Mesh(<mesh referenced from the Rhino model>)
volume = Volume(Geometry=mesh)  # -> Volume, Centroid
name = Panel("blockC")
xy = XYPlane(Origin=volume.Centroid)
X_2 = UnitX(Factor=1)

crv_6 = Curve([<curve referenced from the Rhino model> x12])
pt_5 = Point([<point referenced from the Rhino model> x7])
brep = Brep()
brep_2 = Brep([<brep referenced from the Rhino model> x21])
merge_3 = Merge(Data1=crv_6, Data2=pt_5)
xdcon = ConstructXData(Label="blockB body", ReferencePlane=xy, AssemblyObjectNameReference=name)

mesh_2 = Mesh(<mesh referenced from the Rhino model>)
volume_2 = Volume(Geometry=mesh_2)  # -> Volume, Centroid
name_2 = Panel("blockB")
xy_2 = XYPlane(Origin=volume_2.Centroid)
X_3 = UnitX(Factor=1)

crv_7 = Curve([<curve referenced from the Rhino model> x12])
pt_6 = Point([<point referenced from the Rhino model> x7])
brep_3 = Brep()
brep_4 = Brep([<brep referenced from the Rhino model> x21])
merge_4 = Merge(Data1=crv_7, Data2=pt_6)
xdcon_2 = ConstructXData(Label="blockB body", ReferencePlane=xy_2, AssemblyObjectNameReference=name_2)

# ----
# Assembler
# 
# Framework for Iterative Assemblages workflow
# 
# code by Alessio Erioli
# 
# v 1.0
# © Co-de-iT 2020 / Creative Commons Attribution-Non Commercial-ShareAlike 4.0 International License
mesh_3 = Mesh(<mesh referenced from the Rhino model>)
volume_3 = Volume(Geometry=mesh_3)  # -> Volume, Centroid
name_3 = Panel("blockA")
xy_3 = XYPlane(Origin=volume_3.Centroid)
X_4 = UnitX(Factor=1)

crv_8 = Curve([<curve referenced from the Rhino model> x12])
pt_7 = Point([<point referenced from the Rhino model> x7])
brep_5 = Brep()
brep_6 = Brep(<brep referenced from the Rhino model>)
merge_5 = Merge(Data1=crv_8, Data2=pt_7)
xdcon_3 = ConstructXData(Label="blockA body", ReferencePlane=xy_3, AssemblyObjectNameReference=name_3)

merge_6 = Merge(Data1=flip_4, Data2=weldvertices_3.Mesh)  # -> flatten(Result)
merge_7 = Merge(Data1=flip_5, Data2=weldvertices_3.Mesh)  # -> flatten(Result)

# ---- group: Display Handles
handdisp = DisplayHandle(Handles=handle, DisplaySize=Slider(0.262, range=0..0.5), ModelScreenSize=model_abs_size)

handdisp_2 = DisplayHandle(Handles=handle_2, DisplaySize=Slider(0.262, range=0..0.5), ModelScreenSize=model_abs_size_2)

handdisp_3 = DisplayHandle(Handles=handle_3, DisplaySize=Slider(0.1, range=0..0.5), ModelScreenSize=model_abs_size_3)

# ---- group: Create AssemblyObject
aocon = ConstructAssemblyObject(Name=name, CollisionMesh=mesh, ReferencePlane=xy, Direction=X_2, Weight="1.0", Handles=handle)

aocon_2 = ConstructAssemblyObject(Name=name_3, CollisionMesh=mesh_3, ReferencePlane=xy_3, Direction=X_4, Weight="1.0", Handles=handle_3)

aocon_3 = ConstructAssemblyObject(Name=name_2, CollisionMesh=mesh_2, ReferencePlane=xy_2, Direction=X_3, Weight="1.0", Handles=handle_2)

# ---- group: XData
merge_8 = Merge(Data1=flatten(xdcon_3), Data2=flatten(xdcon_2), Data3=flatten(xdcon))
data = Data(merge_8)

# ---- group: AssemblyObjects full catalog
merge_9 = Merge(Data1=flatten(aocon_2), Data2=flatten(aocon_3), Data3=flatten(aocon))
data_2 = Data(merge_9)

# ---- group: use to generate & display selective heuristics
# 0.2 - Heuristics setup
panel = Panel("""0
1""")
panel_2 = Panel("""0
2""")
panel_3 = Panel("""1
2""")

# ----
self_object = BooleanToggle(True)
self_handle = BooleanToggle(True)
cross_type = BooleanToggle(False)

# ----
# It is more conveninent to prepare heuristics in advance and store them as text files.....
# ... and then just load them here.
int = Integer(panel_3)
item = ListItem(List=data_2, Index=int, Wrap=True)
heuw = HeuristicsWriter(
    AssemblyObjectsSet=item,
    AllowSelfObjectConnections=self_object,
    AllowSelfHandleConnections=self_handle,
    AllowCrossTypeConnections=cross_type)
display = ValueList({"by Type": 0, "by s/r status": 1}, selected="by Type")
cell_size = Slider(1.2, range=1..2)
show_edges = BooleanToggle(True)

# ---- group: directory for heuristics save
panel_4 = Panel("heuristics")
f_ghfilepath = GHFilePathInfo()  # -> FileName, FilePath
concat = Concatenate(FragmentA=f_ghfilepath.FilePath, FragmentB=panel_4, FragmentC="\")

# ----
environment = ValueList({"container 0 + obstacle": 0, "container 1 + obstacle": 1, "container 2": 2}, selected="container 0 + obstacle")

# ---- group: fields
filter = StreamFilter(Gate=environment, Stream0=afpop, Stream1=afpop_2, Stream2=afpop_3)

# ---- group: environment meshes
filter_2 = StreamFilter(Gate=environment, Stream0=merge_6, Stream1=merge_7, Stream2=flip_6)

# ---- group: display Environment Geometries
obstacles = ColourSwatch(SwatchColor=RGB(115, 124, 148))
containers = ColourSwatch(SwatchColor=RGB(0, 0, 0))
merge_10 = Merge(Data1=obstacles, Data2=containers)
mesh_4 = Mesh(filter_2)
cluster = Cluster(environment_meshes=mesh_4, colours=merge_10, normal_size=Slider(10, range=1..100))

# ---- group: filter heuristics
heudex = HeuristicsDisplayEx(OriginPoint=Point(0, 0, 0), AssemblyObjectsSet=data_2, HeuristicsString=heuw, XSize=1, YSize=1, NRows=10)  # -> AssemblyObjectPairs, CoherencePattern, HeuristicsStringTree, TextBasePoints, XData
cull = CullPattern(List=flatten(heudex.HeuristicsStringTree), CullPattern=flatten(heudex.CoherencePattern))

# ---- group: load heuristics from file
prefix_for_selection = Panel("04-02*")
f_dirread = DirectoryReader(DirectoryPath=concat)  # -> FileList, SubdirList
tmatch = MatchText(Text=f_dirread.FileList, Pattern=prefix_for_selection, Case=True)
cull_2 = CullPattern(List=f_dirread.FileList, CullPattern=tmatch)
concat_2 = Concatenate(FragmentA=concat, FragmentB=cull_2)
file = ReadFile(File=concat_2, PerLineParse=True)

# ---- group: save heuristics to file / compose filename
join = TextJoin(Text=int, Join="-")
prefix = Panel("04-02_")
extension = Panel(".txt")
concat_3 = Concatenate(FragmentE=prefix, FragmentA=panel_4, FragmentB="_", FragmentC=join, FragmentD=extension)

# ---- group: save heuristics to file
txt = Text(cull)
save = Button()
file_name = Panel(concat_3)
f_str2file = SaveStringToFile(String=txt, FilePath=concat, FileName=concat_3, SaveTrigger=save)

# ----
heuristics_mode = ValueList({"manual": 0, "field driven": 1}, selected="field driven")

# ---- group: manual selection (ignored when HeM is field driven)
number_slider_2 = Slider(0, range=0..2)

# ---- group: base point
pt_8 = Point(Point(0, 20, 0))

# ---- group: Heuristics Display
heud = HeuristicDisplay(
    OriginPoint=pt_8,
    AssemblyObjectsSet=data_2,
    HeuristicsString=cull,
    XSize=cell_size,
    YSize=cell_size,
    NRows=Slider(10, range=10..50),
    ShowEdges=show_edges,
    DisplayMode=display)

# ----
heuset = HeuristicsSettings(
    HeuristicsString=file,
    CurrentHeuristics=number_slider_2,
    HeuristicsMode=heuristics_mode,
    ReceiverSelectionMode=0,
    RuleSelectionMode=0)
go = BooleanToggle(False)
step = Button()
resetex = Button()
max_objects = Panel("2000")
exoset = ExogeousSettings(
    EnvironmentMeshes=filter_2,
    EnvironmentMode=1,
    Field=filter,
    FieldScalarThreshold=0.5,
    Sandbox={Plane=PlaneXY(0, 0, 0), X=Domain(-1, 1), Y=Domain(0, 0), Z=Domain(0, 0)})
reset = Button()
pt_9 = Point(Point(-129.8796384, 113.0177957, 0))
# 1 - simulate
xy_4 = XYPlane(Origin=pt_9)

# ---- group: Assemblage Engine Xtended
aoengx = AssemblerEngineX(
    AssemblyObjectsSet=data_2,
    StartingPlane=xy_4,
    StartingObjectType=Slider(0, range=0..2),
    HeuristicsSettings=heuset,
    ExogenousSettings=exoset,
    Go=go,
    Step=step,
    NIterations=Slider(100, range=10..100),
    MaxNObjects=max_objects,
    ResetExogenous=resetex,
    Reset=reset)  # -> Assemblage, AssemblageCount

# ----
n_of_objects = Panel(aoengx.AssemblageCount)

# ---- group: auto-stop
larger = LargerThan(FirstNumber=aoengx.AssemblageCount, SecondNumber=max_objects)  # -> LargerThan, OrEqualTo
f_tas = ToggleAutostop(Toggle=go, Condition=larger.OrEqualTo)

# ----
or = GateOr(A=go, B=step)
display_2 = ValueList({"objects": 0, "occupancy": 1, "type": 2, "sequence": 3, "Z height": 4, "none": 5}, selected="type")
panel_5 = Panel("""AliceBlue
SlateGray
GoldenRod
YellowGreen
DarkKhaki""")
# 2 - analyze/post-process
cluster_2 = Cluster_2(vizmode=display_2, assemblage=aoengx.Assemblage, type_colors=panel_5, stop_and_go_bool=or)  # -> meshes, edges

# ---- group: display components / display edges
previewlw = CustomPreviewLineweights(Geometry=cluster_2.edges, Shader=ColourSwatch(SwatchColor=RGB(0, 0, 0)), Thickness=Slider(1, range=1..3), Absolute=False)

# ---- group: display components
mjoin = MeshJoin(Meshes=cluster_2.meshes)

# ----
unweld = UnweldMesh(Mesh=mjoin, Angle="0")

# ---- group: display components (continued)
preview = CustomPreview(Geometry=unweld, Material=ColourSwatch(SwatchColor=RGB(255, 255, 255)))

# ==== cluster Cluster
environment_meshes = ClusterInput()
colours = ClusterInput()  # First Colour for obstacles, second for containers
normal_size = ClusterInput()
volume = MeshVolume(Mesh=environment_meshes)  # -> Volume, Centroid
smaller = SmallerThan(FirstNumber=volume.Volume, SecondNumber=0)  # -> SmallerThan, OrEqualTo
panel = Panel("""3
1""")
item = ListItem(List=colours, Index=graft(smaller.SmallerThan), Wrap=True)
item_2 = ListItem(List=panel, Index=graft(smaller.SmallerThan), Wrap=True)
medges = MeshEdges(Mesh=environment_meshes)  # -> NakedEdges, InteriorEdges, NonManifoldEdges
facen = FaceNormals(Mesh=environment_meshes)  # -> Centers, Normals
multiplication = Multiplication(A=facen.Normals, B=normal_size)
previewlw = CustomPreviewLineweights(Geometry=medges.InteriorEdges, Shader=graft(item), Thickness=graft(item_2), Absolute=False)
vdisex = VectorDisplayEx(Point=facen.Centers, Vector=multiplication, Colour=graft(item), Width=2)

# ==== cluster Cluster_2
vizmode = ClusterInput()
assemblage = ClusterInput()
type_colors = ClusterInput()
stop_and_go_bool = ClusterInput()
aoadecon = DeconstructAssemblage(Assemblage=assemblage)  # -> AssemblageObjects, AssemblageRules, ReceiverObjectsIndexes, AvailableObjectIndexes, UnreachableObjectIndexes
filter = StreamFilter(Gate=stop_and_go_bool, Stream0=assemblage)
gate = StreamGate(Stream=aoadecon.AssemblageObjects, Gate=stop_and_go_bool)  # -> Target0, Target1
aoset = ExtractAOSet(Assemblage=filter)
gate_2 = StreamGate(Stream=gate.Target0, Gate=vizmode)  # -> Target0, Target1, Target2, Target3, Target4, Target5
aocmesh = ExtractCollisionMesh(AssemblyObject=aoset)
f_mseea = MeshExtractEdgesWithToleranceAngle(Mesh=aocmesh, Angle="45")  # -> InternalEdges, NakedEdges

# ---- group: extract object type
aotype = ExtractType(AssemblyObject=gate.Target0)

# ----
aocmesh_2 = ExtractCollisionMesh(AssemblyObject=gate_2.Target3)
aocmesh_3 = ExtractCollisionMesh(AssemblyObject=gate_2.Target2)
aocmesh_4 = ExtractCollisionMesh(AssemblyObject=gate_2.Target1)
aocmesh_5 = ExtractCollisionMesh(AssemblyObject=gate_2.Target4)
group = Group(Objects=f_mseea.InternalEdges)  # -> flatten(Group)
lng = ListLength(List=aocmesh_4)
aoplane = ExtractReferencePlane(AssemblyObject=aoset)
aoplane_2 = ExtractReferencePlane(AssemblyObject=gate_2.Target4)
repeat = RepeatData(Data="0", Length=lng)

# ---- group: display by assemblage sequence
lng_2 = ListLength(List=aocmesh_2)  # -> expr("x-1", Length)
f_ifroml = IndexesFromList(D=aocmesh_2)  # -> i; inputs D: list
# ---------- f_ifroml: C# usings ----------
using System.Linq;
# ---------- f_ifroml: C# ----------
   
 /*
    froGH - a sparse collection of (in)utilities for Grasshopper

    Indexes from Number
    code by Alessio Erioli

    froGH by Co-de-iT is licensed under a Creative Commons Attribution 4.0 International License.
    http://creativecommons.org/licenses/by/4.0/

    */
    initComp();
   
    GH_Integer[] indexes = new GH_Integer[D.Count];

    for(int j = 0; j < D.Count; j++)
      indexes[j] = new GH_Integer(j);

    //A = indexes.Sum(j => j.Value); // uses System.Linq Sum selector function - for each GH_Integer j in indexes add its value to the total sum

    i = indexes;
# ---------- f_ifroml: C# additional code ----------
  void initComp(){
    Component.Name = "Indexes from List";
    Component.NickName = "f_iFromL";
    Component.Description = "Generates a list of 0-based integer indexes from a given list of data";
    Component.Params.Input[0].Name = "Data";
    Component.Params.Input[0].Description = "the list to index";
    Component.Params.Output[0].Name = "Indexes";
    Component.Params.Output[0].Description = "the generated indexes";
  }
# ---------- end f_ifroml ----------
one_over_x = OneOverX(Value=lng_2)
multiplication = Multiplication(A=f_ifroml, B=one_over_x)
sqr = Square(Value=multiplication)
gradient = Gradient(
    LowerLimit=0,
    UpperLimit=1,
    Parameter=sqr,
    stops=[0: RGB(0, 0, 0), 0.498: RGB(56, 136, 150), 0.904: RGB(186, 224, 224), 1: RGB(255, 255, 255)])
mcol = MeshColours(Mesh=graft(aocmesh_2), Colours=graft(gradient))  # -> flatten(Mesh)

# ----
filter_2 = StreamFilter(Gate=stop_and_go_bool, Stream0=aotype)
pdecon = Deconstruct(Point=aoplane_2)  # -> XComponent, YComponent, ZComponent
aoplane_3 = ExtractReferencePlane(AssemblyObject=gate.Target0)
item = ListItem(List=group, Index=filter_2, Wrap=True)
item_2 = ListItem(List=aoplane, Index=filter_2, Wrap=True)
replace = ReplaceItems(List=repeat, Item="1", Indices=aoadecon.AvailableObjectIndexes, Wrap=False)
bnd = Bounds(Numbers=pdecon.ZComponent)
replace_2 = ReplaceItems(List=replace, Item="2", Indices=aoadecon.UnreachableObjectIndexes, Wrap=False)
orient = Orient(Geometry=item, Source=item_2, Target=aoplane_3)  # -> Geometry, Transform
remap = RemapNumbers(Value=pdecon.ZComponent, Source=bnd, Target=Domain(0, 1))  # -> Mapped, Clipped

# ---- group: occupied/available visualization
saturated = ColourSwatch(SwatchColor=RGB(112, 117, 57))
available = ColourSwatch(SwatchColor=RGB(255, 255, 255))
unreachable = ColourSwatch(SwatchColor=RGB(194, 199, 137))
weave = Weave(Pattern=graft(replace_2), Stream0=saturated, Stream1=available, Stream2=unreachable, NullGaps=False)  # -> simplify(Weave)
mcol_2 = MeshColours(Mesh=graft(aocmesh_4), Colours=weave)  # -> flatten(Mesh)

# ----
gradient_2 = Gradient(
    LowerLimit=0,
    UpperLimit=1,
    Parameter=remap.Mapped,
    stops=[0: RGB(21, 0, 33), 0.326: RGB(150, 66, 114), 0.664: RGB(224, 186, 187), 1: RGB(255, 255, 255)])
ungroup = Ungroup(Group=orient.Geometry)  # -> flatten(Objects)
item_3 = ListItem(List=type_colors, Index=graft(aotype), Wrap=True)  # -> simplify(Item)
aocmesh_6 = ExtractCollisionMesh(AssemblyObject=gate_2.Target0)
aocmesh_7 = ExtractCollisionMesh(AssemblyObject=gate.Target1)
filter_3 = StreamFilter(Gate=stop_and_go_bool, Stream0=ungroup)

# ---- group: display by component type
mcol_3 = MeshColours(Mesh=graft(aocmesh_3), Colours=item_3)  # -> flatten(Mesh)

# ----
mcol_4 = MeshColours(Mesh=graft(aocmesh_5), Colours=graft(gradient_2))  # -> flatten(Mesh)
filter_4 = StreamFilter(Gate=vizmode, Stream0=aocmesh_6, Stream1=mcol_2, Stream2=mcol_3, Stream3=mcol, Stream4=mcol_4)
filter_5 = StreamFilter(Gate=stop_and_go_bool, Stream0=filter_4, Stream1=aocmesh_7)
meshes = ClusterOutput(filter_5)
edges = ClusterOutput(filter_3)
