# Grasshopper definition Filter duplicate blocks.gh (Grasshopper 1.0.7)
# Copyright: Co-de-iT
# plug-ins: EleFront

listblockd = ListBlockDocument()
# NOTE: Selelct ONE block name at a time!!!
number_slider = Slider(0, range=0..10)
block_names_in_the_rhino_file = Panel(listblockd)
item = ListItem(List=listblockd, Index=number_slider, Wrap=True)
# update when changing block name
refblock = ReferenceBlockByName(BlockName=item)
# <title>
# 
# <description>
# 
# code by Alessio Erioli
# 
# v 0.1
# © Co-de-iT 2020 / Creative Commons Attribution-Non Commercial-ShareAlike 4.0 International License
deblock = DeconstructBlock(Block=refblock)  # -> Name, flatten(Plane), Geometry
cullpt = CullDuplicates(Points=deblock.Plane, Tolerance=0.1, CullMode=1)  # -> Points, Indices, Valence

# ----
# move all single instances to a new position (adjust to your conveninence)
item_2 = ListItem(List=deblock.Plane, Index=cullpt.Indices, Wrap=True)
X = UnitX(Factor="-500")
move = Move(Geometry=item_2, Motion=X)  # -> Geometry, Transform

# ----
# bake ONCE, then deactivate toggle and select the next block name to filter duplicates
bake = BooleanToggle(False)
inblock = InsertBlock(BlockName=item, SourcePlane=move.Geometry)
bake_2 = BakeObjects(Geometry=inblock, Bake=bake)
