# Grasshopper definition check rules-objects.gh (Grasshopper 1.0.7)
# Copyright: Co-de-iT
# plug-ins: Assembler

aoadecon = DeconstructAssemblage()  # -> AssemblageObjects, AssemblageRules, ReceiverObjectsIndexes, AvailableObjectIndexes, UnreachableObjectIndexes
text_size = Slider(100, range=0..100)
zoom_align = BooleanToggle(True)
number_slider = Slider(173, range=0..200)
cull_i = CullIndex(List=aoadecon.AssemblageObjects, Indices="0", Wrap=True)
aocmesh = ExtractCollisionMesh(AssemblyObject=cull_i)
item = ListItem(List=aocmesh, Index=number_slider, Wrap=True)
# <title>
# 
# <description>
# 
# code by Alessio Erioli
# 
# v 0.1
# © Co-de-iT 2020 / Creative Commons Attribution-Non Commercial-ShareAlike 4.0 International License
item_2 = ListItem(List=cull_i, Index=number_slider, Wrap=True)
item_3 = ListItem(List=aoadecon.AssemblageRules, Index=number_slider, Wrap=True)
multiplication = Multiplication(A=text_size, B="0.5")
aoplane = ExtractReferencePlane(AssemblyObject=item_2)
f_o2cam = OrientToCamera(Pt=aoplane, refresh=zoom_align)  # -> P; inputs Pt: Point3d, refresh: Boolean
#   port refresh: true to refresh button: manual refresh toggle + timer: auto refresh
# ---------- f_o2cam: C# ----------
                              /*
    froGH - a sparse collection of (in)utilities for Grasshopper

    Orient to Camera
    code by Alessio Erioli

    froGH by Co-de-iT is licensed under a Creative Commons Attribution 4.0 International License.
    http://creativecommons.org/licenses/by/4.0/

    */

    initComp();

    Plane p;

    if (RhinoDoc.ActiveDoc.Views.ActiveView.ActiveViewport.GetCameraFrame(out p)){
      P = new Plane(new Point3d(Pt.X, Pt.Y, Pt.Z), p.XAxis, p.YAxis);
    }
# ---------- f_o2cam: C# additional code ----------
  void initComp(){
    Component.Name = "Orient to Camera";
    Component.NickName = "f_O2Cam";
    Component.Description = "Creates a plane on the input point aligned with current camera";
    Component.Message = RhinoDoc.ActiveDoc.Views.ActiveView.ActiveViewport.Name;
    Component.Params.Input[0].Name = "Base Point";
    Component.Params.Input[0].Description = "Base point for new plane";
    Component.Params.Input[1].Name = "Refresh";
    Component.Params.Input[1].Description = "true to refresh \nbutton: manual refresh \ntoggle + timer: auto refresh";
    Component.Params.Output[0].Name = "Plane";
    Component.Params.Output[0].Description = "Camera Aligned Plane";
  }
# ---------- end f_o2cam ----------
addition = Addition(A=number_slider, B="1")
f_ztoobj = ZoomToObject(go=zoom_align, G=item)  # inputs go: Boolean, G: list of GeometryBase, inflate: Double
# ---------- f_ztoobj: C# ----------
        /*
    froGH - a sparse collection of (in)utilities for Grasshopper

    Zoom To Object

    code by Alessio Erioli

    froGH by Co-de-iT is licensed under a Creative Commons Attribution 4.0 International License.
    http://creativecommons.org/licenses/by/4.0/

    */

    initComp();
  
    if (!go || G == null) return;
    
    //Get current viewport
    vp = Rhino.RhinoDoc.ActiveDoc.Views.ActiveView.ActiveViewport;
    // zoom to object bounding box

    BoundingBox bb, bTemp;// = G.GetBoundingBox(false);
    bb = G[0].GetBoundingBox(false);
    for(int i = 1; i < G.Count; i++)
    {
      bTemp = G[i].GetBoundingBox(false);
      bb.Union(bTemp);
    }
    bb.Inflate(bb.Diagonal.Length * inflate);
    vp.ZoomBoundingBox(bb);
# ---------- f_ztoobj: C# additional code ----------
  //To get and set camera properties
  Rhino.Display.RhinoViewport vp;
  
  void initComp(){
    Component.Name = "Zoom To Object";
    Component.NickName = "f_ZToObj";
    Component.Description = "Zoom Rhino camera to object";
    Component.Params.Input[0].Name = "Go";
    Component.Params.Input[0].Description = "Activate Zoom";
    Component.Params.Input[1].Name = "Geometry";
    Component.Params.Input[1].Description = "Geometry to Zoom onto";
    Component.Params.Input[2].Name = "Inflate";
    Component.Params.Input[2].Description = "Inflate Geometry Bounding Box (zooms out)";
  }
# ---------- end f_ztoobj ----------
tag = TextTag3D(Location=f_o2cam, Text=item_3, Size=multiplication, Colour=ColourSwatch(SwatchColor=RGB(255, 255, 255)), Justification=2)
tag_2 = TextTag3D(Location=f_o2cam, Text=addition, Size=text_size, Colour=ColourSwatch(SwatchColor=RGB(0, 0, 0)), Justification=8)
