# Grasshopper definition filter handles - by type.gh (Grasshopper 1.0.7)
# Copyright: Co-de-iT
# plug-ins: Assembler

assemblyobjects = Relay()
# <title>
# 
# <description>
# 
# code by Alessio Erioli
# 
# v 0.1
# © Co-de-iT 2020 / Creative Commons Attribution-Non Commercial-ShareAlike 4.0 International License
aodecon = DeconstructAssemblyObject(AssemblyObject=assemblyobjects)  # -> Name, CollisionMesh, ReferencePlane, Direction, Weight, OccludedNeighbours, Handles, Children
handecon = DeconstructHandle(Handle=aodecon.Handles)  # -> SenderPlane, ReceiverPlanes, ReceiverPlanesRotations, HandleType, HandleWeight, HandleOccupancy, NeighbourObject, NeighbourHandle
# replace with your target type
target_type = Panel("1")
equals = Equality(FirstNumber=handecon.HandleType, SecondNumber=target_type)  # -> Equality, Inequality
dispatch = Dispatch(List=aodecon.Handles, DispatchPattern=equals.Equality)  # -> ListA, ListB
# Filtered handles for selected type
handecon_2 = DeconstructHandle(Handle=dispatch.ListA)  # -> SenderPlane, ReceiverPlanes, ReceiverPlanesRotations, HandleType, HandleWeight, HandleOccupancy, NeighbourObject, NeighbourHandle
pln = Plane(handecon_2.SenderPlane)
