# Grasshopper definition filter handles - topology.gh (Grasshopper 1.0.7)
# Copyright: Co-de-iT
# plug-ins: Human, Weaverbird, Assembler, froGH, Shortest Walk in Gh

assemblage = Relay()
aoadecon = DeconstructAssemblage(Assemblage=assemblage)  # -> AssemblageObjects, AssemblageRules, ReceiverObjectsIndexes, AvailableObjectIndexes, UnreachableObjectIndexes

# ---- group: Assemblage topology
# hO - handle occupancy (0 = free,  = connected, -1 = occluded)
# 
# nC - neighbour Object index
# 
# nH - neighbour component handle index
aotopo = ExtractTopology(Assemblage=assemblage)  # -> HandleOccupancy, NeighbourObjectIndex, NeighbourHandleIndex

# ----
occupancy = ValueList({"free": 0, "connected": 1, "occluded": -1}, selected="free")
# <title>
# 
# <description>
# 
# code by Alessio Erioli
# 
# v 0.1
# © Co-de-iT 2020 / Creative Commons Attribution-Non Commercial-ShareAlike 4.0 International License
panel = Panel(aotopo.HandleOccupancy)

# ---- group: extract sender handle plane
aosp = ExtractSenderHandlesPlanes(AssemblyObject=aoadecon.AssemblageObjects)

# ---- group: extract reference plane
aoplane = ExtractReferencePlane(AssemblyObject=aoadecon.AssemblageObjects)

# ----
equals = Equality(FirstNumber=aotopo.HandleOccupancy, SecondNumber=occupancy)  # -> Equality, Inequality
ln = Line(StartPoint=graft(aoplane), EndPoint=aosp)

# ---- group: filter handles sender planes
cull = CullPattern(List=aosp, CullPattern=equals.Equality)  # -> simplify(List)

# ----
line = Line(flatten(ln))
pln = Plane(cull)

# ---- group: planes at non-connected handles
# operation on filtered handles
number_slider = Slider(250, range=0..300)
f_cdom = CenteredDomain(DomainLength=number_slider)
planesrf = PlaneSurface(Plane=pln, XSize=f_cdom, YSize=Slider(280, range=10..500))
mplane = MeshPlane(Boundary=planesrf, WidthCount="1", HeightCount="1")  # -> Mesh, Area

# ----
thickness = Slider(0.05, range=0..0.2)
clean = CleanTree(RemoveNulls="true", RemoveInvalid="true", RemoveEmpty="true", Tree=simplify(mplane.Mesh))
wbthicken = WeaverbirdsMeshThicken(MeshCurves=clean, Distance=thickness, OffsetType=0)
pshift = ShiftPaths(Data=wbthicken, Offset=-1)

# ----
# An example of post-assemblage operation:
# 
# . locate all non-connected handles
# . draw a panel in their locaiton
preview = CustomPreview(Geometry=pshift, Material=ColourSwatch(SwatchColor=RGB(191, 255, 0)))  # disabled

# ---- group: shortest path workflows
number_slider_2 = Slider(2, range=2..1000)
bbox = BoundingBox(Content=line, Plane=PlaneXY(0, 0, 0), UnionBox=True)  # -> Box, Box_2
pop3d = Populate3D(Region=bbox.Box, Count=number_slider_2, Seed=1)
multiplication = Multiplication(A=number_slider_2, B="0.5")
split = SplitList(List=pop3d, Index=multiplication)  # -> ListA, ListB
jitter = Jitter(List=split.ListB, Jitter=1, Seed=2)  # -> Values, Indices
ln_2 = Line(StartPoint=split.ListA, EndPoint=jitter.Values)
shortwalk = ShortestWalk(Curves=line, WantedPath=ln_2)  # -> ShortestWalk, Succession, Direction, Length

# ---- group: objects involved in shortest path
f_ifroml = IndexesFromList(Data=line)
unflatten = UnflattenTree(Tree=f_ifroml, Guide=ln)
mindex = MemberIndex(Set=unflatten, Member=shortwalk.Succession)  # -> Index, simplify(Count)
ma = MassAddition(Input=mindex.Count)  # -> Result, PartialResults
larger = LargerThan(FirstNumber=ma.Result, SecondNumber="0")  # -> flatten(LargerThan), OrEqualTo
f_ifroml_2 = IndexesFromList(Data=larger.LargerThan)
cull_2 = CullPattern(List=f_ifroml_2, CullPattern=larger.LargerThan)

# ---- group: shortest path workflows / determine frequency
cset = CreateSet(List=flatten(shortwalk.Succession))  # -> Set, Map
mindex_2 = MemberIndex(Set=flatten(shortwalk.Succession), Member=cset.Set)  # -> Index, Count

# ---- group: shortest path workflows / remap by length
bnd = Bounds(Numbers=shortwalk.Length)
remap = RemapNumbers(Value=shortwalk.Length, Source=bnd, Target=Domain(0, 1))  # -> Mapped, Clipped

# ---- group: shortest path workflows / remap by frequency
bnd_2 = Bounds(Numbers=mindex_2.Count)
remap_2 = RemapNumbers(Value=mindex_2.Count, Source=bnd_2, Target=Domain(0, 1))  # -> Mapped, Clipped

# ---- group: shortest path workflows (continued)
item = ListItem(List=line, Index=cset.Set, Wrap=True)
gradient = Gradient(LowerLimit=0, UpperLimit=1, Parameter=remap_2.Mapped, stops=[0: RGB(255, 255, 255), 1: RGB(187, 0, 255)])
previewlw = CustomPreviewLineweights(Geometry=item, Shader=gradient, Thickness=Slider(3, range=1..3), Absolute=False)
