# Grasshopper definition random place people.gh (Grasshopper 1.0.7)
# Copyright: Co-de-iT
# plug-ins: MeshEdit Components, EleFront

mesh = Mesh(<mesh referenced from the Rhino model>)
explode = MeshExplode(Mesh=mesh, Interpolate=False)
facen = FaceNormals(Mesh=explode)  # -> flatten(Centers), flatten(Normals)

# ---- group: pick horizontal faces, normals up
Z = UnitZ(Factor=1)
angle = Angle(VectorA=facen.Normals, VectorB=Z)  # -> Angle, Reflex
smaller = SmallerThan(FirstNumber=angle.Angle, SecondNumber="0.005")  # -> SmallerThan, OrEqualTo

# ---- group: area threshold
area = MeshArea(Mesh=explode)  # -> Area, Centroid
# blocks will be placed on surfaces of area greater than this amount
panel = Panel("10")
larger = LargerThan(FirstNumber=area.Area, SecondNumber=panel)  # -> LargerThan, OrEqualTo

# ----
and = GateAnd(A=smaller.SmallerThan, B=larger.LargerThan)

# ---- group: select faces and random reduce
number_slider = Slider(250, range=0..1000)
# <title>
# 
# <description>
# 
# code by Alessio Erioli
# 
# v 0.1
# © Co-de-iT 2020 / Creative Commons Attribution-Non Commercial-ShareAlike 4.0 International License
cull = CullPattern(List=explode, CullPattern=and)
cull_2 = CullPattern(List=facen.Centers, CullPattern=and)
reduce = RandomReduce(List=cull, Reduction=number_slider, Seed=1)
reduce_2 = RandomReduce(List=cull_2, Reduction=number_slider, Seed=1)

# ---- group: randomize rotation and displacement from center
lng = ListLength(List=reduce)
xy = XYPlane(Origin=reduce_2)
random = Random(Range="0 to 2*Pi", Number=lng, Seed=2, Integers=False)
displace_amount = Slider(0.961, range=0..1)
prot = RotatePlane(Plane=xy, Angle=random)
deplane = DeconstructPlane(Plane=prot)  # -> Origin, XAxis, YAxis, ZAxis
multiplication = Multiplication(A=deplane.XAxis, B=displace_amount)
move = Move(Geometry=prot, Motion=multiplication)  # -> Geometry, Transform

# ----
names_of_blocks_to_place = Panel("""Umarell
Zdoura""")
lng_2 = ListLength(List=reduce)
random_2 = Random(Range=Domain(0, 1), Number=lng_2, Seed=2, Integers=True)
item = ListItem(List=names_of_blocks_to_place, Index=random_2, Wrap=True)

# ---- group: summon blocks and bake them
bake = BooleanToggle(False)
inblock = InsertBlock(BlockName=item, SourcePlane=move.Geometry)
bake_2 = BakeObjects(Geometry=inblock, Bake=bake)
