# Grasshopper definition shortest walk - AO connections.gh (Grasshopper 1.0.7)
# Copyright: Co-de-iT
# plug-ins: Human, Assembler, froGH, Shortest Walk in Gh

assemblage = Relay()
# <title>
# 
# <description>
# 
# code by Alessio Erioli
# 
# v 0.1
# © Co-de-iT 2020 / Creative Commons Attribution-Non Commercial-ShareAlike 4.0 International License
# shortest walk - AssemblyObjects connections
aoadecon = DeconstructAssemblage(Assemblage=assemblage)  # -> AssemblageObjects, AssemblageRules, ReceiverObjectsIndexes, AvailableObjectIndexes, UnreachableObjectIndexes

aoplane = ExtractReferencePlane(AssemblyObject=aoadecon.AssemblageObjects)  # -> graft(ReferencePlane)
aosp = ExtractSenderHandlesPlanes(AssemblyObject=aoadecon.AssemblageObjects)
ln = Line(StartPoint=aoplane, EndPoint=aosp)
line = Line(flatten(ln))
explode = Explode(Curve=line, Recursive=True)  # -> Segments, flatten(Vertices)
pt = Point(Point(-10111.39819, 13484.86082, 1812.792861))
pt_2 = Point(Point(-13319.67027, 14021.5373, -3440.70407))
cp = ClosestPoint(Point=pt, Cloud=explode.Vertices)  # -> ClosestPoint, CPIndex, Distance
cp_2 = ClosestPoint(Point=pt_2, Cloud=explode.Vertices)  # -> ClosestPoint, CPIndex, Distance
ln_2 = Line(StartPoint=cp.ClosestPoint, EndPoint=cp_2.ClosestPoint)
shortwalk = ShortestWalk(Curves=line, WantedPath=ln_2)  # -> ShortestWalk, Succession, Direction, Length
previewlw = CustomPreviewLineweights(Geometry=shortwalk.ShortestWalk, Shader=ColourSwatch(SwatchColor=RGB(255, 212, 0)), Thickness="5", Absolute=False)

# ---- group: extract indexes of involved objects
f_ifroml = IndexesFromList(Data=line)
unflatten = UnflattenTree(Tree=f_ifroml, Guide=ln)
mindex = MemberIndex(Set=unflatten, Member=shortwalk.Succession)  # -> Index, Count
f_massbool = MassBoolean(Values=mindex.Count, BooleanOperator="1", Boolean_operator=1)  # -> flatten(Result)

# ----
aocmesh = ExtractCollisionMesh(AssemblyObject=aoadecon.AssemblageObjects)
dispatch = Dispatch(List=aocmesh, DispatchPattern=f_massbool)  # -> ListA, ListB
preview = CustomPreview(Geometry=dispatch.ListA, Material=ColourSwatch(SwatchColor=RGB(255, 244, 186)))
