# Grasshopper definition show Handles occupancy.gh (Grasshopper 1.0.7)
# Copyright: Co-de-iT
# plug-ins: Human, Assembler

assemblage = Relay()

# ---- group: Show Handles Occupancy status
aotopo = ExtractTopology(Assemblage=assemblage)  # -> HandleOccupancy, NeighbourObjectIndex, NeighbourHandleIndex
aoadecon = DeconstructAssemblage(Assemblage=assemblage)  # -> AssemblageObjects, AssemblageRules, ReceiverObjectsIndexes, AvailableObjectIndexes, UnreachableObjectIndexes
aosp = ExtractSenderHandlesPlanes(AssemblyObject=aoadecon.AssemblageObjects)
occluded = ColourSwatch(SwatchColor=RGB(255, 0, 0))
available = ColourSwatch(SwatchColor=RGB(255, 255, 255))
connected = ColourSwatch(SwatchColor=RGB(58, 222, 47))
deplane = DeconstructPlane(Plane=aosp)  # -> Origin, XAxis, YAxis, ZAxis
merge = Merge(Data1=available, Data2=connected, Data3=occluded)
# <title>
# 
# <description>
# 
# code by Alessio Erioli
# 
# v 0.1
# © Co-de-iT 2020 / Creative Commons Attribution-Non Commercial-ShareAlike 4.0 International License
line = LineSDL(Start=aosp, Direction=deplane.ZAxis, Length=Slider(93.487, range=0..1000))
item = ListItem(List=merge, Index=aotopo.HandleOccupancy, Wrap=True)
previewlw = CustomPreviewLineweights(Geometry=line, Shader=item, Absolute=False)
