# Grasshopper definition stop at density.gh (Grasshopper 1.0.7)
# Copyright: Co-de-iT
# plug-ins: MeshEdit Components, Assembler

container_mesh = Relay()
assemblage = Relay()
aoadecon = DeconstructAssemblage(Assemblage=assemblage)  # -> AssemblageObjects, AssemblageRules, ReceiverObjectsIndexes, AvailableObjectIndexes, UnreachableObjectIndexes; disabled
# © Co-de-iT 2020 / Creative Commons Attribution-Non Commercial-ShareAlike 4.0 International License
aocmesh = ExtractCollisionMesh(AssemblyObject=aoadecon.AssemblageObjects)
scale = Panel("0.00001")
# <title>
# 
# <description>
# 
# code by Alessio Erioli
# 
# v 0.1
volume = MeshVolume(Mesh=aocmesh)  # -> Volume, Centroid
volume_2 = MeshVolume(Mesh=container_mesh)  # -> Volume, Centroid
multiplication = Multiplication(A=volume.Volume, B=scale)
multiplication_2 = Multiplication(A=volume_2.Volume, B=scale)
ma = MassAddition(Input=multiplication)  # -> Result, PartialResults
division = Division(A=ma.Result, B=multiplication_2)
panel = Panel(volume_2.Volume)
target_density = Slider(0.25, range=0..1)
panel_2 = Panel(ma.Result)
panel_3 = Panel(division)
larger = LargerThan(FirstNumber=division, SecondNumber=target_density)  # -> LargerThan, OrEqualTo

# ---- group: condition for Toggle Autostop
bool = Boolean(larger.LargerThan)
