# Grasshopper definition 01-02_AssemblyObject 2 objects setup custom rot.gh (Grasshopper 1.0.7)
# Copyright: Co-de-iT
# plug-ins: Assembler

# ---- group: type 1 - square
crv = Curve([<curve referenced from the Rhino model> x3])

# ---- group: type 2 - rectangle
crv_2 = Curve([<curve referenced from the Rhino model> x2])

# ---- group: type 3 - triangle
crv_3 = Curve([<curve referenced from the Rhino model> x4])

# ---- group: type 1 - square
crv_4 = Curve([<curve referenced from the Rhino model> x4])

# ---- group: type 2 - rectangle
crv_5 = Curve([<curve referenced from the Rhino model> x2])

# ----
rotations = Panel("""0
180""")
lng = ListLength(List=crv_2)
weight = Panel("0")
repeat = RepeatData(Data=graft(rotations), Length=lng)
flip = FlipMatrix(Data=repeat)  # -> simplify(Data)
repeat_2 = RepeatData(Data=weight, Length=lng)

rotations_2 = Panel("""0
90
180""")
lng_2 = ListLength(List=crv)
type = Panel("1")
weight_2 = Panel("0")
repeat_3 = RepeatData(Data=graft(rotations_2), Length=lng_2)
repeat_4 = RepeatData(Data=graft(type), Length=lng_2)
flip_2 = FlipMatrix(Data=repeat_3)  # -> simplify(Data)
repeat_5 = RepeatData(Data=weight_2, Length=lng_2)

merge = Merge(Data1=crv_4, Data2=crv_5)
rotations_3 = Panel("""0
180""")
lng_3 = ListLength(List=merge)
type_2 = Panel("""1
1
1
1
2
2""")
repeat_6 = RepeatData(Data=graft(rotations_3), Length=lng_3)
weight_3 = Panel("0")
flip_3 = FlipMatrix(Data=repeat_6)  # -> simplify(Data)
repeat_7 = RepeatData(Data=weight_3, Length=lng_3)

rotations_4 = Panel("-90")
lng_4 = ListLength(List=crv_3)
weight_4 = Panel("0")
repeat_8 = RepeatData(Data=graft(rotations_4), Length=lng_4)
flip_4 = FlipMatrix(Data=repeat_8)  # -> simplify(Data)
repeat_9 = RepeatData(Data=weight_4, Length=lng_4)

type_3 = Panel("2")
type_4 = Panel("3")
repeat_10 = RepeatData(Data=graft(type_3), Length=lng)
repeat_11 = RepeatData(Data=graft(type_4), Length=lng_4)

# ---- group: Create Handles
handle = ConstructHandle(Polyline=crv_2, RotationAngles=flip, Type=repeat_10, Weight=repeat_2)

# Assembler
# 
# Framework for Iterative Assemblages workflow
# 
# code by Alessio Erioli
# 
# v 1.0
# © Co-de-iT 2020 / Creative Commons Attribution-Non Commercial-ShareAlike 4.0 International License
handle_2 = ConstructHandle(Polyline=crv, RotationAngles=flip_2, Type=repeat_4, Weight=repeat_5)

handle_3 = ConstructHandle(Polyline=crv_3, RotationAngles=flip_4, Type=repeat_11, Weight=repeat_9)

handle_4 = ConstructHandle(Polyline=merge, RotationAngles=flip_3, Type=type_2, Weight=repeat_7)

# ----
model_abs_size = BooleanToggle(True)
merge_2 = Merge(Data1=flatten(handle_2), Data2=flatten(handle), Data3=flatten(handle_3))

# ---- group: Display Handles
handdisp = DisplayHandle(Handles=handle_4, DisplaySize=Slider(7.261, range=0..10), ModelScreenSize=model_abs_size)

# ----
mesh = Mesh(<mesh referenced from the Rhino model>)
volume = Volume(Geometry=mesh)  # -> Volume, Centroid
name = Panel("blockB")
xy = XYPlane(Origin=volume.Centroid)
X = UnitX(Factor=1)

mesh_2 = Mesh(<mesh referenced from the Rhino model>)
volume_2 = Volume(Geometry=mesh_2)  # -> Volume, Centroid
name_2 = Panel("blockA")
xy_2 = XYPlane(Origin=volume_2.Centroid)
X_2 = UnitX(Factor=1)

crv_6 = Curve([<curve referenced from the Rhino model> x12])
pt = Point([<point referenced from the Rhino model> x7])
brep = Brep([<brep referenced from the Rhino model> x7])
merge_3 = Merge()
xdcon = ConstructXData(Label="blockB body", Data=merge_3, ReferencePlane=xy, AssemblyObjectNameReference=name)

crv_7 = Curve()
pt_2 = Point()
brep_2 = Brep()
merge_4 = Merge()
xdcon_2 = ConstructXData(Label="blockA body", Data=merge_4, ReferencePlane=xy_2, AssemblyObjectNameReference=name_2)

model_abs_size_2 = BooleanToggle(True)

# ---- group: Create AssemblyObject
aocon = ConstructAssemblyObject(Name=name_2, CollisionMesh=mesh_2, ReferencePlane=xy_2, Direction=X_2, Weight="1.0", Handles=merge_2)

aocon_2 = ConstructAssemblyObject(Name=name, CollisionMesh=mesh, ReferencePlane=xy, Direction=X, Weight="1.0", Handles=handle_4)

# ---- group: Display Handles
handdisp_2 = DisplayHandle(Handles=merge_2, DisplaySize=Slider(7.261, range=0..10), ModelScreenSize=model_abs_size_2)

# ----
merge_5 = Merge(Data1=flatten(xdcon_2), Data2=flatten(xdcon))
merge_6 = Merge(Data1=flatten(aocon), Data2=flatten(aocon_2))

self_object = BooleanToggle(True)
self_handle = BooleanToggle(True)
cross_type = BooleanToggle(False)
heuw = HeuristicsWriter(
    AssemblyObjectsSet=merge_6,
    AllowSelfObjectConnections=self_object,
    AllowSelfHandleConnections=self_handle,
    AllowCrossTypeConnections=cross_type)

display = ValueList({"by Type": 0, "by s/r status": 1}, selected="by s/r status")
number_slider = Slider(1.2, range=1..2)
pt_3 = Point(Point(0, 1500, 0))
heuristics_rules = Panel(heuw)

# ---- group: Heuristics Display
heud = HeuristicDisplay(
    OriginPoint=pt_3,
    AssemblyObjectsSet=merge_6,
    HeuristicsString=heuw,
    XSize=number_slider,
    YSize=number_slider,
    NRows=Slider(10, range=10..50),
    ShowEdges=Toggle(True),
    DisplayMode=display)

# ----
# receiver rotation angle (in degrees)
# receiver Handle index
# sender Handle index
# rule integer Weight
# receiver Object name
# sender Object name
# rO | rH = rHA < sO | sH % r_iWeight
panel = Panel("rName|1=90<sName|3%0")
