# Grasshopper definition 01-07_Assemblage 3 objects handle compatibility.gh (Grasshopper 1.0.7)
# Copyright: Co-de-iT
# plug-ins: Human, Assembler, froGH

# ---- group: type 5
crv = Curve(<curve referenced from the Rhino model>)

# ---- group: type 4
crv_2 = Curve(<curve referenced from the Rhino model>)

# ---- group: type 7
crv_3 = Curve(<curve referenced from the Rhino model>)

# ---- group: type 2
crv_4 = Curve([<curve referenced from the Rhino model> x4])

# ---- group: type 6
crv_5 = Curve(<curve referenced from the Rhino model>)

# ---- group: type 3
crv_6 = Curve([<curve referenced from the Rhino model> x4])

# ---- group: type 1
# 0 - construct
# slab
crv_7 = Curve([<curve referenced from the Rhino model> x4])

# ----
merge = Merge(Data1=flatten(crv_2), Data2=flatten(crv))
merge_2 = Merge(Data1=flatten(crv_7), Data2=flatten(crv_4), Data3=flatten(crv_6))
merge_3 = Merge(Data1=flatten(crv_5), Data2=flatten(crv_3))
panel = Panel(merge_2)

# ----
# column
rotations = Panel("0")
lng = ListLength(List=merge)
type = Panel("""4
5""")
repeat = RepeatData(Data=graft(rotations), Length=lng)
weight = Panel("0")
flip = FlipMatrix(Data=repeat)  # -> simplify(Data)
repeat_2 = RepeatData(Data=weight, Length=lng)

# ----
# ASSEMBLAGES IN BRIEF: GENERAL STEPS
# 
# . choose WHERE to add
# 
# . choose WHAT to add
# 
# 
# PROCESS STEPS
# 
# 
# 
# . select receiver object in the assemblage
# 
# . list all possible combinations of free handles and related compatible candidates
# 
# . choose a winnig candidate according to given criteria
# DEFINITION ANATOMY: 00 - constuct
# 
# Construct the object and relationships necessary for the Assemblage
# 
# 
# 
# 01 - simulate
# 
# Simulate the Assemblage growth
# 
# 
# 
# 02 - analyze/post-process
# 
# Analyze results and post-process the obtained assemblage
rotations_2 = Panel("0")
lng_2 = ListLength(List=merge_2)
repeat_3 = RepeatData(Data=graft(rotations_2), Length=lng_2)
type_2 = Panel("""1
1
1
1
2
2
2
2
3
3
3
3""")
weight_2 = Panel("0")
flip_2 = FlipMatrix(Data=repeat_3)  # -> simplify(Data)
repeat_4 = RepeatData(Data=weight_2, Length=lng_2)

# ----
# stair
rotations_3 = Panel("0")
lng_3 = ListLength(List=merge_3)
type_3 = Panel("""6
7""")
repeat_5 = RepeatData(Data=graft(rotations_3), Length=lng_3)
weight_3 = Panel("0")
flip_3 = FlipMatrix(Data=repeat_5)  # -> simplify(Data)
repeat_6 = RepeatData(Data=weight_3, Length=lng_3)

# ---- group: Create Handles
handle = ConstructHandle(Polyline=merge, RotationAngles=flip, Type=type, Weight=repeat_2)

handle_2 = ConstructHandle(Polyline=merge_2, RotationAngles=flip_2, Type=type_2, Weight=repeat_4)

handle_3 = ConstructHandle(Polyline=merge_3, RotationAngles=flip_3, Type=type_3, Weight=repeat_6)

# ----
model_abs_size = BooleanToggle(True)
model_abs_size_2 = BooleanToggle(True)
model_abs_size_3 = BooleanToggle(True)

mesh = Mesh(<mesh referenced from the Rhino model>)
volume = Volume(Geometry=mesh)  # -> Volume, Centroid
name = Panel("column")
xy = XYPlane(Origin=volume.Centroid)
X = UnitX(Factor=1)

# ----
# Assembler
# 
# Framework for Iterative Assemblages workflow
# 
# code by Alessio Erioli
# 
# v 1.0
# © Co-de-iT 2020 / Creative Commons Attribution-Non Commercial-ShareAlike 4.0 International License
mesh_2 = Mesh(<mesh referenced from the Rhino model>)
volume_2 = Volume(Geometry=mesh_2)  # -> Volume, Centroid
name_2 = Panel("slab")
xy_2 = XYPlane(Origin=volume_2.Centroid)
X_2 = UnitX(Factor=1)

mesh_3 = Mesh(<mesh referenced from the Rhino model>)
volume_3 = Volume(Geometry=mesh_3)  # -> Volume, Centroid
name_3 = Panel("stair")
xy_3 = XYPlane(Origin=volume_3.Centroid)
X_3 = UnitX(Factor=1)

# ---- group: Display Handles
handdisp = DisplayHandle(Handles=handle, DisplaySize=Slider(7.261, range=0..10), ModelScreenSize=model_abs_size)

handdisp_2 = DisplayHandle(Handles=handle_2, DisplaySize=Slider(7.261, range=0..10), ModelScreenSize=model_abs_size_2)

handdisp_3 = DisplayHandle(Handles=handle_3, DisplaySize=Slider(7.261, range=0..10), ModelScreenSize=model_abs_size_3)

# ----
brep = Brep(<brep referenced from the Rhino model>)
xdcon = ConstructXData(Label="slab body", Data=brep, ReferencePlane=xy_2, AssemblyObjectNameReference=name_2)

brep_2 = Brep(<brep referenced from the Rhino model>)
xdcon_2 = ConstructXData(Label="column body", Data=brep_2, ReferencePlane=xy, AssemblyObjectNameReference=name)

brep_3 = Brep(<brep referenced from the Rhino model>)
xdcon_3 = ConstructXData(Label="stair body", Data=brep_3, ReferencePlane=xy_3, AssemblyObjectNameReference=name_3)

# ---- group: Create AssemblyObject
aocon = ConstructAssemblyObject(Name=name_2, CollisionMesh=mesh_2, ReferencePlane=xy_2, Direction=X_2, Weight="1.0", Handles=handle_2)

aocon_2 = ConstructAssemblyObject(Name=name, CollisionMesh=mesh, ReferencePlane=xy, Direction=X, Weight="1.0", Handles=handle)

aocon_3 = ConstructAssemblyObject(Name=name_3, CollisionMesh=mesh_3, ReferencePlane=xy_3, Direction=X_3, Weight="1.0", Handles=handle_3)

# ----
_1_slab_to_slab = Panel("""1<2
2<1""")
_2_slab_to_stair = Panel("""3<6
3<7
6<7
7<6
6<3
7<3""")
_0_slab_to_column = Panel("""1<5
5<1
2<4
4<2""")
slab_to_column_column_to_column = Panel("""1<5
5<1
2<4
4<2
4<5
5<4""")
_3_slab_to_column_slab_to_slab = Panel("""1<5
5<1
2<4
4<2
3<3""")
# Handle compatibility: 1<2
# 
# Means Handles of type 1 can receive Handles of type 2.
# 
# If present, these rules take precedence; in this csae the self-Handle and cross-type options are ignored
# 
# For mutual compatibility between types, the reverse relations should also be explicited:
# 
# 1<2
# 2<1
full_set = Panel("""3<3
6<3
3<6
7<3
3<7
2<4
4<2
5<1
1<5
4<5
5<4
3<3""")

# ---- group: XData
merge_4 = Merge(Data1=flatten(xdcon), Data2=flatten(xdcon_2), Data3=flatten(xdcon_3))
data = Data(merge_4)

# ---- group: AssemblyObjects
merge_5 = Merge(Data1=flatten(aocon), Data2=flatten(aocon_2), Data3=flatten(aocon_3))
data_2 = Data(merge_5)

# ----
self_object = BooleanToggle(True)
self_handle = BooleanToggle(True)
cross_type = BooleanToggle(False)
heuw = HeuristicsWriter(
    AssemblyObjectsSet=data_2,
    AllowSelfObjectConnections=self_object,
    AllowSelfHandleConnections=self_handle,
    AllowCrossTypeConnections=cross_type,
    HandleCompatibility=_0_slab_to_column)

display = ValueList({"by Type": 0, "by s/r status": 1}, selected="by s/r status")
cell_size = Slider(1.2, range=1..2)
show_edges = BooleanToggle(True)

# ---- group: base point
pt = Point(Point(0, 1500, 0))

# ----
toggle = BooleanToggle(False)
step = Button()
max_objects = Panel("3000")
reset = Button()
pt_2 = Point(Point(-5576.201378, 1761.388447, 0))

# ---- group: try it with 3 - slab to column & slab to slab
subset = SubList(List=heuw, Domain="8 to 23", Wrap=True)  # -> List, Index
# one way to have more control is to replicate rules that you want to apply more often. In this case rules for slab to slab connection are duplicated.
# 
# Use Hc combination 3, try the original HeS, then replace them with this modified list.
merge_6 = Merge(Data1=flatten(heuw), Data2=flatten(subset.List))

# ---- group: Heuristics Display
heud = HeuristicDisplay(
    OriginPoint=pt,
    AssemblyObjectsSet=data_2,
    HeuristicsString=heuw,
    XSize=cell_size,
    YSize=cell_size,
    NRows=Slider(10, range=10..50),
    ShowEdges=show_edges,
    DisplayMode=display)

# ---- group: filter heuristics
heudex = HeuristicsDisplayEx(OriginPoint=pt, AssemblyObjectsSet=data_2, XData=data, HeuristicsString=heuw, XSize=1, YSize=1, NRows=10)  # -> AssemblyObjectPairs, CoherencePattern, HeuristicsStringTree, TextBasePoints, XData
cull = CullPattern(List=flatten(heudex.HeuristicsStringTree), CullPattern=flatten(heudex.CoherencePattern))

# ----
# 1 - simulate
xy_4 = XYPlane(Origin=pt_2)

# ---- group: Assemblage Engine Xtended
aoeng = AssemblerEngineSimple(
    AssemblyObjectsSet=data_2,
    StartingPlane=xy_4,
    StartingObjectType=0,
    HeuristicsString=heuw,
    Go=toggle,
    Step=step,
    NIterations=Slider(100, range=1..100),
    MaxNObjects=max_objects,
    Reset=reset)  # -> Assemblage, AssemblageCount

# ----
larger = LargerThan(FirstNumber=aoeng.AssemblageCount, SecondNumber=max_objects)  # -> LargerThan, OrEqualTo
n_of_objects = Panel(aoeng.AssemblageCount)
or = GateOr(A=toggle, B=step)
f_tas = ToggleAutostop(Toggle=toggle, Condition=larger.OrEqualTo)
# 2 - analyze/post-process
display_2 = ValueList({"objects": 0, "occupancy": 1, "type": 2, "sequence": 3, "Z height": 4, "none": 5}, selected="Z height")
panel_2 = Panel("""AliceBlue
SlateGray
GoldenRod
YellowGreen
DarkKhaki""")
cluster = Cluster(vizmode=display_2, assemblage=aoeng.Assemblage, type_colors=panel_2, stop_and_go_bool=or)  # -> meshes, edges

# ---- group: display components / display edges
previewlw = CustomPreviewLineweights(Geometry=cluster.edges, Shader=ColourSwatch(SwatchColor=RGB(0, 0, 0)), Thickness=Slider(1, range=1..3), Absolute=False)

# ---- group: display components
mjoin = MeshJoin(Meshes=cluster.meshes)
preview = CustomPreview(Geometry=mjoin, Material=ColourSwatch(SwatchColor=RGB(255, 255, 255)))

# ==== cluster Cluster
vizmode = ClusterInput()
assemblage = ClusterInput()
type_colors = ClusterInput()
stop_and_go_bool = ClusterInput()
aoadecon = DeconstructAssemblage(Assemblage=assemblage)  # -> AssemblageObjects, AssemblageRules, ReceiverObjectsIndexes, AvailableObjectIndexes, UnreachableObjectIndexes
filter = StreamFilter(Gate=stop_and_go_bool, Stream0=assemblage)
gate = StreamGate(Stream=aoadecon.AssemblageObjects, Gate=stop_and_go_bool)  # -> Target0, Target1
aoset = ExtractAOSet(Assemblage=filter)
gate_2 = StreamGate(Stream=gate.Target0, Gate=vizmode)  # -> Target0, Target1, Target2, Target3, Target4, Target5
aocmesh = ExtractCollisionMesh(AssemblyObject=aoset)
f_mseea = MeshExtractEdgesWithToleranceAngle(Mesh=aocmesh, Angle="45")  # -> InternalEdges, NakedEdges

# ---- group: extract object type
aotype = ExtractType(AssemblyObject=gate.Target0)

# ----
aocmesh_2 = ExtractCollisionMesh(AssemblyObject=gate_2.Target3)
aocmesh_3 = ExtractCollisionMesh(AssemblyObject=gate_2.Target2)
aocmesh_4 = ExtractCollisionMesh(AssemblyObject=gate_2.Target1)
aocmesh_5 = ExtractCollisionMesh(AssemblyObject=gate_2.Target4)
group = Group(Objects=f_mseea.InternalEdges)  # -> flatten(Group)
lng = ListLength(List=aocmesh_4)
aoplane = ExtractReferencePlane(AssemblyObject=aoset)
aoplane_2 = ExtractReferencePlane(AssemblyObject=gate_2.Target4)
repeat = RepeatData(Data="0", Length=lng)

# ---- group: display by assemblage sequence
lng_2 = ListLength(List=aocmesh_2)  # -> expr("x-1", Length)
f_ifroml = IndexesFromList(D=aocmesh_2)  # -> i; inputs D: list
# ---------- f_ifroml: C# usings ----------
using System.Linq;
# ---------- f_ifroml: C# ----------
   
 /*
    froGH - a sparse collection of (in)utilities for Grasshopper

    Indexes from Number
    code by Alessio Erioli

    froGH by Co-de-iT is licensed under a Creative Commons Attribution 4.0 International License.
    http://creativecommons.org/licenses/by/4.0/

    */
    initComp();
   
    GH_Integer[] indexes = new GH_Integer[D.Count];

    for(int j = 0; j < D.Count; j++)
      indexes[j] = new GH_Integer(j);

    //A = indexes.Sum(j => j.Value); // uses System.Linq Sum selector function - for each GH_Integer j in indexes add its value to the total sum

    i = indexes;
# ---------- f_ifroml: C# additional code ----------
  void initComp(){
    Component.Name = "Indexes from List";
    Component.NickName = "f_iFromL";
    Component.Description = "Generates a list of 0-based integer indexes from a given list of data";
    Component.Params.Input[0].Name = "Data";
    Component.Params.Input[0].Description = "the list to index";
    Component.Params.Output[0].Name = "Indexes";
    Component.Params.Output[0].Description = "the generated indexes";
  }
# ---------- end f_ifroml ----------
one_over_x = OneOverX(Value=lng_2)
multiplication = Multiplication(A=f_ifroml, B=one_over_x)
sqr = Square(Value=multiplication)
gradient = Gradient(
    LowerLimit=0,
    UpperLimit=1,
    Parameter=sqr,
    stops=[0: RGB(0, 0, 0), 0.498: RGB(56, 136, 150), 0.904: RGB(186, 224, 224), 1: RGB(255, 255, 255)])
mcol = MeshColours(Mesh=graft(aocmesh_2), Colours=graft(gradient))  # -> flatten(Mesh)

# ----
filter_2 = StreamFilter(Gate=stop_and_go_bool, Stream0=aotype)
pdecon = Deconstruct(Point=aoplane_2)  # -> XComponent, YComponent, ZComponent
aoplane_3 = ExtractReferencePlane(AssemblyObject=gate.Target0)
item = ListItem(List=group, Index=filter_2, Wrap=True)
item_2 = ListItem(List=aoplane, Index=filter_2, Wrap=True)
replace = ReplaceItems(List=repeat, Item="1", Indices=aoadecon.AvailableObjectIndexes, Wrap=False)
bnd = Bounds(Numbers=pdecon.ZComponent)
replace_2 = ReplaceItems(List=replace, Item="2", Indices=aoadecon.UnreachableObjectIndexes, Wrap=False)
orient = Orient(Geometry=item, Source=item_2, Target=aoplane_3)  # -> Geometry, Transform
remap = RemapNumbers(Value=pdecon.ZComponent, Source=bnd, Target=Domain(0, 1))  # -> Mapped, Clipped

# ---- group: occupied/available visualization
saturated = ColourSwatch(SwatchColor=RGB(112, 117, 57))
available = ColourSwatch(SwatchColor=RGB(255, 255, 255))
unreachable = ColourSwatch(SwatchColor=RGB(194, 199, 137))
weave = Weave(Pattern=graft(replace_2), Stream0=saturated, Stream1=available, Stream2=unreachable, NullGaps=False)  # -> simplify(Weave)
mcol_2 = MeshColours(Mesh=graft(aocmesh_4), Colours=weave)  # -> flatten(Mesh)

# ----
gradient_2 = Gradient(
    LowerLimit=0,
    UpperLimit=1,
    Parameter=remap.Mapped,
    stops=[0: RGB(21, 0, 33), 0.326: RGB(150, 66, 114), 0.664: RGB(224, 186, 187), 1: RGB(255, 255, 255)])
ungroup = Ungroup(Group=orient.Geometry)  # -> flatten(Objects)
item_3 = ListItem(List=type_colors, Index=graft(aotype), Wrap=True)  # -> simplify(Item)
aocmesh_6 = ExtractCollisionMesh(AssemblyObject=gate_2.Target0)
aocmesh_7 = ExtractCollisionMesh(AssemblyObject=gate.Target1)
filter_3 = StreamFilter(Gate=stop_and_go_bool, Stream0=ungroup)

# ---- group: display by component type
mcol_3 = MeshColours(Mesh=graft(aocmesh_3), Colours=item_3)  # -> flatten(Mesh)

# ----
mcol_4 = MeshColours(Mesh=graft(aocmesh_5), Colours=graft(gradient_2))  # -> flatten(Mesh)
filter_4 = StreamFilter(Gate=vizmode, Stream0=aocmesh_6, Stream1=mcol_2, Stream2=mcol_3, Stream3=mcol, Stream4=mcol_4)
filter_5 = StreamFilter(Gate=stop_and_go_bool, Stream0=filter_4, Stream1=aocmesh_7)
meshes = ClusterOutput(filter_5)
edges = ClusterOutput(filter_3)
