# Grasshopper definition 03-02_Fields - populate iWeights.gh (Grasshopper 1.0.7)
# Copyright: Co-de-iT
# plug-ins: Human, Assembler

box = CenterBox(Base="0,0,0", X=Slider(840, range=1..2000), Y=Slider(1200, range=1..2000), Z=Slider(850, range=1..2000))
scale = Scale(Geometry=box, Center=Point(0, 0, 0), Factor="100")  # -> Geometry, Transform

edges = BrepEdges(Brep=scale.Geometry)  # -> Naked, Interior, NonManifold
previewlw = CustomPreviewLineweights(Geometry=edges.Interior, Shader=ColourSwatch(SwatchColor=RGB(0, 0, 0)), Absolute=False)

iweights_one_for_each_point = Panel("""0
1
2""")

# ---- group: multiple attractor points
# Assembler
# 
# Framework for Iterative Assemblages workflow
# 
# code by Alessio Erioli
# 
# v 1.0
# © Co-de-iT 2020 / Creative Commons Attribution-Non Commercial-ShareAlike 4.0 International License
pt = Point(Point(42187.04806, 97897.31723, 50117.16787))
pt_2 = Point(Point(-69568.52053, -80412.00534, 62.76255449))
pt_3 = Point(Point(27.98851503, -86.49690043, -43683.74738))
merge = Merge(Data1=pt, Data2=pt_2, Data3=pt_3)

# ---- group: empty field
afieldn = ConstructFieldN(Box=scale.Geometry, NCells=Slider(15, range=10..30))  # -> Field, FieldPoints

# ----
panel = Panel(afieldn.Field)

# ---- group: calculate vector
xprod = CrossProduct(VectorA=graft(afieldn.FieldPoints), VectorB=merge, Unitize=True)  # -> Vector, Length
avr = Average(Input=xprod.Vector)  # -> flatten(ArithmeticMean)
unit = UnitVector(Vector=avr)

# ---- group: calculate scalar
# multiple points
dist = Distance(PointA=graft(afieldn.FieldPoints), PointB=merge)
log = Logarithm(Value=dist)
avr_2 = Average(Input=log)  # -> flatten(ArithmeticMean)

# ---- group: iWeights by proximity
sort = SortList(Keys=dist, ValuesA=iweights_one_for_each_point)  # -> Keys, ValuesA
item = ListItem(List=sort.ValuesA, Index=0, Wrap=True)  # -> flatten(Item)
int = Integer(item)

# ---- group: generate colors for iWeights
lng = ListLength(List=iweights_one_for_each_point)
wheel = ColourWheel(
    lng,
    ColourGrips_Style=20,
    ColourGrips_Grip=[3.852552882, 2.112129398, 3.910274516, 2.863076965],
    ColourGrips_Lum=[0.1, 0.7575425545],
    ColourGrips_Range=[0.2617993878, 0.4985281605, 0.2617993878, 0.2617993878],
    ColourGrips_Sat=[0.2, 0.8073025463])

# ---- group: generate colors for iWeights / colour chart
legend = Legend(Colour=wheel, Tags=iweights_one_for_each_point, LegendType=1)

# ----
int_2 = Integer(graft(int))

# ---- group: Populate Field (scalars, vectors)
afpop = PopulateField(Field=afieldn.Field, ScalarValues=avr_2, VectorValues=unit)

# ----
afpop_2 = PopulateField(Field=afieldn.Field, ScalarValues=avr_2, VectorValues=unit, IWeightValues=int_2)
blend = BooleanToggle(True)
list = ValueList({"2-steps": 0, "direct population": 1}, selected="2-steps")

# ---- group: Populate iWeights
afpopwa = PopulateFieldIWeightsAttractors(Field=afpop, AttractorPoints=merge, IWeightValues=graft(iweights_one_for_each_point), Blend=blend)

# ----
filter = StreamFilter(Gate=list, Stream0=afpopwa, Stream1=afpop_2)
afdecon = DeconstructField(Field=filter)  # -> Points, ScalarValues, Vectors, IWeights, Colors
item_2 = ListItem(List=wheel, Index=afdecon.IWeights, Wrap=True)
tag = TextTag3D(Location=graft(afdecon.Points), Text=afdecon.IWeights, Size="2500", Colour=item_2, Justification=5)
