# Grasshopper definition circulation path operations.gh (Grasshopper 1.0.7)
# Copyright: Co-de-iT
# plug-ins: Human, Assembler, froGH, Shortest Walk in Gh

# XData must contain line network for circulation
associated_xdata = Relay()
assemblage = Relay()
xddecon = DeconstructXData(XData=associated_xdata)  # -> Label, simplify(Data), ReferencePlane, AssemblyObjectNameReference

# ---- group: path topology
line = Line(flatten(xddecon.Data))
f_tln = Topologizer(LinesNetwork=line, Decimals=3)  # -> Points, LinePointsData, PointsConnectivity, LineDirectionAtEachPoint

# ----
f_clstr = Clusterizer(TopologyData=f_tln.PointsConnectivity)

# ---- group: highlight clusters
# <title>
# 
# <description>
# 
# code by Alessio Erioli
# 
# v 0.1
# © Co-de-iT 2020 / Creative Commons Attribution-Non Commercial-ShareAlike 4.0 International License
f_tinv = TopologyInverter(TopologyData=f_tln.LinePointsData)
item = ListItem(List=line, Index=f_tinv, Wrap=True)
tstat = TreeStatistics(Tree=f_clstr)  # -> Paths, Length, Count
group = Group(Objects=item)  # -> flatten(Group)
n_of_clusters = Panel(tstat.Count)
item_2 = ListItem(List=group, Index=f_clstr, Wrap=True)

# ---- group: isolate horizontal and vertical paths
Z = UnitZ(Factor=1)
angle = Angle(VectorA=line, VectorB=Z)  # -> Angle, Reflex
similar = Similarity(FirstNumber=angle.Angle, SecondNumber="0", Threshold=0.1)  # -> Similarity, AbsoluteDifference
similar_2 = Similarity(FirstNumber=angle.Angle, SecondNumber="0.5", Threshold=0.1)  # -> Similarity, AbsoluteDifference
cull = CullPattern(List=line, CullPattern=similar.Similarity)
cull_2 = CullPattern(List=line, CullPattern=similar_2.Similarity)

# ---- group: shortest walk between points / end point
pt = Point(Point(-16393.85646, 14436.76647, -9158.493907))

# ---- group: shortest walk between points / start point
pt_2 = Point(Point(-22377.33255, 10611.41268, 2010.000358))

# ---- group: shortest walk between points
cp = ClosestPoint(Point=pt_2, Cloud=f_tln.Points)  # -> ClosestPoint, CPIndex, Distance
cp_2 = ClosestPoint(Point=pt, Cloud=f_tln.Points)  # -> ClosestPoint, CPIndex, Distance
ln = Line(StartPoint=cp.ClosestPoint, EndPoint=cp_2.ClosestPoint)
shortwalk = ShortestWalk(Curves=line, WantedPath=ln)  # -> ShortestWalk, Succession, Direction, Length

# ---- group: display clusters
wheel = ColourWheel(
    tstat.Count,
    ColourGrips_Style=10,
    ColourGrips_Grip=[3.34820233, 2.094395102, 4.188790205, 3.141592654],
    ColourGrips_Lum=[0.1, 0.6959162562],
    ColourGrips_Range=[0.2980456393, 0.2980456393, 0.2980456393, 0.2980456393],
    ColourGrips_Sat=[0.1889716777, 0.7131070986])
previewlw = CustomPreviewLineweights(Geometry=item_2, Shader=graft(wheel), Thickness="3", Absolute=False)

# ----
previewlw_2 = CustomPreviewLineweights(Geometry=shortwalk.ShortestWalk, Shader=ColourSwatch(SwatchColor=RGB(255, 0, 0)), Thickness="5", Absolute=False)

# ---- group: objects involved in shortest path
f_ifroml = IndexesFromList(Data=line)
unflatten = UnflattenTree(Tree=f_ifroml, Guide=xddecon.Data)
mindex = MemberIndex(Set=unflatten, Member=shortwalk.Succession)  # -> Index, simplify(Count)
ma = MassAddition(Input=mindex.Count)  # -> Result, PartialResults
larger = LargerThan(FirstNumber=ma.Result, SecondNumber="0")  # -> flatten(LargerThan), OrEqualTo
f_ifroml_2 = IndexesFromList(Data=larger.LargerThan)
cull_3 = CullPattern(List=f_ifroml_2, CullPattern=larger.LargerThan)

# ----
# circulation path operations
aoadecon = DeconstructAssemblage(Assemblage=assemblage)  # -> AssemblageObjects, AssemblageRules, ReceiverObjectsIndexes, AvailableObjectIndexes, UnreachableObjectIndexes
panel = Panel(cull_3)

# ---- group: display circulation paths
previewlw_3 = CustomPreviewLineweights(Geometry=line, Shader=ColourSwatch(SwatchColor=RGB(237, 85, 194)), Thickness="2", Absolute=False)

# ----
item_3 = ListItem(List=aoadecon.AssemblageObjects, Index=cull_3, Wrap=True)
aocmesh = ExtractCollisionMesh(AssemblyObject=item_3)

# ---- group: shortlisted objects
int = Integer(cull_3)

# ---- group: walkthrough / live animation
reset = Button()
go = BooleanToggle(False)
number_slider = Slider(1000, range=0..10000)
counter = CSharpScript(reset=reset, go=go, max=number_slider)  # -> C; inputs reset: Boolean, go: Boolean, max: Int32
# ---------- counter: C# ----------
    if(reset) count = 0;
    if (go && count < max)
    {
      count++;
      Component.ExpireSolution(true);
    }
    C = count;
# ---------- counter: C# additional code ----------
  int count;
# ---------- end counter ----------
division = Division(A=counter, B=number_slider)

# ---- group: walkthrough
activate_camera = BooleanToggle(False)
list = ValueList({"live animation": 0, "save animation": 1}, selected="live animation")
head_height = Slider(160, range=1..200)
save_animation = Slider(0, range=0..1)
anticipation = Slider(0.005, range=0..0.01)
fillet = Fillet(Curve=shortwalk.ShortestWalk, Radius=Slider(20, range=0..20))
Z_2 = UnitZ(Factor=head_height)
move = Move(Geometry=fillet, Motion=Z_2)  # -> Geometry, Transform
filter = StreamFilter(Gate=list, Stream0=division, Stream1=save_animation)
crv = Curve(reparameterize(move.Geometry))
panel_2 = Panel(filter)
addition = Addition(A=filter, B=anticipation)
eval = EvaluateCurve(Curve=crv, Parameter=filter)  # -> Point, Tangent, Angle
eval_2 = EvaluateCurve(Curve=crv, Parameter=addition)  # -> Point, Tangent, Angle
move_2 = Move(Geometry=eval.Point, Motion=eval_2.Tangent)  # -> Geometry, Transform
Z_3 = UnitZ(Factor=1)
f_camcon = CameraControl(location=eval.Point, target=move_2.Geometry, lens=Slider(21, range=21..120), up=Z_3, activate=activate_camera)  # inputs location: Point3d, target: Point3d, lens: Double, up: Vector3d, activate: Boolean
# ---------- f_camcon: C# ----------
                                          /*
    froGH - a sparse collection of (in)utilities for Grasshopper

    Camera Control
    code by Alessio Erioli

    froGH by Co-de-iT is licensed under a Creative Commons Attribution 4.0 International License.
    http://creativecommons.org/licenses/by/4.0/

    */

    initComp();

    if (activate){
      Component.Message = "active";
      //Get current viewport
      vp = Rhino.RhinoDoc.ActiveDoc.Views.ActiveView.ActiveViewport;
      //Set new camera
      vp.SetCameraLocations(target, location);
      vp.CameraUp = up;
      vp.ChangeToPerspectiveProjection(true, lens);
    }
    else Component.Message = "";
# ---------- f_camcon: C# additional code ----------
  //To get and set camera properties
  Rhino.Display.RhinoViewport vp;

  void initComp(){
    Component.Name = "Camera Control";
    Component.NickName = "f_CamCon";
    Component.Description = "Controls Rhino camera from Grasshopper";

    Component.Params.Input[0].Name = "Location";
    Component.Params.Input[0].Description = "Camera location";
    Component.Params.Input[1].Name = "Target";
    Component.Params.Input[1].Description = "Camera target point";
    Component.Params.Input[2].Name = "Lens";
    Component.Params.Input[2].Description = "Camera lens";
    Component.Params.Input[3].Name = "Up vector";
    Component.Params.Input[3].Description = "Camera up vector";
    Component.Params.Input[4].Name = "Activate";
    Component.Params.Input[4].Description = "Take control or release it back to Rhino";
  }
# ---------- end f_camcon ----------
