# Grasshopper definition 01-00_AssemblyObject 2 objects setup.gh (Grasshopper 1.0.7)
# Copyright: Co-de-iT
# plug-ins: Assembler

# ---- group: type 1
crv = Curve([<curve referenced from the Rhino model> x3])

# ---- group: type 2
crv_2 = Curve([<curve referenced from the Rhino model> x2])

crv_3 = Curve([<curve referenced from the Rhino model> x2])

# ---- group: type 1
crv_4 = Curve([<curve referenced from the Rhino model> x4])

# ----
merge = Merge(Data1=crv, Data2=crv_2)
merge_2 = Merge(Data1=crv_4, Data2=crv_3)

rotations = Panel("""0
180""")
lng = ListLength(List=merge_2)
type = Panel("""1
1
1
1
2
2""")
repeat = RepeatData(Data=graft(rotations), Length=lng)
weight = Panel("0")
flip = FlipMatrix(Data=repeat)  # -> simplify(Data)
repeat_2 = RepeatData(Data=weight, Length=lng)

crv_5 = Curve(merge)

type_2 = Panel("""1
1
1
2
2""")
rotations_2 = Panel("""0
180""")
lng_2 = ListLength(List=crv_5)
repeat_3 = RepeatData(Data=graft(rotations_2), Length=lng_2)
weight_2 = Panel("0")
flip_2 = FlipMatrix(Data=repeat_3)  # -> simplify(Data)
repeat_4 = RepeatData(Data=weight_2, Length=lng_2)

# ---- group: Create Handles
handle = ConstructHandle(Polyline=merge_2, RotationAngles=flip, Type=type, Weight=repeat_2)

# Assembler
# 
# Framework for Iterative Assemblages workflow
# 
# code by Alessio Erioli
# 
# v 1.0
# © Co-de-iT 2020 / Creative Commons Attribution-Non Commercial-ShareAlike 4.0 International License
handle_2 = ConstructHandle(Polyline=crv_5, RotationAngles=flip_2, Type=type_2, Weight=repeat_4)

# ----
model_abs_size = BooleanToggle(True)
model_abs_size_2 = BooleanToggle(True)

mesh = Mesh(<mesh referenced from the Rhino model>)
volume = Volume(Geometry=mesh)  # -> Volume, Centroid
name = Panel("blockB")
xy = XYPlane(Origin=volume.Centroid)
X = UnitX(Factor=1)

crv_6 = Curve([<curve referenced from the Rhino model> x12])
pt = Point([<point referenced from the Rhino model> x7])
brep = Brep([<brep referenced from the Rhino model> x7])
brep_2 = Brep([<brep referenced from the Rhino model> x21])
merge_3 = Merge(Data1=crv_6, Data2=pt)
xdcon = ConstructXData(Label="blockB body", Data=merge_3, ReferencePlane=xy, AssemblyObjectNameReference=name)  # disabled

mesh_2 = Mesh(<mesh referenced from the Rhino model>)
volume_2 = Volume(Geometry=mesh_2)  # -> Volume, Centroid
name_2 = Panel("blockA")
xy_2 = XYPlane(Origin=volume_2.Centroid)
X_2 = UnitX(Factor=1)

crv_7 = Curve([<curve referenced from the Rhino model> x12])
pt_2 = Point([<point referenced from the Rhino model> x7])
brep_3 = Brep([<brep referenced from the Rhino model> x21])
brep_4 = Brep([<brep referenced from the Rhino model> x7])
merge_4 = Merge(Data1=crv_7, Data2=pt_2)
xdcon_2 = ConstructXData(Label="blockA body", Data=merge_4, ReferencePlane=xy_2, AssemblyObjectNameReference=name_2)  # disabled

# ---- group: Display Handles
handdisp = DisplayHandle(Handles=handle, DisplaySize=Slider(7.261, range=0..10), ModelScreenSize=model_abs_size)

handdisp_2 = DisplayHandle(Handles=handle_2, DisplaySize=Slider(7.261, range=0..10), ModelScreenSize=model_abs_size_2)

# ---- group: Create AssemblyObject
aocon = ConstructAssemblyObject(Name=name, CollisionMesh=mesh, ReferencePlane=xy, Direction=X, Weight="1.0", Handles=handle)

aocon_2 = ConstructAssemblyObject(Name=name_2, CollisionMesh=mesh_2, ReferencePlane=xy_2, Direction=X_2, Weight="1.0", Handles=handle_2)

# ---- group: XData
merge_5 = Merge(Data1=flatten(xdcon_2), Data2=flatten(xdcon))

# ---- group: AssemblyObjects
merge_6 = Merge(Data1=flatten(aocon_2), Data2=flatten(aocon))

# ----
self_object = BooleanToggle(True)
self_handle = BooleanToggle(True)
cross_type = BooleanToggle(False)
heuw = HeuristicsWriter(
    AssemblyObjectsSet=merge_6,
    AllowSelfObjectConnections=self_object,
    AllowSelfHandleConnections=self_handle,
    AllowCrossTypeConnections=cross_type)

display = ValueList({"by Type": 0, "by s/r status": 1}, selected="by Type")
number_slider = Slider(1.2, range=1..2)
pt_3 = Point(Point(0, 1500, 0))
heuristics_rules = Panel(heuw)

# ---- group: Heuristics Display
heud = HeuristicDisplay(
    OriginPoint=pt_3,
    AssemblyObjectsSet=merge_6,
    HeuristicsString=heuw,
    XSize=number_slider,
    YSize=number_slider,
    NRows=Slider(10, range=10..50),
    ShowEdges=Toggle(True),
    DisplayMode=display)

# ----
# receiver rotation angle (in degrees)
# receiver Handle index
# sender Handle index
# rule integer Weight
# receiver Object name
# sender Object name
# rO | rH = rHA < sO | sH % r_iWeight
panel = Panel("rName|1=90<sName|3%0")
