# Grasshopper definition 02-01_Assemblage 2 Objects Environment_PP.gh (Grasshopper 1.0.7)
# Copyright: Co-de-iT
# plug-ins: MeshEdit Components, Human, EleFront, Assembler, froGH

# ---- group: container
pt = Point(Point(-13857.30284, 19480.88136, 0))
box = CenterBox(Base=pt, X=Slider(6213.85, range=100..20000), Y=Slider(15026.558, range=100..20000), Z=Slider(304.863, range=100..20000))
mbox = MeshBox(Base=box, XCount="1", YCount="1", ZCount="1")

# ---- group: obstacle
pt_2 = Point(Point(-15847.26811, 17657.88105, 0))
box_2 = CenterBox(Base=pt_2, X=Slider(1100, range=100..20000), Y=Slider(2250, range=100..20000), Z=Slider(2600, range=100..20000))
mbox_2 = MeshBox(Base=box_2, XCount="1", YCount="1", ZCount="1")

pt_3 = Point(Point(-12233.39923, 28215.86602, 0))
box_3 = CenterBox(Base=pt_3, X=Slider(2400, range=100..20000), Y=Slider(900, range=100..20000), Z=Slider(2600, range=100..20000))
mbox_3 = MeshBox(Base=box_3, XCount="1", YCount="1", ZCount="1")

# ---- group: type 1
crv = Curve([<curve referenced from the Rhino model> x4])

# ---- group: type 2
crv_2 = Curve([<curve referenced from the Rhino model> x2])

# ---- group: type 1
# 0 - construct
crv_3 = Curve([<curve referenced from the Rhino model> x3])

# ---- group: type 2
crv_4 = Curve([<curve referenced from the Rhino model> x2])

# ----
merge = Merge(Data1=flatten(crv), Data2=flatten(crv_2))
merge_2 = Merge(Data1=flatten(crv_3), Data3=flatten(crv_4))

rotations = Panel("""0
180""")
lng = ListLength(List=merge)
type = Panel("""1
1
1
1
2
2""")
repeat = RepeatData(Data=graft(rotations), Length=lng)
weight = Panel("0")
flip = FlipMatrix(Data=repeat)  # -> simplify(Data)
repeat_2 = RepeatData(Data=weight, Length=lng)

# ----
# ASSEMBLAGES IN BRIEF: GENERAL STEPS
# 
# . choose WHERE to add
# 
# . choose WHAT to add
# 
# 
# PROCESS STEPS
# 
# 
# 
# . select receiver object in the assemblage
# 
# . list all possible combinations of free handles and related compatible candidates
# 
# . choose a winnig candidate according to given criteria
# DEFINITION ANATOMY: 00 - constuct
# 
# Construct the object and relationships necessary for the Assemblage
# 
# 
# 
# 01 - simulate
# 
# Simulate the Assemblage growth
# 
# 
# 
# 02 - analyze/post-process
# 
# Analyze results and post-process the obtained assemblage
rotations_2 = Panel("""0
180""")
lng_2 = ListLength(List=merge_2)
type_2 = Panel("""1
1
1
2
2""")
repeat_3 = RepeatData(Data=graft(rotations_2), Length=lng_2)
weight_2 = Panel("0")
flip_2 = FlipMatrix(Data=repeat_3)  # -> simplify(Data)
repeat_4 = RepeatData(Data=weight_2, Length=lng_2)

# ---- group: single container
mesh = Mesh(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)

# ----
environment = ValueList({"single mesh container": 0, "container + obstacles": 1}, selected="single mesh container")

# ---- group: single container
# flip normals: A container must have normals pointing inward
flip_3 = MeshFlip(Mesh=mesh)

# ---- group: container
# flip normals: A container must have normals pointing inward
flip_4 = MeshFlip(Mesh=mbox)

# ---- group: Create Handles
handle = ConstructHandle(Polyline=merge, RotationAngles=flip, Type=type, Weight=repeat_2)

handle_2 = ConstructHandle(Polyline=merge_2, RotationAngles=flip_2, Type=type_2, Weight=repeat_4)

# ----
model_abs_size = BooleanToggle(True)
model_abs_size_2 = BooleanToggle(True)

merge_3 = Merge(Data1=flip_4, Data2=mbox_2, Data3=mbox_3)  # -> flatten(Result)

mesh_2 = Mesh(<mesh referenced from the Rhino model>)
volume = Volume(Geometry=mesh_2)  # -> Volume, Centroid
name = Panel("blockB")
xy = XYPlane(Origin=volume.Centroid)
X = UnitX(Factor=1)

# ----
# Assembler
# 
# Framework for Iterative Assemblages workflow
# 
# code by Alessio Erioli
# 
# v 1.0
# © Co-de-iT 2020 / Creative Commons Attribution-Non Commercial-ShareAlike 4.0 International License
mesh_3 = Mesh(<mesh referenced from the Rhino model>)
volume_2 = Volume(Geometry=mesh_3)  # -> Volume, Centroid
name_2 = Panel("blockA")
xy_2 = XYPlane(Origin=volume_2.Centroid)
X_2 = UnitX(Factor=1)

# ---- group: Display Handles
handdisp = DisplayHandle(Handles=handle, DisplaySize=Slider(7.261, range=0..10), ModelScreenSize=model_abs_size)

handdisp_2 = DisplayHandle(Handles=handle_2, DisplaySize=Slider(7.261, range=0..10), ModelScreenSize=model_abs_size_2)

# ----
crv_5 = Curve([<curve referenced from the Rhino model> x2])

crv_6 = Curve([<curve referenced from the Rhino model> x11])
brep = Brep(<brep referenced from the Rhino model>)
brep_2 = Brep()
merge_4 = Merge(Data1=crv_6, Data2=crv_5)
xdcon = ConstructXData(Label="blockA body", Data=merge_4, ReferencePlane=xy_2, AssemblyObjectNameReference=name_2)

brep_3 = Brep([<brep referenced from the Rhino model> x21])
brep_4 = Brep(<brep referenced from the Rhino model>)
crv_7 = Curve([<curve referenced from the Rhino model> x11])
xdcon_2 = ConstructXData(Label="blockB body", Data=crv_7, ReferencePlane=xy, AssemblyObjectNameReference=name)

filter = StreamFilter(Gate=environment, Stream0=flip_3, Stream1=merge_3)

# ---- group: Create AssemblyObject
aocon = ConstructAssemblyObject(Name=name_2, CollisionMesh=mesh_3, ReferencePlane=xy_2, Direction=X_2, Weight="1.0", Handles=handle_2)

aocon_2 = ConstructAssemblyObject(Name=name, CollisionMesh=mesh_2, ReferencePlane=xy, Direction=X, Weight="1.0", Handles=handle)

# ---- group: display Environment Geometries
obstacles = ColourSwatch(SwatchColor=RGB(115, 124, 148))
containers = ColourSwatch(SwatchColor=RGB(0, 0, 0))
merge_5 = Merge(Data1=obstacles, Data2=containers)
mesh_4 = Mesh(filter)
cluster = Cluster(environment_meshes=mesh_4, colours=merge_5, normal_size=Slider(500, range=1..1000))

# ---- group: XData
merge_6 = Merge(Data1=flatten(xdcon), Data2=flatten(xdcon_2))

# ---- group: AssemblyObjects
merge_7 = Merge(Data1=flatten(aocon), Data2=flatten(aocon_2))

# ----
self_object = BooleanToggle(True)
self_handle = BooleanToggle(True)
cross_type = BooleanToggle(False)
heuw = HeuristicsWriter(
    AssemblyObjectsSet=merge_7,
    AllowSelfObjectConnections=self_object,
    AllowSelfHandleConnections=self_handle,
    AllowCrossTypeConnections=cross_type)

# ---- group: filter heuristics
heudex = HeuristicsDisplayEx(OriginPoint=Point(0, 0, 0), AssemblyObjectsSet=merge_7, HeuristicsString=heuw, XSize=1, YSize=1, NRows=10)  # -> AssemblyObjectPairs, CoherencePattern, HeuristicsStringTree, TextBasePoints, XData
cull = CullPattern(List=flatten(heudex.HeuristicsStringTree), CullPattern=flatten(heudex.CoherencePattern))

# ----
display = ValueList({"by Type": 0, "by s/r status": 1}, selected="by Type")
heuset = HeuristicsSettings(HeuristicsString=cull, CurrentHeuristics=0, ReceiverSelectionMode=0, RuleSelectionMode=0)
go = BooleanToggle(False)
step = Button()
resetex = Button()
max_objects = Panel("2000")
reset = Button()
exoset = ExogeousSettings(
    EnvironmentMeshes=filter,
    EnvironmentMode=1,
    FieldScalarThreshold=0.5,
    Sandbox={Plane=PlaneXY(0, 0, 0), X=Domain(-1, 1), Y=Domain(0, 0), Z=Domain(0, 0)})
cell_size = Slider(1.2, range=1..2)
show_edges = BooleanToggle(True)

# ---- group: base point
pt_4 = Point(Point(0, 1500, 0))

# ----
pt_5 = Point(Point(-12807.51619, 13383.37939, 0))

# ---- group: Heuristics Display
heud = HeuristicDisplay(
    OriginPoint=pt_4,
    AssemblyObjectsSet=merge_7,
    HeuristicsString=heuw,
    XSize=cell_size,
    YSize=cell_size,
    NRows=Slider(10, range=10..50),
    ShowEdges=show_edges,
    DisplayMode=display)

# ----
# 1 - simulate
xy_3 = XYPlane(Origin=pt_5)

# ---- group: Assemblage Engine Xtended
aoengx = AssemblerEngineX(
    AssemblyObjectsSet=merge_7,
    StartingPlane=xy_3,
    StartingObjectType=0,
    HeuristicsSettings=heuset,
    ExogenousSettings=exoset,
    Go=go,
    Step=step,
    NIterations=Slider(100, range=10..100),
    MaxNObjects=max_objects,
    ResetExogenous=resetex,
    Reset=reset)  # -> Assemblage, AssemblageCount

# ----
n_of_objects = Panel(aoengx.AssemblageCount)

# ---- group: auto-stop
larger = LargerThan(FirstNumber=aoengx.AssemblageCount, SecondNumber=max_objects)  # -> LargerThan, OrEqualTo
f_tas = ToggleAutostop(Toggle=go, Condition=larger.OrEqualTo)

# ----
# 2 - analyze/post-process
display_2 = ValueList({"objects": 0, "occupancy": 1, "type": 2, "sequence": 3, "none": 4}, selected="occupancy")
dam = DataDam(DataA=aoengx.Assemblage, BufferDelay=10000000, BufferMode=0)
panel = Panel("""AliceBlue
SlateGray
GoldenRod
YellowGreen
DarkKhaki""")
aoadecon = DeconstructAssemblage(Assemblage=dam)  # -> AssemblageObjects, AssemblageRules, ReceiverObjectsIndexes, AvailableObjectIndexes, UnreachableObjectIndexes

# ---- group: Show Handles Occupancy status
aoadecon_2 = DeconstructAssemblage(Assemblage=aoengx.Assemblage)  # -> AssemblageObjects, AssemblageRules, AvailableObjectIndexes, UnreachableObjectIndexes, CandidateObjects; disabled
aotopo = ExtractTopology(Assemblage=aoengx.Assemblage)  # -> HandleOccupancy, NeighbourObjectIndex, NeighbourHandleIndex; disabled
number_slider = Slider(93.487, range=0..1000)  # disabled
aosp = ExtractSenderHandlesPlanes(AssemblyObject=aoadecon_2.AssemblageObjects)  # disabled
occluded = ColourSwatch(SwatchColor=RGB(255, 0, 0))  # disabled
available = ColourSwatch(SwatchColor=RGB(255, 255, 255))  # disabled
connected = ColourSwatch(SwatchColor=RGB(58, 222, 47))  # disabled
deplane = DeconstructPlane(Plane=aosp)  # -> Origin, XAxis, YAxis, ZAxis; disabled
merge_8 = Merge(Data1=available, Data2=connected, Data3=occluded)  # disabled
line = LineSDL(Start=aosp, Direction=deplane.ZAxis, Length=number_slider)  # disabled
item = ListItem(List=merge_8, Index=aotopo.HandleOccupancy, Wrap=True)  # disabled
previewlw = CustomPreviewLineweights(Geometry=line, Shader=item, Absolute=False)  # disabled

# ----
cluster_2 = Cluster_2(vizmode=display_2, assemblage=aoengx.Assemblage, type_colors=panel, stop_and_go_bool=step)  # -> meshes, edges
aotype = ExtractType(AssemblyObject=aoadecon.AssemblageObjects)
sift = SiftPattern(List=aoadecon.AssemblageObjects, SiftPattern=aotype)  # -> Output0, Output1

# ---- group: display components / display edges
previewlw_2 = CustomPreviewLineweights(Geometry=cluster_2.edges, Shader=ColourSwatch(SwatchColor=RGB(0, 0, 0)), Thickness=Slider(1, range=1..3), Absolute=False)

# ----
aoplane = ExtractReferencePlane(AssemblyObject=sift.Output0)
aoplane_2 = ExtractReferencePlane(AssemblyObject=sift.Output1)

# ---- group: display components
mjoin = MeshJoin(Meshes=cluster_2.meshes)
preview = CustomPreview(
    Geometry=mjoin,
    Material={diffuse=RGB(221, 160, 221), emission=RGB(66, 48, 66), shine=0.5, specular=RGB(255, 255, 255), transparency=0})

# ---- group: recognize horizontal/vertical
Z = UnitZ(Factor=1)
deplane_2 = DeconstructPlane(Plane=aoplane)  # -> Origin, XAxis, YAxis, ZAxis
dprod = DotProduct(VectorA=deplane_2.XAxis, VectorB=Z, Unitize=False)
abs = Absolute(Value=dprod)
dispatch = Dispatch(List=aoplane, DispatchPattern=abs)  # -> ListA, ListB

# ---- group: vertical elements
# blockA
pln = Plane(dispatch.ListA)

# ---- group: horizontal elements
pln_2 = Plane(dispatch.ListB)

# ----
# blockB
pln_3 = Plane(aoplane_2)
inblock = InsertBlock(BlockName="blockA_v1", SourcePlane=pln)
inblock_2 = InsertBlock(BlockName="blockA_v2", SourcePlane=pln_2)
inblock_3 = InsertBlock(BlockName="blockB", SourcePlane=pln_3)
data = Data([inblock, inblock_2, inblock_3])
bake = BakeObjects(Geometry=data, Bake=Toggle(False))
preview_2 = CustomPreview(
    Geometry=data,
    Material={diffuse=RGB(221, 160, 221), emission=RGB(66, 48, 66), shine=0.5, specular=RGB(255, 255, 255), transparency=0})

# ==== cluster Cluster
environment_meshes = ClusterInput()
colours = ClusterInput()  # First Colour for obstacles, second for containers
normal_size = ClusterInput()
volume = MeshVolume(Mesh=environment_meshes)  # -> Volume, Centroid
smaller = SmallerThan(FirstNumber=volume.Volume, SecondNumber=0)  # -> SmallerThan, OrEqualTo
panel = Panel("""3
1""")
item = ListItem(List=colours, Index=graft(smaller.SmallerThan), Wrap=True)
item_2 = ListItem(List=panel, Index=graft(smaller.SmallerThan), Wrap=True)
medges = MeshEdges(Mesh=environment_meshes)  # -> NakedEdges, InteriorEdges, NonManifoldEdges
facen = FaceNormals(Mesh=environment_meshes)  # -> Centers, Normals
multiplication = Multiplication(A=facen.Normals, B=normal_size)
previewlw = CustomPreviewLineweights(Geometry=medges.InteriorEdges, Shader=graft(item), Thickness=graft(item_2), Absolute=False)
vdisex = VectorDisplayEx(Point=facen.Centers, Vector=multiplication, Colour=graft(item), Width=2)

# ==== cluster Cluster_2
vizmode = ClusterInput()
assemblage = ClusterInput()
type_colors = ClusterInput()
stop_and_go_bool = ClusterInput()
aoadecon = DeconstructAssemblage(Assemblage=assemblage)  # -> AssemblageObjects, AssemblageRules, ReceiverObjectsIndexes, AvailableObjectIndexes, UnreachableObjectIndexes

# ---- group: extract collision meshes
aocmesh = ExtractCollisionMesh(AssemblyObject=aoadecon.AssemblageObjects)

# ----
gate = StreamGate(Stream=aocmesh, Gate=vizmode)  # -> Target0, Target1, Target2, Target3, Target4

# ---- group: extract object type
aotype = ExtractType(AssemblyObject=aoadecon.AssemblageObjects)

# ----
filter = StreamFilter(Gate=stop_and_go_bool, Stream0=gate.Target3)
lng = ListLength(List=gate.Target1)
repeat = RepeatData(Data="0", Length=lng)

# ---- group: display by assemblage sequence
lng_2 = ListLength(List=filter)  # -> expr("x-1", Length)
f_ifroml = IndexesFromList(D=filter)  # -> i; inputs D: list
# ---------- f_ifroml: C# usings ----------
using System.Linq;
# ---------- f_ifroml: C# ----------
   
 /*
    froGH - a sparse collection of (in)utilities for Grasshopper

    Indexes from Number
    code by Alessio Erioli

    froGH by Co-de-iT is licensed under a Creative Commons Attribution 4.0 International License.
    http://creativecommons.org/licenses/by/4.0/

    */
    initComp();
   
    GH_Integer[] indexes = new GH_Integer[D.Count];

    for(int j = 0; j < D.Count; j++)
      indexes[j] = new GH_Integer(j);

    //A = indexes.Sum(j => j.Value); // uses System.Linq Sum selector function - for each GH_Integer j in indexes add its value to the total sum

    i = indexes;
# ---------- f_ifroml: C# additional code ----------
  void initComp(){
    Component.Name = "Indexes from List";
    Component.NickName = "f_iFromL";
    Component.Description = "Generates a list of 0-based integer indexes from a given list of data";
    Component.Params.Input[0].Name = "Data";
    Component.Params.Input[0].Description = "the list to index";
    Component.Params.Output[0].Name = "Indexes";
    Component.Params.Output[0].Description = "the generated indexes";
  }
# ---------- end f_ifroml ----------
one_over_x = OneOverX(Value=lng_2)
multiplication = Multiplication(A=f_ifroml, B=one_over_x)
sqr = Square(Value=multiplication)
gradient = Gradient(
    LowerLimit=0,
    UpperLimit=1,
    Parameter=sqr,
    stops=[0: RGB(0, 0, 0), 0.498: RGB(56, 136, 150), 0.904: RGB(186, 224, 224), 1: RGB(255, 255, 255)])
mcol = MeshColours(Mesh=graft(filter), Colours=graft(gradient))  # -> flatten(Mesh)

# ----
replace = ReplaceItems(List=repeat, Item="1", Indices=aoadecon.AvailableObjectIndexes, Wrap=False)
replace_2 = ReplaceItems(List=replace, Item="2", Indices=aoadecon.UnreachableObjectIndexes, Wrap=False)

# ---- group: occupied/available visualization
saturated = ColourSwatch(SwatchColor=RGB(112, 117, 57))
available = ColourSwatch(SwatchColor=RGB(255, 255, 255))
unreachable = ColourSwatch(SwatchColor=RGB(194, 199, 137))
weave = Weave(Pattern=graft(replace_2), Stream0=saturated, Stream1=available, Stream2=unreachable, NullGaps=False)  # -> simplify(Weave)
mcol_2 = MeshColours(Mesh=graft(gate.Target1), Colours=weave)  # -> flatten(Mesh)

# ----
item = ListItem(List=type_colors, Index=graft(aotype), Wrap=True)  # -> simplify(Item)

# ---- group: display by component type
mcol_3 = MeshColours(Mesh=graft(gate.Target2), Colours=item)  # -> flatten(Mesh)

# ----
mcol_4 = MeshColours(Mesh=gate.Target0, Colours=ColourSwatch(SwatchColor=RGB(255, 255, 255)))
filter_2 = StreamFilter(Gate=vizmode, Stream0=mcol_4, Stream1=mcol_2, Stream2=mcol_3, Stream3=mcol)
filter_3 = StreamFilter(Gate=stop_and_go_bool, Stream0=filter_2)

# ---- group: extract edges with angle tolerance (many meshes)
f_mmeea = MeshesExtractEdgesWithToleranceAngle(Mesh=filter_3, Angle="45")  # -> flatten(InternalEdges), NakedEdges

# ----
meshes = ClusterOutput(filter_2)
edges = ClusterOutput(f_mmeea.InternalEdges)
