# Grasshopper definition 03-00_Fields - construct.gh (Grasshopper 1.0.7)
# Copyright: Co-de-iT
# plug-ins: Human, Assembler, froGH

# Fields from Box
number_slider = Slider(840, range=1..2000)
xy = XYPlane(Origin="2200,0,0")
xy_2 = XYPlane(Origin="4400,0,0")
prot = RotatePlane(Plane=xy, Angle=Slider(0, range=0..3.142))
prot_2 = RotatePlane(Plane=xy_2, Angle=Slider(0, range=0..3.142))
# Fields from Mesh
mesh = Mesh(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)
box = CenterBox(Base="0,0,0", X=number_slider, Y=Slider(1200, range=1..2000), Z=Slider(850, range=1..2000))
box_2 = CenterBox(Base=prot, X=Slider(840, range=1..2000), Y=Slider(1200, range=1..2000), Z=Slider(850, range=1..2000))
X = UnitX(Factor="200000")
move = Move(Geometry=mesh, Motion=X)  # -> Geometry, Transform
f_mmeea = MeshesExtractEdgesWithToleranceAngle(Mesh=[mesh, move.Geometry], Angle=45)  # -> InternalEdges, NakedEdges
scale = Scale(Geometry=box_2, Center=Point(0, 0, 0), Factor="100")  # -> Geometry, Transform
scale_2 = Scale(Geometry=box, Center=Point(0, 0, 0), Factor="100")  # -> Geometry, Transform
previewlw = CustomPreviewLineweights(Geometry=f_mmeea.InternalEdges, Shader=ColourSwatch(SwatchColor=RGB(111, 163, 168)), Thickness="3", Absolute=False)
# Assembler
# 
# Framework for Iterative Assemblages workflow
# 
# code by Alessio Erioli
# 
# v 1.0
# © Co-de-iT 2020 / Creative Commons Attribution-Non Commercial-ShareAlike 4.0 International License
edges = BrepEdges(Brep=scale_2.Geometry)  # -> Naked, Interior, NonManifold
edges_2 = BrepEdges(Brep=scale.Geometry)  # -> Naked, Interior, NonManifold
afieldxyz = ConstructFieldXYZ(Box=scale.Geometry, NCellsX=Slider(13, range=10..30), NCellsY=Slider(13, range=10..30), NCellsZ=Slider(13, range=10..30))  # -> Field, FieldPoints

# ---- group: Construct Field Mesh XYZ
afieldmxyz = ConstructFieldFromMeshXYZ(
    Mesh=move.Geometry,
    Plane=prot_2,
    NCellsX=Slider(10, range=10..30),
    NCellsY=Slider(10, range=10..30),
    NCellsZ=Slider(10, range=10..30))  # -> Field, FieldPoints

# ---- group: Construct Field Mesh N
afieldmn = ConstructFieldFormMeshN(Mesh=mesh, Plane=prot_2, NCells=Slider(10, range=10..30))  # -> Field, FieldPoints

# ----
afieldn = ConstructFieldN(Box=scale_2.Geometry, NCells=Slider(13, range=10..30))  # -> Field, FieldPoints
panel = Panel(afieldn.Field)
panel_2 = Panel(afieldxyz.Field)
previewlw_2 = CustomPreviewLineweights(Geometry=edges.Interior, Shader=ColourSwatch(SwatchColor=RGB(0, 0, 0)), Absolute=False)
previewlw_3 = CustomPreviewLineweights(Geometry=edges_2.Interior, Shader=ColourSwatch(SwatchColor=RGB(255, 255, 255)), Absolute=False)
