# Grasshopper definition 04-00_Exogenous Settings.gh (Grasshopper 1.0.7)
# Copyright: Co-de-iT
# plug-ins: MeshEdit Components, Human, Assembler

global_scale = Panel("100")
box = CenterBox(Base="0,0,0", X=Slider(840, range=1..2000), Y=Slider(1200, range=1..2000), Z=Slider(850, range=1..2000))
scale = Scale(Geometry=box, Center=Point(0, 0, 0), Factor=global_scale)  # -> Geometry, Transform
# Assembler
# 
# Framework for Iterative Assemblages workflow
# 
# code by Alessio Erioli
# 
# v 1.0
# © Co-de-iT 2020 / Creative Commons Attribution-Non Commercial-ShareAlike 4.0 International License
edges = BrepEdges(Brep=scale.Geometry)  # -> Naked, Interior, NonManifold
afieldn = ConstructFieldN(Box=scale.Geometry, NCells=Slider(15, range=10..30))  # -> Field, FieldPoints
previewlw = CustomPreviewLineweights(Geometry=edges.Interior, Shader=ColourSwatch(SwatchColor=RGB(0, 0, 0)), Absolute=False)

# ---- group: polyline
crv = Curve(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)

# ---- group: smooth curve
crv_2 = Curve(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)

# ---- group: attractor curve
crv_3 = Curve(crv)
previewlw_2 = CustomPreviewLineweights(Geometry=crv_3, Shader=ColourSwatch(SwatchColor=RGB(255, 0, 0)), Thickness="5", Absolute=False)

# ---- group: calculate scalar
# curve
crv_cp = CurveClosestPoint(Point=afieldn.FieldPoints, Curve=crv_3)  # -> Point, Parameter, Distance

# ---- group: calculate vector
eval = EvaluateCurve(Curve=crv_3, Parameter=crv_cp.Parameter)  # -> Point, Tangent, Angle

# ----
afpop = PopulateField(Field=afieldn.Field, ScalarValues=crv_cp.Distance, VectorValues=eval.Tangent)

# ---- group: set box as environment container
smesh = SimpleMesh(Brep=scale.Geometry)
flip = MeshFlip(Mesh=smesh)

# ---- group: display Field
blend = BooleanToggle(False)
merge = Merge(Data1=ColourSwatch(SwatchColor=RGB(255, 0, 0)), Data2=ColourSwatch(SwatchColor=RGB(0, 0, 0)))
multiplication = Multiplication(A=eval.Tangent, B=Slider(10, range=1..10))
afcols = ColorFieldByScalar(Field=afpop, Colors=merge, Index=0, Threshold=Slider(0.219, range=0..1), Blend=blend)  # -> Field, Colors
unit = UnitVector(Vector=multiplication)
vdisex = VectorDisplayEx(Point=afieldn.FieldPoints, Vector=multiplication, Colour=unit, Width=2)
preview = CustomPreview(Geometry=afieldn.FieldPoints, Material=afcols.Colors)

# ---- group: Field for Assemblage
data = Data(afcols.Field)

# ----
exoset = ExogeousSettings(
    EnvironmentMeshes=flip,
    EnvironmentMode="1",
    Field=data,
    FieldScalarThreshold=Slider(0.25, range=0..1),
    Sandbox={Plane=PlaneXY(0, 0, 0), X=Domain(-1, 1), Y=Domain(0, 0), Z=Domain(0, 0)})

# ---- group: to Assembler Engine Ex
data_2 = Data(exoset)

# ---- group: display Environment Geometries
obstacles = ColourSwatch(SwatchColor=RGB(115, 124, 148))
containers = ColourSwatch(SwatchColor=RGB(0, 0, 0))
normal_size = Slider(418.166, range=1..1000)
merge_2 = Merge(Data1=obstacles, Data2=containers)
mesh = Mesh(flip)

# ----
multiplication_2 = Multiplication(A=normal_size, B=global_scale)

# ---- group: display Environment Geometries (continued)
cluster = Cluster(environment_meshes=mesh, colours=merge_2, normal_size=multiplication_2)

# ==== cluster Cluster
environment_meshes = ClusterInput()
colours = ClusterInput()  # First Colour for obstacles, second for containers
normal_size = ClusterInput()
volume = MeshVolume(Mesh=environment_meshes)  # -> Volume, Centroid
smaller = SmallerThan(FirstNumber=volume.Volume, SecondNumber=0)  # -> SmallerThan, OrEqualTo
panel = Panel("""3
1""")
item = ListItem(List=colours, Index=graft(smaller.SmallerThan), Wrap=True)
item_2 = ListItem(List=panel, Index=graft(smaller.SmallerThan), Wrap=True)
medges = MeshEdges(Mesh=environment_meshes)  # -> NakedEdges, InteriorEdges, NonManifoldEdges
facen = FaceNormals(Mesh=environment_meshes)  # -> Centers, Normals
multiplication = Multiplication(A=facen.Normals, B=normal_size)
previewlw = CustomPreviewLineweights(Geometry=medges.InteriorEdges, Shader=graft(item), Thickness=graft(item_2), Absolute=False)
vdisex = VectorDisplayEx(Point=facen.Centers, Vector=multiplication, Colour=graft(item), Width=2)
